# Grasshopper definition USE_MAPING.gh (Grasshopper 1.0.7)
# plug-ins: ElkGHComponents, MeshEdit Components

# ---- group: Total Population Zaatari Camp - 2015 (Source: UNICEF / REACH)
number_slider = Slider(6686, range=0..10000)
number_slider_2 = Slider(7666, range=0..10000)
number_slider_3 = Slider(5082, range=0..10000)
number_slider_4 = Slider(5761, range=0..10000)
number_slider_5 = Slider(7232, range=0..10000)
number_slider_6 = Slider(7254, range=0..10000)
number_slider_7 = Slider(6522, range=0..10000)
number_slider_8 = Slider(4605, range=0..10000)
number_slider_9 = Slider(8164, range=0..10000)
number_slider_10 = Slider(4908, range=0..10000)
number_slider_11 = Slider(8507, range=0..10000)
number_slider_12 = Slider(5699, range=0..10000)
surface_district_10 = Surface(<surface referenced from the Rhino model>)
surface_district_11 = Surface(<surface referenced from the Rhino model>)
surface_district_2 = Surface(<surface referenced from the Rhino model>)
surface_district_12 = Surface(<surface referenced from the Rhino model>)
surface_district_5 = Surface(<surface referenced from the Rhino model>)
surface_district_9 = Surface(<surface referenced from the Rhino model>)
surface_district_7 = Surface(<surface referenced from the Rhino model>)
surface_district_1 = Surface(<surface referenced from the Rhino model>)
surface_district_4 = Surface(<surface referenced from the Rhino model>)
surface_district_8 = Surface(<surface referenced from the Rhino model>)
surface_district_3 = Surface(<surface referenced from the Rhino model>)
surface_district_6 = Surface(<surface referenced from the Rhino model>)

# ---- group: Populate srf
populate_geometry = PopulateGeometry(Geometry=surface_district_2, Count=number_slider_2, Seed=1)
populate_geometry_2 = PopulateGeometry(Geometry=surface_district_6, Count=number_slider_5, Seed=1)
populate_geometry_3 = PopulateGeometry(Geometry=surface_district_5, Count=number_slider_4, Seed=1)
populate_geometry_4 = PopulateGeometry(Geometry=surface_district_9, Count=number_slider_10, Seed=1)
populate_geometry_5 = PopulateGeometry(Geometry=surface_district_10, Count=number_slider_7, Seed=1)
populate_geometry_6 = PopulateGeometry(Geometry=surface_district_1, Count=number_slider, Seed=1)
populate_geometry_7 = PopulateGeometry(Geometry=surface_district_3, Count=number_slider_3, Seed=1)
populate_geometry_8 = PopulateGeometry(Geometry=surface_district_7, Count=number_slider_6, Seed=1)
populate_geometry_9 = PopulateGeometry(Geometry=surface_district_11, Count=number_slider_11, Seed=1)
populate_geometry_10 = PopulateGeometry(Geometry=surface_district_8, Count=number_slider_9, Seed=1)
populate_geometry_11 = PopulateGeometry(Geometry=surface_district_12, Count=number_slider_12, Seed=1)
populate_geometry_12 = PopulateGeometry(Geometry=surface_district_4, Count=number_slider_8, Seed=1)
pop_points = Point(populate_geometry_6)
pop_points_2 = Point(populate_geometry)
pop_points_3 = Point(populate_geometry_7)
pop_points_4 = Point(populate_geometry_3)
pop_points_5 = Point(populate_geometry_2)
pop_points_6 = Point(populate_geometry_12)
pop_points_7 = Point(populate_geometry_8)
pop_points_8 = Point(populate_geometry_5)
pop_points_9 = Point(populate_geometry_10)
pop_points_10 = Point(populate_geometry_4)
pop_points_11 = Point(populate_geometry_9)
pop_points_12 = Point(populate_geometry_11)

# ---- group: Zaatari Camp Total Population
pop_points_13 = Point([pop_points, pop_points_2, pop_points_3, pop_points_6, pop_points_4, pop_points_5, pop_points_7, pop_points_9, pop_points_10, pop_points_8, pop_points_11, pop_points_12])  # disabled

# ----
path = FilePath("C:\Users\Juan\OneDrive - Delft University of Technology\Earthy\00_Organisation\map.osm")
loc = Location(FilePathText=path)  # -> OSMPointData, OSMFile, LongitudeDomain, LatitudeDomain

# ----
# SPORTS
osm = OSMData(
    OSMPointData=loc.OSMPointData,
    OSMFilePath=path,
    Feature="leisure",
    Generate3d=False,
    IndividualOutputs=True,
    SelectedTypes="playground")  # -> Playground, FeatureKey
pline = PolyLine(Vertices=osm.Playground, Closed=False)
avr = Average(Input=osm.Playground)
preview = CustomPreview(Geometry=pline, Material=ColourSwatch(SwatchColor=RGB(187, 218, 120)))

# ----
# COMUNITY CENTRES
osm_2 = OSMData(OSMPointData=loc.OSMPointData, OSMFilePath=path, Feature="office", Generate3d=False, IndividualOutputs=False)  # -> Ways, FeatureKey
pline_2 = PolyLine(Vertices=osm_2.Ways, Closed=False)
preview_2 = CustomPreview(Geometry=pline_2, Material=ColourSwatch(SwatchColor=RGB(255, 255, 255)))

# ----
# Use Analysis
# Buildings
osm_3 = OSMData(OSMPointData=loc.OSMPointData, OSMFilePath=path, Feature="amenity", Generate3d=False, IndividualOutputs=False)  # -> Ways, FeatureKey
pline_3 = PolyLine(Vertices=osm_3.Ways, Closed=False)
preview_3 = CustomPreview(Geometry=pline_3, Material=ColourSwatch(SwatchColor=RGB(120, 120, 120)))

# ----
# HOSPITALS
osm_4 = OSMData(
    OSMPointData=loc.OSMPointData,
    OSMFilePath=path,
    Feature="amenity",
    Generate3d=False,
    IndividualOutputs=True,
    SelectedTypes="hospital")  # -> Hospital, FeatureKey
pline_4 = PolyLine(Vertices=osm_4.Hospital, Closed=False)
avr_2 = Average(Input=osm_4.Hospital)
preview_4 = CustomPreview(Geometry=pline_4, Material=ColourSwatch(SwatchColor=RGB(43, 130, 173)))

# ----
# URBAN BLOCKS
osm_5 = OSMData(OSMPointData=loc.OSMPointData, OSMFilePath=path, Feature="boundary", Generate3d=False, IndividualOutputs=False)  # -> Ways, FeatureKey
pline_5 = PolyLine(Vertices=osm_5.Ways, Closed=False)
preview_5 = CustomPreview(Geometry=pline_5, Material=ColourSwatch(SwatchColor=RGB(255, 255, 255)))

# ----
# Office
osm_6 = OSMData(OSMPointData=loc.OSMPointData, OSMFilePath=path, Feature="emergency", Generate3d=False, IndividualOutputs=False)  # -> Ways, FeatureKey; disabled
swatch = ColourSwatch(SwatchColor=RGB(255, 255, 255))  # disabled
pline_6 = PolyLine(Vertices=osm_6.Ways, Closed=False)  # disabled
preview_6 = CustomPreview(Geometry=pline_6, Material=swatch)  # disabled

# ----
# Toile points + Comerce
osm_7 = OSMData(OSMPointData=loc.OSMPointData, OSMFilePath=path, Feature="building", Generate3d=False, IndividualOutputs=False)  # -> Ways, FeatureKey; disabled
swatch_2 = ColourSwatch(SwatchColor=RGB(255, 255, 255))  # disabled
pline_7 = PolyLine(Vertices=osm_7.Ways, Closed=False)  # disabled
preview_7 = CustomPreview(Geometry=pline_7, Material=swatch_2)  # disabled

# ----
# Power
osm_8 = OSMData(OSMPointData=loc.OSMPointData, OSMFilePath=path, Feature="power", Generate3d=False, IndividualOutputs=False)  # -> Ways, FeatureKey; disabled
swatch_3 = ColourSwatch(SwatchColor=RGB(255, 255, 255))  # disabled
pline_8 = PolyLine(Vertices=osm_8.Ways, Closed=False)  # disabled
preview_8 = CustomPreview(Geometry=pline_8, Material=swatch_3)  # disabled

# ----
# roads
osm_9 = OSMData(OSMPointData=loc.OSMPointData, OSMFilePath=path, Feature="highway", Generate3d=False, IndividualOutputs=False)  # -> Ways, FeatureKey; disabled
swatch_4 = ColourSwatch(SwatchColor=RGB(255, 255, 255))  # disabled
pline_9 = PolyLine(Vertices=osm_9.Ways, Closed=False)  # disabled
preview_9 = CustomPreview(Geometry=pline_9, Material=swatch_4)  # disabled

# ----
# shops
osm_10 = OSMData(OSMPointData=loc.OSMPointData, OSMFilePath=path, Feature="shop", Generate3d=False, IndividualOutputs=False)  # -> Ways, FeatureKey; disabled
number_slider_13 = Slider(15, range=0..100)  # disabled
swatch_5 = ColourSwatch(SwatchColor=RGB(255, 255, 255))  # disabled
cir = Circle(Plane=osm_10.Ways, Radius=number_slider_13)  # disabled
preview_10 = CustomPreview(Geometry=cir, Material=swatch_5)  # disabled

# ----
# Borhole
osm_11 = OSMData(OSMPointData=loc.OSMPointData, OSMFilePath=path, Feature="waterway", Generate3d=False, IndividualOutputs=False)  # -> Ways, FeatureKey; disabled
swatch_6 = ColourSwatch(SwatchColor=RGB(255, 255, 255))  # disabled
pline_10 = PolyLine(Vertices=osm_11.Ways, Closed=False)  # disabled
preview_11 = CustomPreview(Geometry=pline_10, Material=swatch_6)  # disabled

# ----
# Water grid
osm_12 = OSMData(OSMPointData=loc.OSMPointData, OSMFilePath=path, Feature="waterway", Generate3d=False, IndividualOutputs=False)  # -> Ways, FeatureKey; disabled
swatch_7 = ColourSwatch(SwatchColor=RGB(255, 255, 255))  # disabled
pline_11 = PolyLine(Vertices=osm_12.Ways, Closed=False)  # disabled
preview_12 = CustomPreview(Geometry=pline_11, Material=swatch_7)  # disabled

boundary = BoundarySurfaces(Edges=pline_2)
area = Area(Geometry=boundary)  # -> Area, Centroid
cir_2 = Circle(Plane=area.Centroid, Radius=Slider(400, range=0..1000))
camp_outline_input = Curve(<curve referenced from the Rhino model>)
boundary_2 = BoundarySurfaces(Edges=cir_2)
boundary_3 = BoundarySurfaces(Edges=camp_outline_input)
runion = RegionUnion(Curves=flatten(boundary_2))
rdiff = RegionDifference(CurvesA=boundary_3, CurvesB=runion)
srf = Surface(graft(rdiff))
incurve = PointInCurve(Point=flatten(pop_points_13), Curve=runion)  # -> Relationship, Point
incurve_2 = PointInCurve(Point=flatten(pop_points_13), Curve=srf)  # -> Relationship, Point
debrep = DeconstructBrep(Brep=srf)  # -> Faces, Edges, Vertices
cull = CullPattern(List=pop_points_13, CullPattern=debrep.Vertices)  # -> flatten(List)
cull_2 = CullPattern(List=pop_points_13, CullPattern=incurve_2.Relationship)  # -> flatten(List)
lng = ListLength(List=cull_2)
lng_2 = ListLength(List=cull)
number_of_people_with_400m_to_the_closes = Panel(lng_2)  # "Number of people with <=400m to the closest facility"
number_of_people_with_400m_to_the_closes_2 = Panel(lng)  # "Number of people with >400m to the closest facility"

boundary_4 = BoundarySurfaces(Edges=pline_4)
area_2 = MeshArea(Mesh=boundary_4)  # -> Area, Centroid
cir_3 = Circle(Plane=area_2.Centroid, Radius=Slider(400, range=0..1000))
boundary_5 = BoundarySurfaces(Edges=cir_3)
camp_outline_input_2 = Curve(<curve referenced from the Rhino model>)
runion_2 = RegionUnion(Curves=flatten(boundary_5))
boundary_6 = BoundarySurfaces(Edges=camp_outline_input_2)
rdiff_2 = RegionDifference(CurvesA=boundary_6, CurvesB=runion_2)
srf_2 = Surface(graft(rdiff_2))
incurve_3 = PointInCurve(Point=flatten(pop_points_13), Curve=srf_2)  # -> Relationship, Point
incurve_4 = PointInCurve(Point=flatten(pop_points_13), Curve=runion_2)  # -> Relationship, Point
debrep_2 = DeconstructBrep(Brep=srf_2)  # -> Faces, Edges, Vertices
cull_3 = CullPattern(List=pop_points_13, CullPattern=incurve_4.Relationship)  # -> flatten(List)
cull_4 = CullPattern(List=pop_points_13, CullPattern=incurve_3.Relationship)  # -> flatten(List)
lng_3 = ListLength(List=cull_3)
lng_4 = ListLength(List=cull_4)
number_of_people_with_400m_to_the_closes_3 = Panel(lng_4)  # "Number of people with >400m to the closest facility"
number_of_people_with_400m_to_the_closes_4 = Panel(lng_3)  # "Number of people with <=400m to the closest facility"

boundary_7 = BoundarySurfaces(Edges=pline)
area_3 = Area(Geometry=boundary_7)  # -> Area, Centroid
cir_4 = Circle(Plane=area_3.Centroid, Radius=Slider(400, range=0..1000))
boundary_8 = BoundarySurfaces(Edges=cir_4)
camp_outline_input_3 = Curve(<curve referenced from the Rhino model>)
runion_3 = RegionUnion(Curves=flatten(boundary_8))
boundary_9 = BoundarySurfaces(Edges=camp_outline_input_3)
rdiff_3 = RegionDifference(CurvesA=boundary_9, CurvesB=runion_3)
srf_3 = Surface(graft(rdiff_3))
incurve_5 = PointInCurve(Point=flatten(pop_points_13), Curve=srf_3)  # -> Relationship, Point
debrep_3 = DeconstructBrep(Brep=srf_3)  # -> Faces, Edges, Vertices
incurve_6 = PointInCurve(Point=graft(pop_points_13), Curve=runion_3)  # -> Relationship, Point
cull_5 = CullPattern(List=pop_points_13, CullPattern=incurve_6.Relationship)  # -> flatten(List)
cull_6 = CullPattern(List=pop_points_13, CullPattern=incurve_5.Relationship)  # -> flatten(List)
lng_5 = ListLength(List=cull_5)
lng_6 = ListLength(List=cull_6)
number_of_people_with_400m_to_the_closes_5 = Panel(lng_5)  # "Number of people with <=400m to the closest facility"
number_of_people_with_400m_to_the_closes_6 = Panel(lng_6)  # "Number of people with >400m to the closest facility"

pipeline = GeometryPipeline(
    GroupByLayer=False,
    GroupByType=False,
    IncludeHidden=True,
    IncludeLocked=True,
    LayerFilter="Existing Youth Centers",
    NameFilter="*",
    SublayerFiltering=True,
    TypeFilter=4)
pipeline_2 = GeometryPipeline(
    GroupByLayer=False,
    GroupByType=False,
    IncludeHidden=True,
    IncludeLocked=True,
    LayerFilter="New Youth Centers",
    NameFilter="*",
    SublayerFiltering=True,
    TypeFilter=1)
# Manualy defined points
contour = Curve(<curve referenced from the Rhino model>)

number_slider_14 = Slider(1000, range=0..10000)  # disabled
voronoi = Voronoi(Points=area_2.Centroid, Radius=number_slider_14, Boundary=contour, BruteForceOverride=False)  # disabled
point_in_curves = PointInCurves(Point=pop_points_13, Curves=graft(voronoi))  # -> Relationship, Index, Point; disabled
cull_pattern = CullPattern(List=pop_points_13, CullPattern=point_in_curves.Relationship)  # disabled
list_length = ListLength(List=cull_pattern)  # disabled
division = Division(A=area_2.Area, B=flatten(list_length))  # disabled

boundary_10 = BoundarySurfaces(Edges=srf_3)
boundary_11 = BoundarySurfaces(Edges=srf_2)
boundary_12 = BoundarySurfaces(Edges=srf)
rint = RegionIntersection(CurvesA=boundary_10, CurvesB=boundary_11)
pt = Point(area_3.Centroid)
rint_2 = RegionIntersection(CurvesA=rint, CurvesB=boundary_12)
boundary_13 = BoundarySurfaces(Edges=rint_2)  # -> flatten(Surfaces)
item = ListItem(List=boundary_13, Index=Slider(0, range=0..10), Wrap=True)
voronoi_2 = Voronoi(Points=flatten(pt), Radius=Slider(4000, range=0..10000), Boundary=contour, BruteForceOverride=False)
number_slider_15 = Slider(10, range=0..10)
sdivide = DivideSurface(Surface=item, UCount=number_slider_15, VCount=number_slider_15)  # -> Points, Normals, Parameters

# ---- group: Exisitng m2/person
panel = Panel(division)  # disabled

# ----
lng_7 = ListLength(List=flatten(sdivide.Points))
division_2 = Division(A=lng_7, B=Slider(2, range=0..10))
series = Series(Start=0, Step=1, Count=division_2)
item_2 = ListItem(List=flatten(sdivide.Points), Index=series, Wrap=True)
panel_2 = Panel(series)

# ---- group: Bpundary lines
camp_outline = Curve(<curve referenced from the Rhino model>)

# ---- group: New number of population with <=400m to the facility vs population with >400m
number_slider_16 = Slider(400, range=0..1000)  # disabled
camp_outline_input_4 = Curve(<curve referenced from the Rhino model>)  # disabled
boundary_14 = BoundarySurfaces(Edges=camp_outline_input_4)  # disabled

# ----
number_slider_17 = Slider(400, range=0..10000)  # disabled
pt_2 = Point([area_2.Centroid, pipeline_2])  # disabled
voronoi_3 = Voronoi(Points=pt_2, Radius=number_slider_17, Boundary=contour, BruteForceOverride=False)  # disabled
point_in_curves_2 = PointInCurves(Point=pop_points_13, Curves=graft(voronoi_3))  # -> Relationship, Index, Point; disabled
cull_pattern_2 = CullPattern(List=pop_points_13, CullPattern=point_in_curves_2.Relationship)  # disabled
bang = ExplodeTree(Data=cull_pattern_2)  # -> Branch0, Branch1, Branch2, Branch3, Branch4, Branch5, Branch6, Branch7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; disabled
pt_3 = Point(bang.Branch13)  # disabled
pt_4 = Point(bang.Branch14)  # disabled
pt_5 = Point(bang.Branch12)  # disabled
pt_6 = Point(bang.Branch15)  # disabled
pt_7 = Point(bang.Branch16)  # disabled
m2_person = Slider(4, range=1..10)  # disabled
lng_8 = ListLength(List=pt_5)  # disabled
lng_9 = ListLength(List=pt_3)  # disabled
lng_10 = ListLength(List=pt_4)  # disabled
lng_11 = ListLength(List=pt_6)  # disabled
lng_12 = ListLength(List=pt_7)  # disabled
multiplication = Multiplication(A=lng_8, B=m2_person)  # disabled
multiplication_2 = Multiplication(A=lng_9, B=m2_person)  # disabled
multiplication_3 = Multiplication(A=lng_10, B=m2_person)  # disabled
multiplication_4 = Multiplication(A=lng_11, B=m2_person)  # disabled
multiplication_5 = Multiplication(A=lng_12, B=m2_person)  # disabled
lng_13 = ListLength(List=cull_pattern_2)  # disabled

# ---- group: New number of population with <=400m to the facility vs population with >400m (continued)
cir_5 = Circle(Plane=pt_2, Radius=number_slider_16)  # disabled
boundary_15 = BoundarySurfaces(Edges=cir_5)  # disabled
runion_4 = RegionUnion(Curves=boundary_15)  # disabled
rdiff_4 = RegionDifference(CurvesA=boundary_14, CurvesB=runion_4)  # disabled
srf_4 = Surface(graft(rdiff_4))  # disabled
incurve_7 = PointInCurve(Point=flatten(pop_points_13), Curve=graft(runion_4))  # -> Relationship, Point; disabled
incurve_8 = PointInCurve(Point=flatten(pop_points_13), Curve=srf_4)  # -> Relationship, Point; disabled
debrep_4 = DeconstructBrep(Brep=srf_4)  # -> Faces, Edges, Vertices; disabled
cull_7 = CullPattern(List=pop_points_13, CullPattern=incurve_7.Relationship)  # -> flatten(List); disabled
cull_8 = CullPattern(List=pop_points_13, CullPattern=incurve_8.Relationship)  # -> flatten(List); disabled
lng_14 = ListLength(List=cull_7)  # disabled
lng_15 = ListLength(List=cull_8)  # disabled
number_of_people_with_400m_to_the_closes_7 = Panel(lng_15)  # "Number of people with >400m to the closest facility"; disabled
number_of_people_with_400m_to_the_closes_8 = Panel(lng_14)  # "Number of people with <=400m to the closest facility"; disabled

# ---- group: m2 area of the new facility
panel_3 = Panel(multiplication)  # disabled
panel_4 = Panel(multiplication_2)  # disabled
panel_5 = Panel(multiplication_3)  # disabled
panel_6 = Panel(multiplication_4)  # disabled
panel_7 = Panel(multiplication_5)  # disabled

# ----
flatten = FlattenTree(Tree=[panel_3, panel_4, panel_5, panel_6, panel_7, area_2.Area], Path="{0}")  # disabled
division_3 = Division(A=flatten, B=flatten(lng_13))  # disabled

# ---- group: New m2/person
panel_8 = Panel(division_3)  # disabled

# ---- group: New buildings
panel_9 = Panel("13")  # disabled
panel_10 = Panel("15")  # disabled
panel_11 = Panel("14")  # disabled
panel_12 = Panel("16")  # disabled
panel_13 = Panel("12")  # disabled
sqrt = SquareRoot(Value=panel_4)  # disabled
sqrt_2 = SquareRoot(Value=panel_6)  # disabled
sqrt_3 = SquareRoot(Value=panel_5)  # disabled
sqrt_4 = SquareRoot(Value=panel_7)  # disabled
sqrt_5 = SquareRoot(Value=panel_3)  # disabled
item_3 = ListItem(List=pt_2, Index=panel_9, Wrap=True)  # disabled
item_4 = ListItem(List=pt_2, Index=panel_10, Wrap=True)  # disabled
item_5 = ListItem(List=pt_2, Index=panel_11, Wrap=True)  # disabled
item_6 = ListItem(List=pt_2, Index=panel_12, Wrap=True)  # disabled
item_7 = ListItem(List=pt_2, Index=panel_13, Wrap=True)  # disabled
rectangle = Rectangle(Plane=item_3, XSize=sqrt, YSize=sqrt, Radius=0)  # -> Rectangle, Length; disabled
rectangle_2 = Rectangle(Plane=item_4, XSize=sqrt_2, YSize=sqrt_2, Radius=0)  # -> Rectangle, Length; disabled
rectangle_3 = Rectangle(Plane=item_5, XSize=sqrt_3, YSize=sqrt_3, Radius=0)  # -> Rectangle, Length; disabled
rectangle_4 = Rectangle(Plane=item_6, XSize=sqrt_4, YSize=sqrt_4, Radius=0)  # -> Rectangle, Length; disabled
rectangle_5 = Rectangle(Plane=item_7, XSize=sqrt_5, YSize=sqrt_5, Radius=0)  # -> Rectangle, Length; disabled
area_4 = Area(Geometry=rectangle.Rectangle)  # -> Area, Centroid; disabled
area_5 = Area(Geometry=rectangle_2.Rectangle)  # -> Area, Centroid; disabled
area_6 = Area(Geometry=rectangle_3.Rectangle)  # -> Area, Centroid; disabled
area_7 = Area(Geometry=rectangle_4.Rectangle)  # -> Area, Centroid; disabled
area_8 = Area(Geometry=rectangle_5.Rectangle)  # -> Area, Centroid; disabled
vec2pt = Vector2Pt(PointA=area_4.Centroid, PointB=item_3, Unitize=False)  # -> Vector, Length; disabled
vec2pt_2 = Vector2Pt(PointA=area_5.Centroid, PointB=item_4, Unitize=False)  # -> Vector, Length; disabled
vec2pt_3 = Vector2Pt(PointA=area_6.Centroid, PointB=item_5, Unitize=False)  # -> Vector, Length; disabled
vec2pt_4 = Vector2Pt(PointA=area_7.Centroid, PointB=item_6, Unitize=False)  # -> Vector, Length; disabled
vec2pt_5 = Vector2Pt(PointA=area_8.Centroid, PointB=item_7, Unitize=False)  # -> Vector, Length; disabled
move = Move(Geometry=rectangle.Rectangle, Motion=vec2pt.Vector)  # -> Geometry, Transform; disabled
move_2 = Move(Geometry=rectangle_2.Rectangle, Motion=vec2pt_2.Vector)  # -> Geometry, Transform; disabled
move_3 = Move(Geometry=rectangle_3.Rectangle, Motion=vec2pt_3.Vector)  # -> Geometry, Transform; disabled
move_4 = Move(Geometry=rectangle_4.Rectangle, Motion=vec2pt_4.Vector)  # -> Geometry, Transform; disabled
move_5 = Move(Geometry=rectangle_5.Rectangle, Motion=vec2pt_5.Vector)  # -> Geometry, Transform; disabled
boundary_16 = BoundarySurfaces(Edges=[move_5.Geometry, move.Geometry, move_3.Geometry, move_2.Geometry, move_4.Geometry])  # disabled

# ---- group: Find random location
# One of the previously manualy defined points
# is choosen for more detailed site location finding
boundary_17 = BoundarySurfaces(Edges=boundary_4)
panel_14 = Panel("""11
10
0""")
area_9 = Area(Geometry=boundary_17)  # -> Area, Centroid
list_item = ListItem(List=area_9.Centroid, Index=panel_14, Wrap=Slider(4, range=0..100))
explode_tree = ExplodeTree(Data=list_item)  # -> Branch0, Branch1, Branch2
circle_3pt = Circle3Pt(PointA=explode_tree.Branch0, PointB=explode_tree.Branch1, PointC=explode_tree.Branch2)  # -> Circle, Plane, Radius
area_10 = Area(Geometry=circle_3pt.Circle)  # -> Area, Centroid
point = Point(area_10.Centroid)

# ---- group: Find random location / Walkable distance radius
cir_6 = Circle(Plane=point, Radius=Slider(400, range=0..1000))

# ---- group: Find random location (continued)
boundary_surfaces = BoundarySurfaces(Edges=cir_6)
populate_geometry_13 = PopulateGeometry(Geometry=boundary_surfaces, Count=20, Seed=1)
point_in_curve = PointInCurve(Point=populate_geometry_13, Curve=camp_outline)  # -> Relationship, Point
cull_9 = CullPattern(List=populate_geometry_13, CullPattern=point_in_curve.Relationship)

# ---- group: Find random location / Walkable distance radius
cir_7 = Circle(Plane=cull_9, Radius=Slider(30, range=0..1000))

# ---- group: Find random location (continued)
list_item_2 = ListItem(List=cir_7, Index=Slider(3, range=0..5), Wrap=True)

# ---- group: Calculate area
point_in_curve_2 = PointInCurve(Curve=list_item_2)  # -> Relationship, Point
construct_domain = ConstructDomain(DomainStart=expr("-x/2", 0), DomainEnd=expr("x/2", 1))
cull_10 = CullPattern(CullPattern=point_in_curve_2.Relationship)
rectangle_6 = Rectangle(Plane=cull_10, XSize=construct_domain, YSize=construct_domain, Radius=0)  # -> Rectangle, Length
area_11 = Area(Geometry=rectangle_6.Rectangle)  # -> Area, Centroid
geometry = Geometry(rectangle_6.Rectangle)
mass_addition = MassAddition(Input=area_11.Area)  # -> Result, PartialResults
boundary_surfaces_2 = BoundarySurfaces(Edges=geometry)

# ----
area_12 = Panel(mass_addition.Result)
