# Grasshopper definition Brick laying Script.gh (Grasshopper 1.0.7)
# plug-ins: Kangaroo2 Components, Bifocals

mesh = Mesh(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)
meshcorners = MeshCorners(Mesh=mesh, Angle=2.35619449)
average = Average(Input=meshcorners)
deconstruct_mesh = DeconstructMesh(Mesh=mesh)  # -> Vertices, Faces, Colours, Normals
list_item = ListItem(List=meshcorners, Index=0, Wrap=True)  # -> Item, Item1, Item2, Item3
list_length = ListLength(List=deconstruct_mesh.Vertices)
line = Line(StartPoint=list_item.Item, EndPoint=list_item.Item2)
line_2 = Line(StartPoint=list_item.Item1, EndPoint=list_item.Item3)
square_root = SquareRoot(Value=list_length)
addition = Addition(A=square_root, B=Slider(0, range=0..30))
surface_from_points = SurfaceFromPoints(Points=deconstruct_mesh.Vertices, UCount=addition, Interpolate=False)
cluster = Cluster_2(geometry=surface_from_points, point_b=average)  # disabled
md_slider = MDSlider(
    SliderMode=0,
    slider_value=Point(0.6404083996, 0.2368190114, 0.5),
    x_domain=Domain(0, 1),
    y_domain=Domain(0, 1),
    z_domain=Domain(0, 1))
surface = Surface(reparameterize(surface_from_points))
evaluate_surface = EvaluateSurface(Surface=reparameterize(surface_from_points), Point=md_slider)  # -> Point, Normal, UDirection, VDirection, Frame
ghpython_script = GhPythonScript(srf=surface, ctr_geo=average, atrac_pt=md_slider)  # -> out, simplify(a), vert_plane, vert_p_local, b, uu; inputs srf: Surface, ctr_geo: Point3d
# ---------- ghpython_script: Python ----------
"""Provides a scripting component.
    Inputs:
        srf: surface to apply bricks
        ctr_geo: center of the srf, on the floor level
        atract_pt: atractor point for first brick
    Output:
        a: origin and normal plane of atractor point
        vert_plane: Vertical plane aligned to cetner
        vert_p_local: Vertical plane aligned locally"""


__author__ = "Thomas Lindemann"
__version__ = "2021.10.12"

import rhinoscriptsyntax as rs
from ghpythonlib import treehelpers as th
import ghpythonlib.components as cp

#Eval surface with point
a = cp.EvaluateSurface(srf, atrac_pt)
a = cp.ListItem(a, [0, 4], 0)


# project point on ground and produce vector
vect_z = cp.VectorXYZ(0,0,-1)
XY_plane = cp.XYPlane(ctr_geo)
proj = cp.ProjectPoint(a[0],vect_z[0] , XY_plane) 
vect_c = cp.Vector2Pt(proj[0], ctr_geo, 1)


#orient vertical plane with base vector (vect_c) towards the center
vert_plane = cp.YZPlane(a[0])
plane_temp = cp.DeconstructPlane(vert_plane)
vert_plane = cp.OrientDirection(vert_plane, plane_temp[0], plane_temp[1], plane_temp[0], vect_c[0])
vert_plane = vert_plane[0]

#orient vertical plane with vector y local toward plane a
p_local = cp.DeconstructPlane(a[1])
vert_p_local = cp.PlaneNormal(a[0], p_local[1])
#vert_p_local = cp.OrientDirection(vert_p_local, plane_temp[0], plane_temp[1], plane_temp[0], p_local[2])
#vert_p_local = vert_p_local[0]
# ---------- end ghpython_script ----------
surface_2 = Surface(surface_from_points)

# ---- group: Size brick
number_slider = Slider(0.3, range=0..1)
number_slider_2 = Slider(0.3, range=0..1)
number_slider_3 = Slider(0.15, range=0..1)
number_slider_4 = Slider(0.1, range=0..1)
mortar = Panel("0.02")

# ----
list_item_2 = ListItem(List=ghpython_script.a, Index=0, Wrap=True)  # -> Item, Item1
yz_plane = YZPlane(Origin=evaluate_surface.Point)
cluster_2 = Cluster(point=evaluate_surface.Point)
plane_normal = PlaneNormal(Origin=Point(0, 0, 0), ZAxis=Vector(0, 0, 1))
plane = Plane(ghpython_script.vert_plane)
plane_2 = Plane(ghpython_script.vert_p_local)
plane_3 = Plane(list_item_2.Item1)
vector_2pt = Vector2Pt(PointA=cluster_2, PointB=average, Unitize=False)  # -> Vector, Length
deconstruct_plane = DeconstructPlane(Plane=yz_plane)  # -> Origin, XAxis, YAxis, ZAxis
panel = Panel(ghpython_script.vert_p_local)
orient_direction = OrientDirection(
    Geometry=yz_plane,
    PointA=deconstruct_plane.Origin,
    DirectionA=deconstruct_plane.XAxis,
    PointB=deconstruct_plane.Origin,
    DirectionB=vector_2pt.Vector)  # -> Geometry, Transform
number_slider_5 = Slider(12, range=0..15)
division = Division(A=number_slider, B=2)
division_2 = Division(A=number_slider_3, B=2)
center_box = CenterBox(Base=PlaneXY(0, 0, 0), X=number_slider, Y=number_slider_3, Z=number_slider_4)
number = Number(mortar)
panel_2 = Panel(ghpython_script.uu)
deconstruct_plane_2 = DeconstructPlane(Plane=orient_direction.Geometry)  # -> Origin, XAxis, YAxis, ZAxis; disabled
circle = Circle(Plane=orient_direction.Geometry, Radius=1)  # disabled
ghpython_script_2 = GhPythonScript(pattern=Slider(2, range=1..2), a=division, b=division_2, d=number, srf=surface, ctr_geo=average, atrac_pt=md_slider)  # -> out, simplify(dictionnary), simplify(rect), simplify(graft(x)), simplify(graft(y)), ang, a, vert_plane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; inputs pattern: Int32, srf: Surface, ctr_geo: Point3d, atrac_pt: Point3d
# ---------- ghpython_script_2: Python ----------
"""Provides a scripting component.
    Inputs:
        pattern: Pattern type
        a: half length of the brick
        b: half width of the brick
        d: thickness of mortar
    Output:
        dictionnary: x, y ,angle of directions
        connections: list of relations
        angle: angles of all directions
        rect: rectangle of pattern
        x: x axis of points neighbors n+1
        y: y axis for points neihgbors n+1
        a: angles of pattern direction
        test: test item"""

__author__ = "Thomas Lindemann"
__version__ = "2021.10.11"

import rhinoscriptsyntax as rs
from ghpythonlib import treehelpers as th
import ghpythonlib.components as cp
from math import pi

# PART ONE
Dirs = {}
Dirs[1] = [2*a+d, 0]
Dirs[2] = [a+b+d, a-b]
Dirs[3] = [a+d/2, 2*b+d]
Dirs[4] = [a-b, a+b+d]
Dirs[5] = [0, 2*b+d]
Dirs[6] = [-a+b,a+b+d]
Dirs[7] = [-a-d/2, 2*b+d]
Dirs[8]= [-a-b-d, a-b]
Dirs[9]= [-2*a-d, 0]
Dirs[10] = [-a-b-d, -a+b]
Dirs[11] = [-a-d/2, -2*b-d]
Dirs[12] = [-a+b, -a-b-d]
Dirs[13] = [0, -2*b-d]
Dirs[14] = [a-b, -a-b-d]
Dirs[15] = [a+d/2, -2*b-d]
Dirs[16] = [a+b+d, -a+b]

#Building all the angle of the consequent directions
cpoint = cp.ConstructPoint(0,0,0)
point_b = []
for i in range(1,17):
    point_b.append(cp.ConstructPoint(Dirs[i][0], Dirs[i][1], 0))
angle = []
vect_0 = cp.Vector2Pt(cpoint, cp.ConstructPoint(1,0,0), 1)
test = []
for i in range(len(point_b)):
    vect_b = cp.Vector2Pt(cpoint, point_b[i], 1)
    test.append(vect_b[0])
    if i < 9:
        ang_temp = cp.Angle(vect_0[0], vect_b[0])
        ang_temp = cp.Degrees(ang_temp[0])
        angle.append(ang_temp)
        Dirs[i+1].append(ang_temp)
    else:
        ang_temp = cp.Angle(vect_0[0], vect_b[0])
        ang_temp = cp.Degrees(ang_temp[0])
        angle.append(180 - ang_temp + 180)
        Dirs[i+1].append(180 - ang_temp + 180)


#Preparing the dictionnary to print (view in GH)
dictionnary = []
for i in range(len(Dirs)):
    dictionnary.append(Dirs[i+1])
dictionnary = th.list_to_tree(dictionnary)


#Dictionnary of connections based on the pattern type
pattern_dict = {1:[Dirs[1], Dirs[3], Dirs[7], Dirs[9], Dirs[11], Dirs[15]], 2:[Dirs[3], Dirs[6], Dirs[8], Dirs[11], Dirs[14], Dirs[16]]}

###2D###
#collect x and y for n+1 points
x = []
for i in range(0, len(pattern_dict[pattern])):
    x.append(pattern_dict[pattern][i][0])
y = []
for i in range(0, len(pattern_dict[pattern])):
    y.append(pattern_dict[pattern][i][1])

#Vectors and Distance of bases pattern
pts = []
dist_pts = []
for i in range(len(x)):
    pts.append(cp.ConstructPoint(x[i], y[i], 0))
    ptz = cp.ConstructPoint(0,0,0)
    dist_temp = cp.Distance(ptz, pts[i])
    dist_pts.append(dist_temp)


# Draw rectangle at those points
rect = []
rect.append(cp.Rectangle(cp.ConstructPoint(-a,-b,0), 2*a, 2*b, 0))
for i in range(len(y)):
    rect.append(cp.Rectangle(cp.ConstructPoint(x[i]-a, y[i]-b,0), 2*a, 2*b, 0))
# make variables output ready


# adapt rectangle for pattern 2
if pattern == 2:
    index = [2, 3, 5, 6]
    for i in range(0, len(index)):
        new = cp.Rectangle(cp.ConstructPoint(x[index[i]-1]-b, y[index[i]-1]-a, 0), 2*b, 2*a, 0)
        rect.pop(index[i])
        rect.insert(index[i], new)
rect = th.list_to_tree(rect)
rect = cp.ListItem(rect, 0, 0)

#Select right angles of selected pattern
ang = []
if pattern == 1:
     indexes = [0, 2, 6, 8, 10, 14]
elif pattern == 2:
    indexes = [2, 5, 7, 10, 13, 15]

for i in range(len(indexes)):
    temp = indexes[i]
    ang.append(angle[temp])



# PART TWO

#Eval surface with point
a = cp.EvaluateSurface(srf, atrac_pt)
a = cp.ListItem(a, [0, 4], 0)


# project point on ground and produce vector
vect_z = cp.VectorXYZ(0,0,-1)
XY_plane = cp.XYPlane(ctr_geo)
proj = cp.ProjectPoint(a[0],vect_z[0] , XY_plane) 
vect_c = cp.Vector2Pt(proj[0], ctr_geo, 1)


#orient vertical plane with base vector (vect_c) towards the center
vert_plane = cp.YZPlane(a[0])
plane_temp = cp.DeconstructPlane(vert_plane)
vert_plane = cp.OrientDirection(vert_plane, plane_temp[0], plane_temp[1], plane_temp[0], vect_c[0])
vert_plane = vert_plane[0]

#orient vertical plane with vector y local toward plane a
p_local = cp.DeconstructPlane(a[1])
vert_p_local = cp.PlaneNormal(a[0], p_local[1])
#vert_p_local = cp.OrientDirection(vert_p_local, plane_temp[0], plane_temp[1], plane_temp[0], p_local[2])
#vert_p_local = vert_p_local[0]
# ---------- end ghpython_script_2 ----------
panel_3 = Panel(ghpython_script_2.ang)
unit_x = UnitX(Factor=1)
xy_plane = XYPlane(Origin=Point(0, 0, 0))
xy_plane_2 = XYPlane(Origin=Point(0, 0, 0))
list_item_3 = ListItem(List=ghpython_script_2.ang, Index=Slider(5, range=0..5), Wrap=True)
vector_display = VectorDisplay(Anchor=deconstruct_plane_2.Origin, Vector=deconstruct_plane_2.XAxis)  # disabled
plane_4 = Plane(evaluate_surface.Frame)
rotate = Rotate(Geometry=unit_x, Angle=degrees(list_item_3), Plane=xy_plane)  # -> Geometry, Transform
list_item_4 = ListItem(Index=0, Wrap=True)  # -> Item, Item1
panel_4 = Panel(ghpython_script_2.uu)
construct_point = ConstructPoint(XCoordinate=ghpython_script_2.x, YCoordinate=ghpython_script_2.y, ZCoordinate=0)
orient = Orient(Geometry=center_box, Source=xy_plane_2, Target=plane_4)  # -> Geometry, Transform
rectangle = Rectangle(Plane=PlaneXY(0, 0, 0), XSize=number_slider, YSize=number_slider_3, Radius=0)  # -> Rectangle, Length
construct_point_2 = ConstructPoint(XCoordinate=list_item_4.Item, YCoordinate=list_item_4.Item1, ZCoordinate=0)
point = Point(Point(0, 0, 0))
vector_display_2 = VectorDisplay(Anchor=point, Vector=rotate.Geometry)
area = Area(Geometry=rectangle.Rectangle)  # -> Area, Centroid
panel_6 = Panel(construct_point)
x_y_angle = Panel(ghpython_script_2.dictionnary)
panel_7 = Panel(ghpython_script_2.test)

# ==== cluster Cluster
unit_z = UnitZ(Factor=1)
xy_plane = XYPlane(Origin=Point(0, 0, 0))
point = ClusterInput()
project_point = ProjectPoint(Point=point, Direction=expr("-x", unit_z), Geometry=xy_plane)  # -> Point, Index
point_2 = ClusterOutput(project_point.Point)

# ==== cluster Cluster_2
point_b = ClusterInput()
geometry = ClusterInput()

number_slider = Slider(1073, range=0..2100)  # disabled
number_slider_2 = Slider(0.01078, range=0..0.2)  # disabled
panel = Panel("360")  # disabled
division = Division(A=panel, B=number_slider)  # disabled
series = Series(Start=0, Step=division, Count=number_slider)  # disabled
number_slider_3 = Slider(16, range=0..100)  # disabled
sine = Sine(Value=series)  # disabled
cosine = Cosine(Value=series)  # disabled
series_2 = Series(Start=0, Step=number_slider_2, Count=number_slider)  # disabled
multiplication = Multiplication(A=cosine, B=number_slider_3)  # disabled
multiplication_2 = Multiplication(A=sine, B=number_slider_3)  # disabled
construct_point = ConstructPoint(XCoordinate=multiplication, YCoordinate=multiplication_2, ZCoordinate=series_2)  # disabled
xy_plane = XYPlane(Origin=Point(0, 0, 0))  # disabled
project_point = ProjectPoint(Point=construct_point, Direction=Vector(0, 0, -1), Geometry=xy_plane)  # -> Point, Index; disabled
vector_2pt = Vector2Pt(PointA=project_point.Point, PointB=point_b, Unitize=False)  # -> Vector, Length; disabled
boolean_toggle = BooleanToggle(True)  # disabled
project_point_2 = ProjectPoint(Point=construct_point, Direction=vector_2pt.Vector, Geometry=geometry)  # -> Point, Index; disabled
clean_tree = CleanTree(RemoveNulls=boolean_toggle, RemoveInvalid=boolean_toggle, RemoveEmpty=boolean_toggle, Tree=project_point_2.Point)  # disabled
point = Point(clean_tree)  # disabled
