# Grasshopper definition Catenary_Catenary.gh (Grasshopper 1.0.7)

style_of_connection_to_other_modules = Slider(0, range=0..4)
amount_of_arches = Slider(5, range=2..20)
offset_y_opening = Slider(0.23, range=0..1.2)
width_of_cat_a = Slider(2, range=0..10)
length_cat_a = Slider(1.31, range=1..2)
amount_cat_a = Slider(2, range=2..20)
length_cat_b = Slider(1.306, range=1..1.5)
length_cat_c = Slider(2.604, range=1..10.5)
span_cat_a = Slider(8, range=0..40)
tartan_grid = Panel("0.45")
grid_size = Panel("1.20")

off_set_x_opening = Slider(0.3, range=0..1)
panel = Panel("actualise data dam")

# ---- group: substracting the offset to match
multiplication = Multiplication(A=span_cat_a, B=grid_size)
multiplication_2 = Multiplication(A=off_set_x_opening, B=2)
subtraction = Subtraction(A=multiplication, B=multiplication_2)

# ----
cluster = Cluster(A_3=subtraction, A_2=tartan_grid, A=span_cat_a)

# ---- group: adding final tartan at end
multiplication_3 = Multiplication(A=tartan_grid, B=2)
addition = Addition(A=multiplication_3, B=cluster)

# ---- group: starting point
panel_2 = Panel("0,0,0")

# ---- group: adjusting to Juanito's grid
point = Point(Point(-0.3000000119, 0.2300000042, 0))
point_2 = Point(Point(-0.2250003964, 0.4549999833, 0))
vector_2pt = Vector2Pt(PointA=point, PointB=point_2, Unitize=False)  # -> Vector, Length
move = Move(Geometry=panel_2, Motion=vector_2pt.Vector)  # -> Geometry, Transform

# ----
panel_3 = Panel("re-adjust param.")
panel_4 = Panel("Go to bake")

multiplication_4 = Multiplication(A=cluster, B=length_cat_a)
multiplication_5 = Multiplication(A=grid_size, B=width_of_cat_a)
unit_x = UnitX(Factor=addition)
move_2 = Move(Geometry=move.Geometry, Motion=unit_x)  # -> Geometry, Transform
series = Series(Start=0, Step=1, Count=amount_cat_a)
catenary = Catenary(PointA=move.Geometry, PointB=move_2.Geometry, Length=multiplication_4, Gravity=expr("-x", Vector(0, 0, -1)))
list_length = ListLength(List=series)
cull_index = CullIndex(List=series, Indices=expr("x-1", list_length), Wrap=True)
list_item = ListItem(List=series, Index=graft(cull_index), Wrap=True)  # -> Item, Item1
multiplication_6 = Multiplication(A=multiplication_5, B=length_cat_b)
loft_options = LoftOptions(Closed=False, Adjust=Toggle(True), Rebuild=0, Refit=0, Type=0)

cluster_2 = Cluster_2(A_3=multiplication_5, A_2=tartan_grid, A=width_of_cat_a)

unit_y = UnitY(Factor=cluster_2)
linear_array = LinearArray(Geometry=catenary, Direction=unit_y, Count=amount_cat_a)  # -> Geometry, Transform
divide_curve = DivideCurve(Curve=linear_array.Geometry, Count=Slider(15, range=0..100), Kinks=False)  # -> simplify(Points), Tangents, Parameters
tree_branch = TreeBranch(Tree=divide_curve.Points, Path=list_item.Item, MaintainPaths=False)
tree_branch_2 = TreeBranch(Tree=divide_curve.Points, Path=list_item.Item1, MaintainPaths=False)
catenary_2 = Catenary(PointA=tree_branch, PointB=tree_branch_2, Length=multiplication_6, Gravity=expr("-x", Vector(0, 0, -1)))
loft = Loft(Curves=catenary_2, Options=loft_options)
brep_join = BrepJoin(Breps=flatten(loft))  # -> Breps, Closed

end_points = EndPoints(Curve=linear_array.Geometry)  # -> graft(Start), graft(End)
data = Data(simplify([end_points.End, end_points.Start]))
flip_matrix = FlipMatrix(Data=data)
unit_y_2 = UnitY(Factor=offset_y_opening)
list_item_2 = ListItem(List=flip_matrix, Index=0, Wrap=True)  # -> Item, Item1
move_3 = Move(Geometry=list_item_2.Item1, Motion=expr("-x", unit_y_2))  # -> Geometry, Transform
move_4 = Move(Geometry=list_item_2.Item, Motion=unit_y_2)  # -> Geometry, Transform
merge = Merge(Data1=move_4.Geometry, Data2=move_3.Geometry)
multiplication_7 = Multiplication(A=multiplication_5, B=length_cat_c)
list_item_3 = ListItem(List=merge, Index=0, Wrap=True)  # -> Item, Item1
catenary_3 = Catenary(PointA=list_item_3.Item, PointB=list_item_3.Item1, Length=multiplication_7, Gravity=expr("-x", Vector(0, 0, -1)))  # -> simplify(Catenary)

stream_filter = StreamFilter(Gate=style_of_connection_to_other_modules, Stream0=catenary_3, Stream1="other shapes")  # -> flatten(Stream)

# ---- group: Proceed with mesh generation
data_dam = DataDam(DataA=brep_join.Breps, BufferDelay=10000000, BufferMode=0)
data_dam_2 = DataDam(DataA=stream_filter, BufferDelay=10000000, BufferMode=0)

# ---- group: Extra vault Cat-C
unit_x_2 = UnitX(Factor=off_set_x_opening)
list_item_4 = ListItem(List=flatten(stream_filter), Index=0, Wrap=True)  # -> Item, Item1
extrude = Extrude(Base=list_item_4.Item1, Direction=expr("-x", unit_x_2))
extrude_2 = Extrude(Base=list_item_4.Item, Direction=unit_x_2)
merge_2 = Merge(Data1=extrude_2, Data2=extrude)

# ---- group: Triangle correction
list_length_2 = ListLength(List=catenary_2)  # -> expr("x-1", Length)
list_item_5 = ListItem(List=catenary_2, Index=[list_length_2, "0"], Wrap=True)
curve_curve = CurveCurve(CurveA=list_item_5, CurveB=flatten(catenary_3))  # -> reverse(simplify(Points)), ParamsA, ParamsB
shatter = Shatter(Curve=graft(list_item_5), Parameters=simplify(curve_curve.ParamsA))
list_item_6 = ListItem(List=simplify(shatter), Index=["0", "2"], Wrap=True)
list_item_7 = ListItem(List=list_item_6, Index=0, Wrap=True)  # -> Item, Item1
flip_curve = FlipCurve(Curve=list_item_7.Item)  # -> Curve, Flag
merge_3 = Merge(Data1=flip_curve.Curve, Data2=list_item_7.Item1)
tree_branch_3 = TreeBranch(Tree=merge_3, Path="1", MaintainPaths=True)
tree_branch_4 = TreeBranch(Tree=merge_3, Path="0", MaintainPaths=True)
move_5 = Move(Geometry=list_item_4.Item, Motion=expr("x/2", unit_x_2))  # -> Geometry, Transform
reverse_list = ReverseList(List=tree_branch_4)
move_6 = Move(Geometry=list_item_4.Item1, Motion=expr("-x/2", unit_x_2))  # -> Geometry, Transform
merge_4 = Merge(Data1=tree_branch_3, Data2=reverse_list)
flip_curve_2 = FlipCurve(Curve=move_5.Geometry)  # -> Curve, Flag
end_points_2 = EndPoints(Curve=merge_4)  # -> Start, End
merge_5 = Merge(Data1=flip_curve_2.Curve, Data2=move_6.Geometry)
flip_matrix_2 = FlipMatrix(Data=merge_4)  # -> simplify(Data)
end_points_3 = EndPoints(Curve=merge_5)  # -> graft(Start), graft(End)
flip_matrix_3 = FlipMatrix(Data=end_points_2.Start)
flip_matrix_4 = FlipMatrix(Data=end_points_2.End)
data_2 = Data([end_points_3.Start, end_points_3.End])
flip_matrix_5 = FlipMatrix(Data=data_2)
line = Line(StartPoint=flip_matrix_3, EndPoint=flip_matrix_5)  # -> simplify(Line)
line_2 = Line(StartPoint=flip_matrix_5, EndPoint=flip_matrix_4)  # -> simplify(Line)
join_curves = JoinCurves(Curves=[line, line_2, flip_matrix_2], Preserve=False)
fragment_patch = FragmentPatch(Boundary=join_curves)

# ---- group: Cutting & meshing
unit_x_3 = UnitX(Factor=expr("x/2.5", multiplication))
list_item_8 = ListItem(List=data_dam_2, Index=0, Wrap=True)  # -> Item, Item1
extrude_3 = Extrude(Base=list_item_8.Item, Direction=expr("-x", unit_x_3))
extrude_4 = Extrude(Base=list_item_8.Item1, Direction=unit_x_3)
brep_join_2 = BrepJoin(Breps=flatten([extrude_3, extrude_4]))  # -> Breps, Closed
split_brep_multiple = SplitBrepMultiple(Brep=data_dam, Cutters=brep_join_2.Breps)
split_brep_multiple_2 = SplitBrepMultiple(Brep=brep_join_2.Breps, Cutters=data_dam)  # -> simplify(Result)
area = Area(Geometry=split_brep_multiple_2)  # -> Area, Centroid
area_2 = Area(Geometry=split_brep_multiple)  # -> Area, Centroid
sort_list = SortList(Keys=area_2.Area, ValuesValuesA=split_brep_multiple)  # -> Keys, ValuesValuesA
sort_list_2 = SortList(Keys=area.Area, ValuesValuesA=split_brep_multiple_2)  # -> Keys, reverse(ValuesValuesA)
list_item_9 = ListItem(List=reverse(sort_list.ValuesValuesA), Index=0, Wrap=True)
list_length_3 = ListLength(List=sort_list_2.ValuesValuesA)
list_item_10 = ListItem(List=reverse(linear_array.Geometry), Index=0, Wrap=True)
cull_index_2 = CullIndex(List=sort_list_2.ValuesValuesA, Indices=list_length_3, Wrap=True)
unit_y_3 = UnitY(Factor=tartan_grid)
extrude_5 = Extrude(Base=list_item_10, Direction=unit_y_3)
brep_join_3 = BrepJoin(Breps=flatten([cull_index_2, list_item_9, merge_2, fragment_patch]))  # -> Breps, Closed
mesh_brep = MeshBrep(
    Brep=extrude_5,
    Settings={GridMaxCount=0, GridMinCount=16, JaggedSeams=False, MaxEdgeLength=0, MinEdgeLength=0.0001, MinTolerance=0, Refine=True, RefineAngle=0, RelativeTolerance=0.65, SimplePlanes=True, Tolerance=0})
mesh_brep_2 = MeshBrep(
    Brep=brep_join_3.Breps,
    Settings={GridMaxCount=0, GridMinCount=16, JaggedSeams=False, MaxEdgeLength=0, MinEdgeLength=0.0001, MinTolerance=0, Refine=True, RefineAngle=0, RelativeTolerance=0.65, SimplePlanes=True, Tolerance=0})
data_3 = Data(amount_of_arches)
addition_2 = Addition(A=unit_y, B=unit_y_3)
linear_array_2 = LinearArray(Geometry=mesh_brep, Direction=addition_2, Count=expr("x-1", data_3))  # -> Geometry, Transform
linear_array_3 = LinearArray(Geometry=mesh_brep_2, Direction=addition_2, Count=data_3)  # -> Geometry, Transform
mesh_join = MeshJoin(Meshes=[linear_array_3.Geometry, linear_array_2.Geometry])

# ----
custom_preview = CustomPreview(
    Geometry=mesh_join,
    Material={diffuse=RGB(221, 160, 221), emission=RGB(66, 48, 66), shine=0.5, specular=RGB(255, 255, 255), transparency=0})

# ==== cluster Cluster
A = ClusterInput()
A_2 = ClusterInput()
A_3 = ClusterInput()
subtraction = Subtraction(A=A, B=1)
multiplication = Multiplication(A=A_2, B=subtraction)
addition = Addition(A=A_3, B=multiplication)
result = ClusterOutput(addition)

# ==== cluster Cluster_2
A = ClusterInput()
subtraction = Subtraction(A=A, B=1)
A_2 = ClusterInput()
multiplication = Multiplication(A=A_2, B=subtraction)
A_3 = ClusterInput()
addition = Addition(A=A_3, B=multiplication)
result = ClusterOutput(addition)
