# Grasshopper definition Ribs_2x3.gh (Grasshopper 1.0.7)

arc_rib_guide = Curve(<curve referenced from the Rhino model>)
data = Data(arc_rib_guide)
amount_of_blocks = Slider(12, range=0..15)
peak_frame = Slider(0, range=0..100)

# ---- group: Rib Profile
arc_rib_guide_2 = Curve(<curve referenced from the Rhino model>)

# ----
area = Area(Geometry=arc_rib_guide_2)  # -> Area, Centroid
number_slider = Slider(-0.6, range=-2..2)

# ---- group: center
data_2 = Data(area.Centroid)

# ---- group: crv
data_3 = Data(arc_rib_guide_2)

# ----
xy = XYPlane(Origin=data_2)
rotate = Rotate(Geometry=xy, Angle=degrees(Slider(-45, range=-180..180)), Plane=data_2)  # -> Geometry, Transform
arc_rib_guide_3 = Curve(<curve referenced from the Rhino model>)
arc_rib_guide_4 = Curve(<curve referenced from the Rhino model>)
data_4 = Data(amount_of_blocks)
data_5 = Data(number_slider)
arc_rib_guide_5 = Curve(<curve referenced from the Rhino model>)
arc_rib_guide_6 = Curve(<curve referenced from the Rhino model>)
end = EndPoints(Curve=arc_rib_guide_3)  # -> Start, End
flip = FlipCurve(Curve=arc_rib_guide_6)  # -> Curve, Flag
arc_for_rib = Data(arc_rib_guide_4)
data_6 = Data(amount_of_blocks)
data_7 = Data(number_slider)
arc_rib_guide_7 = Curve(<curve referenced from the Rhino model>)
arc_rib_guide_8 = Curve(<curve referenced from the Rhino model>)
data_8 = Data(amount_of_blocks)
data_9 = Data(number_slider)
cluster = Cluster_3(
    relay=arc_for_rib,
    G=arc_for_rib,
    C_2=arc_for_rib,
    number_of_rib_parts=data_4,
    C=arc_for_rib,
    B=data_5,
    profile_curve=arc_rib_guide_5,
    profile_plane=arc_rib_guide_5)  # -> rib_parts, rib_parts_2, item_1, i
cluster_2 = Cluster(
    arc_for_rib=flip.Curve,
    number_of_rib_parts=data_6,
    B=data_7,
    profile_curve=arc_rib_guide_7,
    profile_plane=arc_rib_guide_7)  # -> rib_parts, rib_parts_2, item_1, i
cluster_3 = Cluster(
    arc_for_rib=arc_rib_guide_3,
    number_of_rib_parts=data_8,
    B=data_9,
    profile_curve=arc_rib_guide_8,
    profile_plane=arc_rib_guide_8)  # -> rib_parts, rib_parts_2, item_1, i
neg = Negative(Value=Slider(0.18, range=0.01..1))
Z = UnitZ(Factor=neg)
Z_2 = UnitZ(Factor=Slider(0.19, range=0.01..1))
end_2 = EndPoints(Curve=cluster_2.item_1)  # -> Start, End
data_10 = Data(cluster_3.i)
move = Move(Geometry=end.Start, Motion=Z)  # -> Geometry, Transform
move_2 = Move(Geometry=end.Start, Motion=Z_2)  # -> Geometry, Transform
end_3 = EndPoints(Curve=cluster.i)  # -> Start, End
end_4 = EndPoints(Curve=cluster_2.i)  # -> Start, End
end_5 = EndPoints(Curve=data_10)  # -> Start, End
fmerge = MergeFaces(Brep=cluster_2.rib_parts)  # -> Breps, Before, After
fmerge_2 = MergeFaces(Brep=cluster_2.rib_parts_2)  # -> Breps, Before, After
amp = Amplitude(Vector=cluster_3.i, Amplitude=Slider(0.45, range=0.01..2))
polygon = Polygon(Plane=end_2.End, Radius=amp, Segments=Slider(7, range=1..8), FilletRadius=0)  # -> Polygon, Length
ln = Line(StartPoint=end_3.End, EndPoint=move_2.Geometry)
ln_2 = Line(StartPoint=end_3.End, EndPoint=move.Geometry)
ln_3 = Line(StartPoint=end_4.End, EndPoint=move_2.Geometry)
ln_4 = Line(StartPoint=end_4.End, EndPoint=move.Geometry)
ln_5 = Line(StartPoint=end_5.End, EndPoint=move_2.Geometry)
ln_6 = Line(StartPoint=end_5.End, EndPoint=move.Geometry)
debrep = DeconstructBrep(Brep=polygon.Polygon)  # -> Faces, Edges, Vertices
ln_7 = Line(StartPoint=end_5.End, EndPoint=end_3.End)
ln_8 = Line(StartPoint=end_3.End, EndPoint=end_4.End)
item = ListItem(List=debrep.Vertices, Index=Slider(3, range=0..6), Wrap=True)  # -> graft(Item)
item_2 = ListItem(List=debrep.Vertices, Index=Slider(2, range=0..6), Wrap=True)  # -> graft(Item)
Y = UnitY(Factor=1)
X = UnitX(Factor=1)
ln_9 = Line(StartPoint=item_2, EndPoint=item)
Y_2 = UnitY(Factor=1)
line = LineSDL(Start=item, Direction=expr("x*(-1)", Y), Length=Slider(0.45, range=0..1))
line_2 = LineSDL(Start=item_2, Direction=X, Length=Slider(0.45, range=0..1))
Y_3 = UnitY(Factor=1)
end_6 = EndPoints(Curve=line)  # -> Start, End
X_2 = UnitX(Factor=1)
end_7 = EndPoints(Curve=line_2)  # -> Start, End
line_3 = LineSDL(Start=end_6.End, Direction=X_2, Length=1)
line_4 = LineSDL(Start=end_7.End, Direction=expr("x*(-1)", Y_3), Length=1)
data_11 = Data(end.Start)
ccx = CurveCurve(CurveA=line_4, CurveB=line_3)  # -> Points, ParamsA, graft(ParamsB)
peak_frame_2 = Slider(21, range=0..100)
peak_frame_3 = Slider(6, range=0..100)
peak_frame_4 = Slider(1, range=0..100)
ln_10 = Line(StartPoint=ccx.Points, EndPoint=[end_7.End, end_6.End])
ln_11 = Line(StartPoint=end_7.Start, EndPoint=end_7.End)
ln_12 = Line(StartPoint=end_6.Start, EndPoint=end_6.End)
len = Length(Curve=ln_11)
join = JoinCurves(Curves=[ln_11, ln_10, ln_12, ln_9], Preserve=False)
panel = Panel(len)
Z_3 = UnitZ(Factor=Slider(0.25, range=0..1))
extr = Extrude(Base=join, Direction=Z_3)
boundary = BoundarySurfaces(Edges=join)
join_2 = BrepJoin(Breps=[extr, boundary])  # -> Breps, Closed
Z_4 = UnitZ(Factor=Slider(0.15, range=0..1))
cap = CapHoles(Brep=join_2.Breps)
neg_2 = Negative(Value=Z_4)
move_3 = Move(Geometry=cap, Motion=neg_2)  # -> Geometry, Transform
debrep_2 = DeconstructBrep(Brep=move_3.Geometry)  # -> Faces, Edges, Vertices
lng = ListLength(List=debrep_2.Edges)
scale_nu = ScaleNU(
    Geometry=move_3.Geometry,
    Plane=Plane(origin=(21.90534806, 8.910922377, -0.15), x=(-0.8076714697, 0.5896327646, 0), y=(-0.5896327646, -0.8076714697, 0)),
    ScaleX=Slider(1.11, range=0..3),
    ScaleY=Slider(1.11, range=0..3),
    ScaleZ=1)  # -> Geometry, Transform
series = Series(Start=0, Step=1, Count=lng)
filedge = FilletEdge(Shape=scale_nu.Geometry, Blend=0, Metric=0, Edges=series, Radii=Slider(0.03, range=0.01..2))

project = Project(Geometry=data, Plane=PlaneXY(0, 0, 0))  # -> Geometry, Transform
divide = DivideCurve(Curve=project.Geometry, Count=amount_of_blocks, Kinks=False)  # -> Points, Tangents, Parameters

cull_i = CullIndex(List=divide.Points, Indices=flatten(peak_frame), Wrap=True)

line_5 = LineSDL(Start=cull_i, Direction=Vector(0, 0, 1), Length="50")
ccx_2 = CurveCurve(CurveA=data, CurveB=line_5)  # -> Points, ParamsA, ParamsB

shatter = Shatter(Curve=data, Parameters=flatten(ccx_2.ParamsA))  # -> simplify(graft(Segments))
pframe = PerpFrame(Curve=data, Parameter=ccx_2.ParamsA)
end_8 = EndPoints(Curve=shatter)  # -> Start, End
deplane = DeconstructPlane(Plane=pframe)  # -> simplify(Origin), simplify(XAxis), simplify(YAxis), simplify(ZAxis)
ln_13 = Line(StartPoint=end_8.Start, EndPoint=end_8.End)
len_2 = Length(Curve=ln_13)
amp_2 = Amplitude(Vector=simplify(ln_13), Amplitude=len_2)

panel_2 = Panel(len_2)
multiplication = Multiplication(A=amp_2, B=number_slider)  # -> simplify(Result)
data_12 = Data(simplify(multiplication))
orient = Orient(Geometry=data_3, Source=simplify(flatten(rotate.Geometry)), Target=pframe)  # -> Geometry, Transform

# ---- group: Weight Ribs Optimization
smaller_radius = Slider(0.136, range=0.001..1)  # disabled
lng_2 = ListLength(List=flatten(pframe))  # disabled
repeat = RepeatData(Data=smaller_radius, Length=lng_2)  # disabled
series_2 = Series(Start=0, Step=1, Count=lng_2)  # disabled
bnd = Bounds(Numbers=series_2)  # disabled
number_slider_2 = Slider(4.9, range=0..10)  # disabled
number_slider_3 = Slider(7.35, range=0..10)  # disabled
remap = RemapNumbers(Value=series_2, Source=bnd, Target=Domain(0, 1))  # -> Mapped, Clipped; disabled
graph = GraphMapper(remap.Mapped, x0=0, x1=1, y0=0, y1=1, container_name="Bezier", cpx=[0, 0, 1, 1], cpy=[0, 0.4428026676, 0.6420369744, 1])  # disabled
dom = ConstructDomain(DomainStart=number_slider_2, DomainEnd=number_slider_3)  # disabled
remap_2 = RemapNumbers(Value=graph, Source=Domain(0, 1), Target=dom)  # -> Mapped, Clipped; disabled
multiplication_2 = Multiplication(A=remap_2.Mapped, B=repeat)  # disabled
rev = ReverseList(List=reverse(multiplication_2))  # -> simplify(graft(List)); disabled
scale = Scale(Geometry=orient.Geometry, Center=deplane.Origin, Factor=rev)  # -> simplify(Geometry), Transform; disabled

# ---- group: Scaled Profiles
data_13 = Data(scale.Geometry)

# ----
extr_2 = Extrude(Base=simplify(orient.Geometry), Direction=data_12)
panel_3 = Panel(scale.Geometry)

# ---- group: Main Rib Geometry
capex = CapHolesEx(Brep=extr_2)  # -> Brep, Caps, Solid

# ----
item_3 = ListItem(List=flatten(ln_13), Index=0, Wrap=True)
end_9 = EndPoints(Curve=item_3)  # -> Start, End
ln_14 = Line(StartPoint=end_9.End, EndPoint=move_2.Geometry)
ln_15 = Line(StartPoint=end_9.End, EndPoint=move.Geometry)
ln_16 = Line(StartPoint=end_9.End, EndPoint=end_4.End)
ln_17 = Line(StartPoint=end_9.End, EndPoint=end_5.End)

main_ribs = CullPattern(List=flatten(capex.Brep), CullPattern=[False, True])
cull = CullPattern(List=flatten(capex.Brep), CullPattern=[True, False])

merge = Merge(
    Data1=[ln_5, ln_14, ln_17],
    Data2=[ln_15, ln_6, ln_17],
    Data3=[ln_14, ln_16, ln_3],
    Data4=[ln_16, ln_4, ln_15],
    Data5=[ln, ln_3, ln_8],
    Data6=[ln_4, ln_8, ln_2],
    Data7=[ln, ln_5, ln_7],
    Data8=[ln_7, ln_2, ln_6])
boundary_2 = BoundarySurfaces(Edges=merge)
join_3 = BrepJoin(Breps=boundary_2)  # -> Breps, Closed
scale_2 = Scale(Geometry=join_3.Breps, Center=data_11, Factor=Slider(3.1, range=0..5))  # -> Geometry, Transform
debrep_3 = DeconstructBrep(Brep=scale_2.Geometry)  # -> Faces, Edges, Vertices
lng_3 = ListLength(List=debrep_3.Edges)
series_3 = Series(Start=0, Step=1, Count=lng_3)
panel_4 = Panel(series_3)

# ---- group: Connections
debrep_4 = DeconstructBrep(Brep=capex.Brep)  # -> Faces, Edges, Vertices

# ---- group: Connections / Connection faces
item_4 = ListItem(List=debrep_4.Faces, Index=Slider(13, range=0..20), Wrap=True)  # -> flatten(Item)
item_5 = ListItem(List=debrep_4.Faces, Index=Slider(12, range=0..20), Wrap=True)  # -> flatten(Item)

# ---- group: Connections (continued)
lng_4 = ListLength(List=item_5)  # -> flatten(Length)
merge_2 = Merge(Data1=item_4, Data2=item_5)  # -> simplify(Result)
series_4 = Series(Start=0, Step=1, Count=lng_4)  # -> simplify(graft(Series))
addition = Addition(A=series_4, B=lng_4, C=1)
item_6 = ListItem(List=merge_2, Index=series_4, Wrap=True)
item_7 = ListItem(List=merge_2, Index=addition, Wrap=True)
debrep_5 = DeconstructBrep(Brep=item_6)  # -> Faces, Edges, Vertices
debrep_6 = DeconstructBrep(Brep=item_7)  # -> Faces, Edges, Vertices
join_4 = JoinCurves(Curves=debrep_6.Edges, Preserve=False)
join_5 = JoinCurves(Curves=debrep_5.Edges, Preserve=False)
flip_2 = FlipCurve(Curve=join_5)  # -> Curve, Flag
loft = Loft(
    Curves=[flip_2.Curve, join_4],
    Options={Adjust=False, Closed=False, LoftEnds=0, LoftSimp=0, LoftType=0, Rebuild=10, Refit=0.01})  # -> simplify(Loft)
lng_5 = ListLength(List=flatten(loft))
subtraction = Subtraction(A=lng_5, B=1)
cull_i_2 = CullIndex(List=flatten(loft), Indices=subtraction, Wrap=True)  # -> simplify(List)

# ---- group: Divide Geometry
item_8 = ListItem(List=debrep_5.Vertices, Index=Slider(2, range=0..40), Wrap=True)
item_9 = ListItem(List=debrep_5.Vertices, Index=Slider(22, range=0..40), Wrap=True)
ln_18 = Line(StartPoint=item_8, EndPoint=item_9)  # -> simplify(Line)
debrep_7 = DeconstructBrep(Brep=cull_i_2)  # -> Faces, Edges, Vertices
item_10 = ListItem(List=debrep_7.Edges, Index=Slider(34, range=0..40), Wrap=True)
len_3 = Length(Curve=item_10)
amp_3 = Amplitude(Vector=item_10, Amplitude=len_3)
multiplication_3 = Multiplication(A=amp_3, B=Slider(1, range=0..1))
extr_3 = Extrude(Base=ln_18, Direction=multiplication_3)  # -> simplify(flatten(Extrusion))

# ----
lng_6 = ListLength(List=extr_3)
culln = CullNth(List=extr_3, CullFrequency=lng_6)
split = SplitBrep(Brep=cull_i_2, Cutter=culln)
item_11 = ListItem(List=split, Index=0, Wrap=True)  # -> flatten(Item1), flatten(Item)

# ---- group: Lower Part Connection
join_6 = BrepJoin(Breps=[item_11.Item1, extr_3])  # -> simplify(Breps), Closed
lng_7 = ListLength(List=join_6.Breps)
cull_i_3 = CullIndex(List=join_6.Breps, Indices=expr("x-1", lng_7), Wrap=True)
cap_2 = CapHoles(Brep=cull_i_3)  # -> simplify(graft(Brep))
cull_2 = CullPattern(List=flatten(cap_2), CullPattern=[True, False])
cull_3 = CullPattern(List=flatten(cap_2), CullPattern=[False, True])

# ---- group: Upper Part Connection
join_7 = BrepJoin(Breps=[item_11.Item, extr_3])  # -> Breps, Closed
lng_8 = ListLength(List=join_6.Breps)
cull_i_4 = CullIndex(List=join_7.Breps, Indices=expr("x-1", lng_8), Wrap=True)
cap_3 = CapHoles(Brep=cull_i_4)  # -> simplify(graft(Brep))
cull_4 = CullPattern(List=flatten(cap_3), CullPattern=[False, True])
cull_5 = CullPattern(List=flatten(cap_3), CullPattern=[True, False])

# ----
panel_5 = Panel(cap_3)
sunion = SolidUnion(Breps=[cull_2, main_ribs, cull_4])

# ---- group: Lower Piece for Keystone
peak_frame_5 = Slider(0, range=0..100)
peak_frame_6 = Slider(0, range=0..100)
peak_frame_7 = Slider(0, range=0..100)
item_12 = ListItem(List=cluster_3.rib_parts, Index=peak_frame_5, Wrap=True)
item_13 = ListItem(List=cluster_2.rib_parts, Index=peak_frame_6, Wrap=True)
item_14 = ListItem(List=cluster.rib_parts, Index=peak_frame_7, Wrap=True)
peak_frame_8 = Slider(0, range=0..100)
item_15 = ListItem(List=sunion, Index=peak_frame_8, Wrap=True)

# ---- group: Volume index for Construction Optimization
peak_frame_9 = Slider(0, range=0..100)
item_16 = ListItem(List=sunion, Index=peak_frame_9, Wrap=True)
volume = Volume(Geometry=item_16)  # -> Volume, Centroid
panel_6 = Panel(volume.Volume)

# ----
sunion_2 = SolidUnion(Breps=[cull, cull_3, cull_5])

# ---- group: Upper Piece to connect with keystone
cluster_4 = Cluster_2(L=cluster_2.rib_parts_2, L_2=cluster_2.rib_parts)
cluster_5 = Cluster_2(L=cluster_3.rib_parts_2, L_2=cluster_3.rib_parts)
cluster_6 = Cluster_2(L=cluster.rib_parts_2, L_2=cluster.rib_parts)
data_14 = Data(cluster_4)
data_15 = Data(cluster_6)
data_16 = Data(cluster_5)
peak_frame_10 = Slider(1, range=0..100)
peak_frame_11 = Slider(0, range=0..100)
item_17 = ListItem(List=sunion_2, Index=peak_frame_11, Wrap=True)
item_18 = ListItem(List=sunion, Index=peak_frame_10, Wrap=True)
join_8 = BrepJoin(Breps=[item_17, item_18])  # -> Breps, Closed
fmerge_3 = MergeFaces(Brep=join_8.Breps)  # -> Breps, Before, After
filedge_2 = FilletEdge(Shape=scale_2.Geometry, Blend=0, Metric=0, Edges=series_3, Radii=Slider(0.09, range=0.01..1))

# ---- group: Final Rib Blocks
fmerge_4 = MergeFaces(Brep=sunion)  # -> Breps, Before, After
fmerge_5 = MergeFaces(Brep=sunion_2)  # -> Breps, Before, After

# ----
item_19 = ListItem(List=fmerge_4.Breps, Index=peak_frame_2, Wrap=True)
cull_i_5 = CullIndex(List=fmerge_4.Breps, Indices=[peak_frame_3, peak_frame_4], Wrap=True)
cull_i_6 = CullIndex(List=fmerge_5.Breps, Indices=0, Wrap=True)
debrep_8 = DeconstructBrep(Brep=item_19)  # -> Faces, Edges, Vertices

# ==== cluster Cluster
arc_for_rib = ClusterInput()
arc_for_rib_2 = Data(arc_for_rib)
number_of_rib_parts = ClusterInput()
smaller_radius = Slider(0.136, range=0.001..1)
profile_plane = ClusterInput()
profile_plane_2 = Area(ProfilePlane=profile_plane)  # -> Area, Centroid
profile_curve = ClusterInput()

# ---- group: center
data = Data(profile_plane_2.Centroid)

# ---- group: crv
profile_curve_2 = Data(profile_curve)

# ----
B = ClusterInput()
xy = XYPlane(Origin=data)
rotate = Rotate(Geometry=xy, Angle=degrees(Slider(-45, range=-180..180)), Plane=data)  # -> Geometry, Transform
dom = ConstructDomain(DomainStart=Slider(4.65, range=0..10), DomainEnd=Slider(7, range=0..10))

project = Project(Geometry=arc_for_rib_2, Plane=PlaneXY(0, 0, 0))  # -> Geometry, Transform
divide = DivideCurve(Curve=project.Geometry, NumberOfRibParts=number_of_rib_parts, Kinks=False)  # -> Points, Tangents, Parameters

cull_i = CullIndex(List=divide.Points, Indices=flatten(Slider(0, range=0..100)), Wrap=True)

line = LineSDL(Start=cull_i, Direction=Vector(0, 0, 1), Length="50")
ccx = CurveCurve(CurveA=arc_for_rib_2, CurveB=line)  # -> Points, ParamsA, ParamsB

shatter = Shatter(Curve=arc_for_rib_2, Parameters=flatten(ccx.ParamsA))  # -> simplify(graft(Segments))
pframe = PerpFrame(Curve=arc_for_rib_2, Parameter=ccx.ParamsA)
end = EndPoints(Curve=shatter)  # -> Start, End
deplane = DeconstructPlane(Plane=pframe)  # -> simplify(Origin), simplify(XAxis), simplify(YAxis), simplify(ZAxis)
ln = Line(StartPoint=end.Start, EndPoint=end.End)
len = Length(Curve=ln)
amp = Amplitude(Vector=simplify(ln), Amplitude=len)

lng = ListLength(List=flatten(pframe))
repeat = RepeatData(Data=smaller_radius, Length=lng)
series = Series(Start=0, Step=1, Count=lng)
first_curve = ListItem(List=flatten(ln), Index=0, Wrap=True)  # -> Item1, Item
bnd = Bounds(Numbers=series)
item_1 = ClusterOutput(first_curve.Item1)
i = ClusterOutput(first_curve.Item)
remap = RemapNumbers(Value=series, Source=bnd, Target=Domain(0, 1))  # -> Mapped, Clipped
multiplication = Multiplication(A=amp, B=B)  # -> simplify(Result)
graph = GraphMapper(remap.Mapped, x0=0, x1=1, y0=0, y1=1, container_name="Bezier", cpx=[0, 0, 1, 1], cpy=[0, 0.4428026676, 0.6420369744, 1])
data_2 = Data(simplify(multiplication))
orient = Orient(Geometry=profile_curve_2, Source=simplify(flatten(rotate.Geometry)), Target=pframe)  # -> Geometry, Transform
remap_2 = RemapNumbers(Value=graph, Source=Domain(0, 1), Target=dom)  # -> Mapped, Clipped
multiplication_2 = Multiplication(A=remap_2.Mapped, B=repeat)
rev = ReverseList(List=reverse(multiplication_2))  # -> simplify(graft(List))
extr = Extrude(Base=simplify(orient.Geometry), Direction=data_2)
scale = Scale(Geometry=orient.Geometry, Center=deplane.Origin, Factor=rev)  # -> simplify(Geometry), Transform; disabled

# ---- group: Main Rib Geometry
capex = CapHolesEx(Brep=extr)  # -> Brep, Caps, Solid

# ---- group: Connections
debrep = DeconstructBrep(Brep=capex.Brep)  # -> Faces, Edges, Vertices
item = ListItem(List=debrep.Faces, Index=Slider(13, range=0..25), Wrap=True)  # -> flatten(Item)
item_2 = ListItem(List=debrep.Faces, Index=Slider(12, range=0..25), Wrap=True)  # -> flatten(Item)
lng_2 = ListLength(List=item_2)  # -> flatten(Length)
merge = Merge(Data1=flatten(item), Data2=item_2)  # -> simplify(Result)
series_2 = Series(Start=0, Step=1, Count=lng_2)  # -> simplify(graft(Series))
addition = Addition(A=series_2, B=lng_2, C=1)
item_3 = ListItem(List=merge, Index=series_2, Wrap=True)
item_4 = ListItem(List=merge, Index=addition, Wrap=True)
debrep_2 = DeconstructBrep(Brep=item_3)  # -> Faces, Edges, Vertices
debrep_3 = DeconstructBrep(Brep=item_4)  # -> Faces, Edges, Vertices
join = JoinCurves(Curves=debrep_3.Edges, Preserve=False)
join_2 = JoinCurves(Curves=debrep_2.Edges, Preserve=False)
flip = FlipCurve(Curve=join_2)  # -> Curve, Flag
loft = Loft(
    Curves=[flip.Curve, join],
    Options={Adjust=False, Closed=False, LoftEnds=0, LoftSimp=0, LoftType=0, Rebuild=10, Refit=0.01})  # -> simplify(Loft)
lng_3 = ListLength(List=flatten(loft))
subtraction = Subtraction(A=lng_3, B=1)
cull_i_2 = CullIndex(List=flatten(loft), Indices=subtraction, Wrap=True)  # -> simplify(List)

# ---- group: Divide Geometry
item_5 = ListItem(List=debrep_2.Vertices, Index=Slider(2, range=0..40), Wrap=True)
item_6 = ListItem(List=debrep_2.Vertices, Index=Slider(10, range=0..40), Wrap=True)
ln_2 = Line(StartPoint=item_5, EndPoint=item_6)  # -> simplify(Line)
debrep_4 = DeconstructBrep(Brep=cull_i_2)  # -> Faces, Edges, Vertices
item_7 = ListItem(List=debrep_4.Edges, Index=Slider(26, range=0..40), Wrap=True)
len_2 = Length(Curve=item_7)
amp_2 = Amplitude(Vector=item_7, Amplitude=len_2)
multiplication_3 = Multiplication(A=amp_2, B=Slider(1, range=0..1))
extr_2 = Extrude(Base=ln_2, Direction=multiplication_3)  # -> simplify(flatten(Extrusion))

# ----
lng_4 = ListLength(List=extr_2)
culln = CullNth(List=extr_2, CullFrequency=lng_4)
split = SplitBrep(Brep=cull_i_2, Cutter=culln)
item_8 = ListItem(List=split, Index=0, Wrap=True)  # -> flatten(Item1), flatten(Item)

# ---- group: Lower Part Connection
join_3 = BrepJoin(Breps=[item_8.Item1, extr_2])  # -> simplify(Breps), Closed
lng_5 = ListLength(List=join_3.Breps)
cull_i_3 = CullIndex(List=join_3.Breps, Indices=expr("x-1", lng_5), Wrap=True)
cap = CapHoles(Brep=cull_i_3)  # -> simplify(graft(Brep))
cull = CullPattern(List=flatten(cap), CullPattern=[True, False])
cull_2 = CullPattern(List=flatten(cap), CullPattern=[False, True])

# ---- group: Upper Part Connection
join_4 = BrepJoin(Breps=[item_8.Item, extr_2])  # -> Breps, Closed
lng_6 = ListLength(List=join_3.Breps)
cull_i_4 = CullIndex(List=join_4.Breps, Indices=expr("x-1", lng_6), Wrap=True)
cap_2 = CapHoles(Brep=cull_i_4)  # -> simplify(graft(Brep))
cull_3 = CullPattern(List=flatten(cap_2), CullPattern=[False, True])
cull_4 = CullPattern(List=flatten(cap_2), CullPattern=[True, False])

# ----
main_ribs = CullPattern(List=flatten(capex.Brep), CullPattern=[False, True])
cull_5 = CullPattern(List=flatten(capex.Brep), CullPattern=[True, False])

sunion = SolidUnion(Breps=[cull, main_ribs, cull_3])
sunion_2 = SolidUnion(Breps=[cull_5, cull_2, cull_4])
rib_parts = ClusterOutput(sunion)
rib_parts_2 = ClusterOutput(sunion_2)

# ==== cluster Cluster_2
peak_frame = Slider(1, range=0..100)
peak_frame_2 = Slider(0, range=0..100)
L = ClusterInput()
L_2 = ClusterInput()
item = ListItem(List=L, Index=peak_frame_2, Wrap=True)
item_2 = ListItem(List=L_2, Index=peak_frame, Wrap=True)
join = BrepJoin(Breps=[item, item_2])  # -> Breps, Closed
fmerge = MergeFaces(Brep=join.Breps)  # -> Breps, Before, After
B = ClusterOutput(fmerge.Breps)

# ==== cluster Cluster_3
G = ClusterInput()
number_of_rib_parts = ClusterInput()
relay = ClusterInput()
C = ClusterInput()
C_2 = ClusterInput()
smaller_radius = Slider(0.136, range=0.001..1)
profile_plane = ClusterInput()
profile_plane_2 = Area(ProfilePlane=profile_plane)  # -> Area, Centroid
profile_curve = ClusterInput()

# ---- group: center
data = Data(profile_plane_2.Centroid)

# ---- group: crv
profile_curve_2 = Data(profile_curve)

# ----
B = ClusterInput()
xy = XYPlane(Origin=data)
rotate = Rotate(Geometry=xy, Angle=degrees(Slider(-45, range=-180..180)), Plane=data)  # -> Geometry, Transform
dom = ConstructDomain(DomainStart=Slider(4.65, range=0..10), DomainEnd=Slider(7, range=0..10))

project = Project(Geometry=G, Plane=PlaneXY(0, 0, 0))  # -> Geometry, Transform
divide = DivideCurve(Curve=project.Geometry, NumberOfRibParts=number_of_rib_parts, Kinks=False)  # -> Points, Tangents, Parameters

cull_i = CullIndex(List=divide.Points, Indices=flatten(Slider(0, range=0..100)), Wrap=True)

line = LineSDL(Start=cull_i, Direction=Vector(0, 0, 1), Length="50")
ccx = CurveCurve(CurveA=relay, CurveB=line)  # -> Points, ParamsA, ParamsB

shatter = Shatter(Curve=C, Parameters=flatten(ccx.ParamsA))  # -> simplify(graft(Segments))
pframe = PerpFrame(Curve=C_2, Parameter=ccx.ParamsA)
end = EndPoints(Curve=shatter)  # -> Start, End
deplane = DeconstructPlane(Plane=pframe)  # -> simplify(Origin), simplify(XAxis), simplify(YAxis), simplify(ZAxis)
ln = Line(StartPoint=end.Start, EndPoint=end.End)
len = Length(Curve=ln)
amp = Amplitude(Vector=simplify(ln), Amplitude=len)

lng = ListLength(List=flatten(pframe))
repeat = RepeatData(Data=smaller_radius, Length=lng)
series = Series(Start=0, Step=1, Count=lng)
first_curve = ListItem(List=flatten(ln), Index=0, Wrap=True)  # -> Item1, Item
bnd = Bounds(Numbers=series)
item_1 = ClusterOutput(first_curve.Item1)
i = ClusterOutput(first_curve.Item)
remap = RemapNumbers(Value=series, Source=bnd, Target=Domain(0, 1))  # -> Mapped, Clipped
multiplication = Multiplication(A=amp, B=B)  # -> simplify(Result)
graph = GraphMapper(remap.Mapped, x0=0, x1=1, y0=0, y1=1, container_name="Bezier", cpx=[0, 0, 1, 1], cpy=[0, 0.4428026676, 0.6420369744, 1])
data_2 = Data(simplify(multiplication))
orient = Orient(Geometry=profile_curve_2, Source=simplify(flatten(rotate.Geometry)), Target=pframe)  # -> Geometry, Transform
remap_2 = RemapNumbers(Value=graph, Source=Domain(0, 1), Target=dom)  # -> Mapped, Clipped
multiplication_2 = Multiplication(A=remap_2.Mapped, B=repeat)
rev = ReverseList(List=reverse(multiplication_2))  # -> simplify(graft(List))
extr = Extrude(Base=simplify(orient.Geometry), Direction=data_2)
scale = Scale(Geometry=orient.Geometry, Center=deplane.Origin, Factor=rev)  # -> simplify(Geometry), Transform; disabled

# ---- group: Main Rib Geometry
capex = CapHolesEx(Brep=extr)  # -> Brep, Caps, Solid

# ---- group: Connections
debrep = DeconstructBrep(Brep=capex.Brep)  # -> Faces, Edges, Vertices
item = ListItem(List=debrep.Faces, Index=Slider(13, range=0..25), Wrap=True)  # -> flatten(Item)
item_2 = ListItem(List=debrep.Faces, Index=Slider(12, range=0..25), Wrap=True)  # -> flatten(Item)
lng_2 = ListLength(List=item_2)  # -> flatten(Length)
merge = Merge(Data1=flatten(item), Data2=item_2)  # -> simplify(Result)
series_2 = Series(Start=0, Step=1, Count=lng_2)  # -> simplify(graft(Series))
addition = Addition(A=series_2, B=lng_2, C=1)
item_3 = ListItem(List=merge, Index=series_2, Wrap=True)
item_4 = ListItem(List=merge, Index=addition, Wrap=True)
debrep_2 = DeconstructBrep(Brep=item_3)  # -> Faces, Edges, Vertices
debrep_3 = DeconstructBrep(Brep=item_4)  # -> Faces, Edges, Vertices
join = JoinCurves(Curves=debrep_3.Edges, Preserve=False)
join_2 = JoinCurves(Curves=debrep_2.Edges, Preserve=False)
flip = FlipCurve(Curve=join_2)  # -> Curve, Flag
loft = Loft(
    Curves=[flip.Curve, join],
    Options={Adjust=False, Closed=False, LoftEnds=0, LoftSimp=0, LoftType=0, Rebuild=10, Refit=0.01})  # -> simplify(Loft)
lng_3 = ListLength(List=flatten(loft))
subtraction = Subtraction(A=lng_3, B=1)
cull_i_2 = CullIndex(List=flatten(loft), Indices=subtraction, Wrap=True)  # -> simplify(List)

# ---- group: Divide Geometry
item_5 = ListItem(List=debrep_2.Vertices, Index=Slider(2, range=0..40), Wrap=True)
item_6 = ListItem(List=debrep_2.Vertices, Index=Slider(10, range=0..40), Wrap=True)
ln_2 = Line(StartPoint=item_5, EndPoint=item_6)  # -> simplify(Line)
debrep_4 = DeconstructBrep(Brep=cull_i_2)  # -> Faces, Edges, Vertices
item_7 = ListItem(List=debrep_4.Edges, Index=Slider(34, range=0..40), Wrap=True)
len_2 = Length(Curve=item_7)
amp_2 = Amplitude(Vector=item_7, Amplitude=len_2)
multiplication_3 = Multiplication(A=amp_2, B=Slider(1, range=0..1))
extr_2 = Extrude(Base=ln_2, Direction=multiplication_3)  # -> simplify(flatten(Extrusion))

# ----
lng_4 = ListLength(List=extr_2)
culln = CullNth(List=extr_2, CullFrequency=lng_4)
split = SplitBrep(Brep=cull_i_2, Cutter=culln)
item_8 = ListItem(List=split, Index=0, Wrap=True)  # -> flatten(Item1), flatten(Item)

# ---- group: Lower Part Connection
join_3 = BrepJoin(Breps=[item_8.Item1, extr_2])  # -> simplify(Breps), Closed
lng_5 = ListLength(List=join_3.Breps)
cull_i_3 = CullIndex(List=join_3.Breps, Indices=expr("x-1", lng_5), Wrap=True)
cap = CapHoles(Brep=cull_i_3)  # -> simplify(graft(Brep))
cull = CullPattern(List=flatten(cap), CullPattern=[True, False])
cull_2 = CullPattern(List=flatten(cap), CullPattern=[False, True])

# ---- group: Upper Part Connection
join_4 = BrepJoin(Breps=[item_8.Item, extr_2])  # -> Breps, Closed
lng_6 = ListLength(List=join_3.Breps)
cull_i_4 = CullIndex(List=join_4.Breps, Indices=expr("x-1", lng_6), Wrap=True)
cap_2 = CapHoles(Brep=cull_i_4)  # -> simplify(graft(Brep))
cull_3 = CullPattern(List=flatten(cap_2), CullPattern=[False, True])
cull_4 = CullPattern(List=flatten(cap_2), CullPattern=[True, False])

# ----
main_ribs = CullPattern(List=flatten(capex.Brep), CullPattern=[False, True])
cull_5 = CullPattern(List=flatten(capex.Brep), CullPattern=[True, False])

sunion = SolidUnion(Breps=[cull, main_ribs, cull_3])
sunion_2 = SolidUnion(Breps=[cull_5, cull_2, cull_4])
rib_parts = ClusterOutput(sunion)
rib_parts_2 = ClusterOutput(sunion_2)
