# Grasshopper definition Wall study.gh (Grasshopper 1.0.7)
# plug-ins: Pufferfish, Parakeet

# ---- group: Triangle
number_of_sides = Slider(3, range=0..120)
radios = Slider(9, range=0..120)
rotation = Slider(90, range=0..120)
triangle = Polygon(Plane=PlaneXY(0, 0, 0), Radius=radios, Segments=number_of_sides, FilletRadius=0)  # -> Polygon, Length
rad = Radians(Degrees=rotation)
rotate = Rotate(Geometry=triangle.Polygon, Angle=rad, Plane=PlaneXY(0, 0, 0))  # -> Geometry, Transform

# ---- group: Dome Dimentions
supports_width = Slider(1.05, range=0..1.5)
number_slider = Slider(4, range=0..8)
radios_1_65 = Slider(2, range=0..10)

# ----
number_slider_2 = Slider(50, range=0..100)
# Grid
number_slider_3 = Slider(1.65, range=0..10)
sqgrid = Square(Plane=PlaneXY(0, 0, 0), Size=number_slider_3, ExtentX=number_slider_2, ExtentY=number_slider_2)  # -> Cells, Points
number_slider_4 = Slider(0.225, range=0..1)
offcrv = OffsetCurve(Curve=sqgrid.Cells, Plane=PlaneXY(0, 0, 0), Distance=number_slider_4, BothSides=number_slider_4, Kinks=0, CapType=1)

B = Base(PlaneXY(0, 0, 0))

# ---- group: Base Geometry
multiplication = Multiplication(A=radios_1_65, B=1.65)
multiplication_2 = Multiplication(A=multiplication, B=supports_width)
polygon = Polygon(Plane=PlaneXY(0, 0, 0), Radius=multiplication_2, Segments=number_slider, FilletRadius=0)  # -> Polygon, Length
sph = Sphere(Base=B, Radius=multiplication)
Z = UnitZ(Factor=multiplication_2)
boundary = BoundarySurfaces(Edges=polygon.Polygon)
extr = Extrude(Base=boundary, Direction=Z)
sint = SolidIntersection(BrepsA=sph, BrepsB=extr)

# ----
deplane = DeconstructPlane(Plane=B)  # -> Origin, XAxis, YAxis, ZAxis

number_of_divisions = Slider(6, range=0..120)
divide = DivideCurve(Curve=rotate.Geometry, Count=number_of_divisions, Kinks=False)  # -> Points, Tangents, Parameters
points = PointList(Points=divide.Points, Size=number_of_divisions)

angel = Slider(10, range=0..10)
multiplication_3 = Multiplication(A=angel, B=90)
rotax = RotateAxis(
    Geometry=sint,
    Angle=degrees(multiplication_3),
    Axis=Line((-0.0191628086, -0.006433339446, 0), (-0.0191628086, -0.006433339446, 4.761248843)))  # -> Geometry, Transform

# ---- group: Point list
item_number = Slider(1, range=0..120)
item_number_2 = Slider(3, range=0..120)
item_number_3 = Slider(2, range=0..120)
item_number_4 = Slider(4, range=0..120)
item_number_5 = Slider(5, range=0..120)
item = ListItem(List=divide.Points, Index=item_number_3, Wrap=True)
item_2 = ListItem(List=divide.Points, Index=item_number, Wrap=True)
item_3 = ListItem(List=divide.Points, Index=item_number_2, Wrap=True)
item_4 = ListItem(List=divide.Points, Index=item_number_4, Wrap=True)
item_5 = ListItem(List=divide.Points, Index=item_number_5, Wrap=True)

# ----
item_number_6 = Slider(0, range=0..120)
item_number_7 = Slider(6, range=0..120)
item_number_8 = Slider(7, range=0..120)

# ---- group: AREA TESOLATION
box = Box(rotax.Geometry)
tesolation_area = Slider(1.65, range=0..1.65)
multiplication_4 = Multiplication(A=tesolation_area)
debrep = DeconstructBrep(Brep=box)  # -> Faces, Edges, Vertices
neg = Negative(Value=multiplication_4)
item_6 = ListItem(List=reverse(debrep.Faces), Index=0, Wrap=True)
Z_2 = UnitZ(Factor=neg)
move = Move(Geometry=item_6, Motion=Z_2)  # -> Geometry, Transform
bbx = BrepBrep(BrepA=rotax.Geometry, BrepB=move.Geometry)  # -> Curves, Points
project = Project(Geometry=bbx.Curves, Plane=PlaneXY(0, 0, 0))  # -> Geometry, Transform
box_2 = Box(project.Geometry)

# ----
item_7 = ListItem(List=divide.Points, Index=item_number_7, Wrap=True)

# ---- group: Vetical Line P3
length = Slider(7, range=0..120)
line = LineSDL(Start=item_3, Direction=Vector(0, 0, 1), Length=length)
end = EndPoints(Curve=line)  # -> Start, End

# ----
# Geometry definition
number_slider_5 = Slider(1, range=0..3)

ln = Line(StartPoint=item, EndPoint=item_5)
ln_2 = Line(StartPoint=item_2, EndPoint=item_4)
llx = LineLine(Line1=ln, Line2=ln_2)  # -> ParamA, ParamB, PointA, PointB

# ---- group: Geometry
debrep_2 = DeconstructBrep(Brep=rotax.Geometry)  # -> Faces, Edges, Vertices
item_8 = ListItem(List=debrep_2.Faces, Index=0, Wrap=True)
neg_2 = Negative(Value=Slider(0.45, range=0..1))
offset = OffsetSurface(Surface=item_8, Distance=neg_2, Retrim=True)

# ----
srf = Surface(offset)
divide_2 = DivideDomain²(Domain=srf, UCount=Slider(50, range=0..100), VCount=Slider(80, range=0..100))
subsrf = Isotrim(Surface=srf, Domain=divide_2)
debrep_3 = DeconstructBrep(Brep=subsrf)  # -> Faces, Edges, Vertices
item_9 = ListItem(List=debrep_3.Vertices, Index=Slider(0, range=0..10), Wrap=True)
item_10 = ListItem(List=debrep_3.Vertices, Index=Slider(1, range=0..10), Wrap=True)
item_11 = ListItem(List=debrep_3.Vertices, Index=Slider(2, range=0..10), Wrap=True)
item_12 = ListItem(List=debrep_3.Vertices, Index=Slider(3, range=0..10), Wrap=True)
srf4pt = _4PointSurface(CornerA=item_9, CornerB=item_10, CornerC=item_11, CornerD=item_12)

length_2 = Slider(6, range=0..120)
line_2 = LineSDL(Start=llx.PointA, Direction=Vector(0, 0, 1), Length=length_2)
end_2 = EndPoints(Curve=line_2)  # -> Start, End

number_slider_6 = Slider(10, range=0..10)

# ---- group: change edges
arc = Arc3Pt(PointA=item, PointB=end.End, PointC=item_4)  # -> Arc, Plane, Radius

# ---- group: Vetical Line P5
line_3 = LineSDL(Start=item_5, Direction=Vector(0, 0, 1), Length=length_2)
end_3 = EndPoints(Curve=line_3)  # -> Start, End

# ----
loft = Loft(
    Curves=[item_8, offset],
    Options={Adjust=False, Closed=False, LoftEnds=0, LoftSimp=0, LoftType=0, Rebuild=10, Refit=0.01})
join = BrepJoin(Breps=[loft, offset, item_8])  # -> Breps, Closed
arc_2 = Arc3Pt(PointA=item, PointB=end_2.End, PointC=end_3.End)  # -> Arc, Plane, Radius

# ---- group: Evaluate Arc
eval = EvaluateCurve(Curve=reparameterize(arc_2.Arc), Parameter=Slider(0.73, range=0..1))  # -> Point, Tangent, Angle

# ----
wall_position_0_45 = Slider(6, range=0..100)
wall_position_0_45_2 = Slider(3, range=0..100)

yz = YZPlane(Origin=Point(0, 0, 0))
arc_3 = Arc3Pt(PointA=item, PointB=end_2.End, PointC=eval.Point)  # -> Arc, Plane, Radius
mirror = Mirror(Geometry=arc_3.Arc, Plane=yz)  # -> Geometry, Transform

x_0_45 = Multiplication(A=wall_position_0_45_2, B=0.45)
Y = UnitY(Factor=1)
x_0_45_2 = Multiplication(A=wall_position_0_45, B=0.45)
surface = EdgeSurface(CurveA=arc_3.Arc, CurveB=mirror.Geometry, CurveC=arc.Arc)

angle = Slider(120, range=0..360)
count = Slider(3, range=0..10)
series = Series(Start=0, Step=angle, Count=count)
rad_2 = Radians(Degrees=series)
rotate_2 = Rotate(Geometry=surface, Angle=rad_2, Plane=PlaneXY(0, 0, 0))  # -> Geometry, Transform

series_2 = Series(Start=0, Step=Slider(1, range=0..10), Count=10)
vec = VectorXYZ(XComponent=0, YComponent=x_0_45, ZComponent=0)  # -> Vector, Length
vec_2 = VectorXYZ(XComponent=0, YComponent=x_0_45_2, ZComponent=0)  # -> Vector, Length
move_2 = Move(Motion=[vec.Vector, vec_2.Vector])  # -> Geometry, Transform

# ---- group: Pattern
number_slider_7 = Slider(29, range=0..100)
crv = Curve(<curve referenced from the Rhino model>)
crv_2 = Curve(project.Geometry)
divide_3 = DivideCurve(Curve=crv, Count=number_slider_7, Kinks=False)  # -> Points, Tangents, Parameters
divide_4 = DivideCurve(Curve=crv_2, Count=number_slider_7, Kinks=False)  # -> Points, Tangents, Parameters
shift = ShiftList(List=divide_4.Points, Shift=Slider(3, range=0..10), Wrap=True)
area = Area(Geometry=crv)  # -> Area, Centroid
ln_3 = Line(StartPoint=divide_3.Points, EndPoint=shift)
eval_2 = EvaluateLength(Curve=ln_3, Length=Slider(0.5, range=0..1), Normalized=True)  # -> Point, Tangent, Parameter
hframe = HorizontalFrame(Curve=ln_3, Parameter=eval_2.Parameter)
deplane_2 = DeconstructPlane(Plane=hframe)  # -> Origin, XAxis, YAxis, ZAxis
amp = Amplitude(Vector=deplane_2.YAxis, Amplitude=Slider(3.12, range=0..10))
move_3 = Move(Geometry=eval_2.Point, Motion=amp)  # -> Geometry, Transform
vdis = VectorDisplay(Anchor=deplane_2.Origin, Vector=deplane_2.YAxis)
arc_4 = Arc3Pt(PointA=divide_3.Points, PointB=move_3.Geometry, PointC=shift)  # -> Arc, Plane, Radius
xz = XZPlane(Origin=area.Centroid)
mirror_2 = Mirror(Geometry=arc_4.Arc, Plane=xz)  # -> Geometry, Transform
crv_3 = Curve([arc_4.Arc, mirror_2.Geometry])

# ----
d_04 = Geometry(<brep referenced from the Rhino model>)
d_01 = Geometry(<brep referenced from the Rhino model>)
w_01 = Geometry(<brep referenced from the Rhino model>)
cw_01 = Geometry(<brep referenced from the Rhino model>)
c_01 = Geometry(<brep referenced from the Rhino model>)

horizontal = Slider(12, range=0..50)
vertical = Slider(5, range=0..50)
angel_2 = Slider(0, range=0..1)
multiplication_5 = Multiplication(A=vertical, B=1.65)
multiplication_6 = Multiplication(A=horizontal, B=1.65)
multiplication_7 = Multiplication(A=angel_2, B=90)
vec_3 = VectorXYZ(XComponent=multiplication_6, YComponent=multiplication_5, ZComponent=0)  # -> Vector, Length
rotax_2 = RotateAxis(
    Geometry=c_01,
    Angle=degrees(multiplication_7),
    Axis=Line((-0.0191628086, -0.006433339446, 0), (-0.0191628086, -0.006433339446, 4.761248843)))  # -> Geometry, Transform
move_4 = Move(Geometry=rotax_2.Geometry, Motion=vec_3.Vector)  # -> Geometry, Transform

mcx = MultipleCurves(Curves=flatten(crv_3))  # -> Points, IndexA, IndexB, ParamA, ParamB
cir = Circle(Plane=mcx.Points, Radius=Slider(0.49, range=0..10))

# ---- group: Triangle
radios_2 = Slider(3, range=0..10)
number_of_sides_2 = Slider(4, range=0..120)
rotation_2 = Slider(45, range=0..120)
rad_3 = Radians(Degrees=rotation_2)

# ----
multiplication_8 = Multiplication(A=radios_2, B=1.65)

# ---- group: Triangle (continued)
triangle_2 = Polygon(Plane=PlaneXY(0, 0, 0), Radius=multiplication_8, Segments=number_of_sides_2, FilletRadius=0)  # -> Polygon, Length
rotate_3 = Rotate(Geometry=triangle_2.Polygon, Angle=rad_3, Plane=PlaneXY(0, 0, 0))  # -> Geometry, Transform

# ----
number_of_divisions_2 = Slider(8, range=0..120)
divide_5 = DivideCurve(Curve=rotate_3.Geometry, Count=number_of_divisions_2, Kinks=False)  # -> Points, Tangents, Parameters
points_2 = PointList(Points=divide_5.Points, Size=number_of_divisions_2)

item_number_9 = Slider(1, range=0..120)
item_number_10 = Slider(3, range=0..120)
item_number_11 = Slider(2, range=0..120)
item_number_12 = Slider(4, range=0..120)
item_number_13 = Slider(6, range=0..120)
item_number_14 = Slider(5, range=0..120)
item_13 = ListItem(List=divide_5.Points, Index=item_number_11, Wrap=True)
item_14 = ListItem(List=divide_5.Points, Index=item_number_9, Wrap=True)
item_15 = ListItem(List=divide_5.Points, Index=item_number_10, Wrap=True)
item_16 = ListItem(List=divide_5.Points, Index=item_number_13, Wrap=True)
item_17 = ListItem(List=divide_5.Points, Index=item_number_12, Wrap=True)
item_18 = ListItem(List=divide_5.Points, Index=item_number_14, Wrap=True)

item_19 = ListItem(List=divide_5.Points, Index=item_number_8, Wrap=True)
item_20 = ListItem(List=divide_5.Points, Index=item_number_6, Wrap=True)

# ---- group: Vetical Line P3
length_3 = Slider(3, range=0..10)
line_4 = LineSDL(Start=item_15, Direction=Vector(0, 0, 1), Length=length_3)
end_4 = EndPoints(Curve=line_4)  # -> Start, End

# ----
ln_4 = Line(StartPoint=item_13, EndPoint=item_16)
ln_5 = Line(StartPoint=item_20, EndPoint=item_17)
llx_2 = LineLine(Line1=ln_4, Line2=ln_5)  # -> ParamA, ParamB, PointA, PointB

length_4 = Slider(3, range=0..120)
line_5 = LineSDL(Start=llx_2.PointA, Direction=Vector(0, 0, 1), Length=length_4)
end_5 = EndPoints(Curve=line_5)  # -> Start, End

# ---- group: change edges
arc_5 = Arc3Pt(PointA=item_13, PointB=end_4.End, PointC=item_17)  # -> Arc, Plane, Radius

# ---- group: Vetical Line P5
line_6 = LineSDL(Start=item_17, Direction=Vector(0, 0, 1), Length=Slider(0, range=0..100))
end_6 = EndPoints(Curve=line_6)  # -> Start, End

# ----
arc_6 = Arc3Pt(PointA=item_20, PointB=end_5.End, PointC=end_6.End)  # -> Arc, Plane, Radius

# ---- group: Evaluate Arc
eval_3 = EvaluateCurve(Curve=reparameterize(arc_6.Arc), Parameter=Slider(1, range=0..10))  # -> Point, Tangent, Angle

# ----
yz_2 = YZPlane(Origin=Point(0, 0, 0))
arc_7 = Arc3Pt(PointA=item_20, PointB=end_5.End, PointC=eval_3.Point)  # -> Arc, Plane, Radius
mirror_3 = Mirror(Geometry=arc_7.Arc, Plane=yz_2)  # -> Geometry, Transform

surface_2 = EdgeSurface(CurveA=arc_7.Arc, CurveB=mirror_3.Geometry, CurveC=arc_5.Arc)

angle_2 = Slider(90, range=0..360)
count_2 = Slider(4, range=0..10)
series_3 = Series(Start=0, Step=angle_2, Count=count_2)
rad_4 = Radians(Degrees=series_3)
rotate_4 = Rotate(Geometry=surface_2, Angle=rad_4, Plane=PlaneXY(0, 0, 0))  # -> Geometry, Transform

# ---- group: Geometry
debrep_4 = DeconstructBrep(Brep=rotate_4.Geometry)  # -> Faces, Edges, Vertices
item_21 = ListItem(List=debrep_4.Faces, Index=0, Wrap=True)
neg_3 = Negative(Value=Slider(0.364, range=0..1))
offset_2 = OffsetSurface(Surface=item_21, Distance=neg_3, Retrim=True)

# ----
loft_2 = Loft(
    Curves=[item_21, offset_2],
    Options={Adjust=False, Closed=False, LoftEnds=0, LoftSimp=0, LoftType=0, Rebuild=10, Refit=0.01})
join_2 = BrepJoin(Breps=[loft_2, offset_2, item_21])  # -> Breps, Closed

# ----
# Wall Dimention
wall_height_1_20 = Slider(2, range=0..10)
wall_width_0_15 = Slider(3, range=0..10)
wall_lengtht_1_20 = Slider(1, range=0..10)
multiplication_9 = Multiplication(A=wall_height_1_20, B=1.2)
multiplication_10 = Multiplication(A=wall_lengtht_1_20, B=1.2)

multiplication_11 = Multiplication(A=wall_width_0_15, B=0.15)

rectangle = Rectangle(Plane=PlaneXY(0, 0, 0), XSize=multiplication_11, YSize=multiplication_10, Radius=0)  # -> Rectangle, Length
boxrec = BoxRectangle(Rectangle=rectangle.Rectangle, Height=multiplication_9)

window_position_0_45 = Slider(0, range=0..100)
end_7 = EndPoints(Curve=rectangle.Rectangle)  # -> Start, End
# window or door Dimention
wall_position_0_15 = Slider(1, range=0..100)
door_width = Slider(0.9, range=0..1000)
block_hight_0_10 = Slider(0, range=0..100)
multiplication_12 = Multiplication(A=window_position_0_45, B=0.45)
multiplication_13 = Multiplication(A=wall_position_0_15, B=0.15)
multiplication_14 = Multiplication(A=block_hight_0_10, B=0.1)
rectangle_2 = Rectangle(Plane=end_7.Start, XSize=Domain(-1, 1), YSize=door_width, Radius=0)  # -> Rectangle, Length
vec_4 = VectorXYZ(XComponent=0, YComponent=multiplication_13, ZComponent=multiplication_12)  # -> Vector, Length
Z_3 = UnitZ(Factor=multiplication_14)
move_5 = Move(Geometry=rectangle_2.Rectangle, Motion=vec_4.Vector)  # -> Geometry, Transform
boundary_2 = BoundarySurfaces(Edges=move_5.Geometry)
extr_2 = Extrude(Base=boundary_2, Direction=Z_3)

# ----
# Gothic Arch
number_slider_8 = Slider(0.86, range=0..1)
Z_4 = UnitZ(Factor=number_slider_8)
Y_2 = UnitY(Factor=1)
amp_2 = Amplitude(Vector=Y_2, Amplitude=Slider(0.01, range=0.01..1))
Z_5 = UnitZ(Factor=1)

debrep_5 = DeconstructBrep(Brep=extr_2)  # -> Faces, Edges, Vertices
item_22 = ListItem(List=debrep_5.Faces, Index=Slider(2, range=0..10), Wrap=True)
debrep_6 = DeconstructBrep(Brep=item_22)  # -> Faces, Edges, Vertices
item_23 = ListItem(List=debrep_6.Edges, Index=[Slider(2, range=0..10), Slider(1, range=0..10), Slider(3, range=0..10)], Wrap=True)
join_3 = JoinCurves(Curves=item_23, Preserve=False)
item_24 = ListItem(List=debrep_6.Edges, Index=0, Wrap=True)
fillet = Fillet(Curve=join_3, Radius=0)
fillet_2 = Fillet(Curve=join_3, Radius=1)

# ----
# Base Points
end_8 = EndPoints(Curve=item_24)  # -> Start, End

move_6 = Move(Geometry=[end_8.Start, end_8.End], Motion=Z_4)  # -> Geometry, Transform
item_25 = ListItem(List=move_6.Geometry, Index=0, Wrap=True)  # -> Item, Item1
item_26 = ListItem(List=item_23, Index=0, Wrap=True)
midpt = CurveMiddle(Curve=item_26)
ln_6 = Line(StartPoint=end_8.End, EndPoint=item_25.Item1)
ln_7 = Line(StartPoint=end_8.Start, EndPoint=item_25.Item)
bzspan = BezierSpan(StartPoint=item_25.Item, StartTangent=Z_5, EndPoint=midpt, EndTangent=expr("-x", amp_2))  # -> Curve, Length, Domain
bzspan_2 = BezierSpan(StartPoint=item_25.Item1, StartTangent=Z_5, EndPoint=midpt, EndTangent=expr("x", amp_2))  # -> Curve, Length, Domain
join_4 = JoinCurves(Curves=[ln_7, ln_6, bzspan_2.Curve, bzspan.Curve], Preserve=False)

# ----
# Catenari Arch
Z_6 = UnitZ(Factor=1)
catenary = Catenary(PointA=end_8.Start, PointB=end_8.End, Length=expr("x*2", multiplication_14), Gravity=Z_6)

stream_filter = StreamFilter(ShapeOfTop=number_slider_5, Stream0=fillet, Stream1=fillet_2, Stream2=catenary, Stream3=join_4)
join_5 = JoinCurves(Curves=[stream_filter, item_24], Preserve=False)

boundary_3 = BoundarySurfaces(Edges=join_5)
X = UnitX(Factor=Slider(2, range=0..10))
neg_4 = Negative(Value=X)
extr_3 = Extrude(Base=boundary_3, Direction=neg_4)
sdiff = SolidDifference(BrepsA=boxrec, BrepsB=extr_3)

# ---- group: TESOLATION
debrep_7 = DeconstructBrep(Brep=box_2)  # -> Faces, Edges, Vertices
item_27 = ListItem(List=debrep_7.Faces, Index=0, Wrap=True)
debrep_8 = DeconstructBrep(Brep=item_27)  # -> Faces, Edges, Vertices
divide_6 = DivideDomain²(Domain=item_27, UCount=number_slider_6, VCount=number_slider_6)
subsrf_2 = Isotrim(Surface=item_27, Domain=divide_6)
item_28 = ListItem(List=debrep_8.Edges, Index=0, Wrap=True)
item_29 = ListItem(List=reverse(debrep_8.Edges), Index=0, Wrap=True)
len = Length(Curve=item_28)
debrep_9 = DeconstructBrep(Brep=subsrf_2)  # -> Faces, Edges, Vertices
panel = Panel(len)
area_2 = Area(Geometry=debrep_9.Faces)  # -> Area, Centroid
number_slider_9 = Slider(0.284, range=0..3)
cullpt = CullDuplicates(Points=flatten([area_2.Centroid, debrep_9.Vertices]), Tolerance=0.1, CullMode=3)  # -> Points, Indices, Valence
boundary_4 = BoundarySurfaces(Edges=project.Geometry)
arc_8 = Arc(Plane=cullpt.Points, Radius=number_slider_9, Angle=Slider(2.861, range=0..10))  # -> Arc, Length

# ----
srf_2 = Surface(offset)
srf_3 = Surface(item_8)
brick_a = BrickTypeA(BaseSurface=boundary_4, UCount=15, VCount=15, OffsetDistance=0)
project_2 = Project(Curve=brick_a, Brep=srf_3, Direction=Vector(0, 0, 1))  # -> simplify(Curve)
project_3 = Project(Curve=brick_a, Brep=srf_2, Direction=Vector(0, 0, 1))  # -> simplify(Curve)
srfsplit = SurfaceSplit(Surface=srf_3, Curves=project_2)
item_30 = ListItem(List=flatten(srfsplit), Index=Slider(4, range=0..200), Wrap=True)
srfsplit_2 = SurfaceSplit(Surface=srf_2, Curves=project_3)
item_31 = ListItem(List=flatten(srfsplit_2), Index=Slider(13, range=0..200), Wrap=True)
join_6 = BrepJoin(Breps=[item_30, item_31])  # -> Breps, Closed

cir_2 = Circle(Plane=cullpt.Points, Radius=number_slider_9)

# ---- group: TESOLATION (continued)
bcx = BrepCurve(Brep=boundary_4, Curve=[arc_8.Arc, cir_2])  # -> Curves, Points

# ----
mcx_2 = MultipleCurves(Curves=cir_2)  # -> Points, IndexA, IndexB, ParamA, ParamB
vec2pt = Vector2Pt(PointA=cullpt.Points, PointB=deplane.Origin, Unitize=False)  # -> Vector, Length
orient = OrientDirection(Geometry=arc_8.Arc, PointA=cullpt.Points, DirectionA=unitize(Y), PointB=cullpt.Points, DirectionB=unitize(vec2pt.Vector))  # -> Geometry, Transform
project_4 = Project(Curve=bcx.Curves, Brep=offset, Direction=Vector(0, 0, 1))
