# Grasshopper definition 1x1_Relaxed Box.gh (Grasshopper 1.0.7)
# plug-ins: Kangaroo2 Components, Weaverbird, karambaGH

# ---- group: 1_1 approximation for ribs
mesh = Mesh(<mesh referenced from the Rhino model>)

# ---- group: Mesh Division
number_slider = Slider(3, range=0..10)
mjoin = MeshJoin(Meshes=flatten(mesh))

# ----
wbtriangles = WeaverbirdsSplitTrianglesSubdivision(MeshCurves=mjoin, Level=number_slider)
wbsplitquads = WeaverbirdsConstantQuadsSplitSubdivision(MeshCurves=mjoin, Level=number_slider, SmoothNakedEdges=0)
data = Data(wbsplitquads)

# ---- group: Anchor Points
nakedvertices = NakedVertices(Mesh=wbsplitquads)  # -> ClothedIndex, NakedIndex, ClothedPts, NakedPts
data_2 = Data(nakedvertices.ClothedPts)
curve = Curve(<curve referenced from the Rhino model>)
incurve = PointInCurve(Point=data_2, Curve=curve)  # -> Relationship, Point
expression = Expression(x=incurve.Relationship, y=Slider(2, range=0..10), Expression="If ((x=y), 1,x)")
dispatch = Dispatch(List=data_2, DispatchPattern=expression)  # -> ListA, flatten(ListB)
anchor = Anchor(Point=[dispatch.ListA, nakedvertices.NakedPts], Strength=10000)
anchorxyz = AnchorXYZ(Point=dispatch.ListB, X=True, Y=True, Z=False, Strength=1000)

# ----
edgelengths = EdgeLengths(Mesh=data, LengthFactor=1, Strength=Slider(7, range=1..20))
vertexloads = VertexLoads(Mesh=data, Strength=Slider(0.4, range=0..1))

data_3 = Data(dispatch.ListA)
show = Show(G=data)
bouncysolver = BouncySolver(
    GoalObjects=[show, vertexloads, edgelengths, anchor, anchorxyz],
    Reset=Button(),
    Threshold=1e-15,
    Tolerance=0.0001,
    Damping=Slider(0.8, range=0..1),
    Iterations=10,
    On=Toggle(False))  # -> I, V, O
list_item = ListItem(List=bouncysolver.O, Index=Slider(353, range=0..1000), Wrap=True)

# ---- group: MESH TO ANALYSE
mesh_2 = Mesh(flatten(list_item))

# ---- group: ADOBE BRICK PROPERTIES
young_s_modulus_n_mm_2 = Panel("80")
density_kg_m_3 = Panel("1200")
gravity_m_s_2 = Panel("9.81")
compressive_strength_n_mm_2 = Panel("1")
expression_2 = Expression(E=young_s_modulus_n_mm_2, Expression="E*0.1")
expression_3 = Expression(d=density_kg_m_3, g=gravity_m_s_2, Expression="(d*g)*0.001")
mpa_to_kn_cm_2 = Multiplication(A=compressive_strength_n_mm_2, B=0.1)
division = Division(A=expression_2, B=2.5)

# ---- group: BRICK SIZE
width = Slider(0.2, range=0..1)
length = Slider(0.3, range=0..1)
height = Slider(0.15, range=0..1)
domain_box = DomainBox(Base=PlaneXY(0, 0, 0), Width=width, Length=length, Height=height)

# ---- group: LOADS / POINTS WHERE WIND LOAD IS APPLIED
deconstruct_mesh = DeconstructMesh(Mesh=mesh_2)  # -> flatten(Vertices), Faces, Colours, Normals
deconstruct = Deconstruct(Point=deconstruct_mesh.Vertices)  # -> XComponent, YComponent, ZComponent
average = Average(Input=deconstruct.XComponent)
evaluate = Evaluate(Expression="if((X=A)or(X<A),1,0)", X=deconstruct.XComponent, A=average)
dispatch_2 = Dispatch(List=deconstruct_mesh.Vertices, DispatchPattern=evaluate)  # -> ListA, ListB

# ---- group: Ceiling Mesh Anchor EDGES on Wall
mesh_edges = MeshEdges(Mesh=mesh_2)  # -> NakedEdges, InteriorEdges, NonManifoldEdges
curve_2 = Curve(flatten(mesh_edges.NakedEdges))
curve_middle = CurveMiddle(Curve=curve_2)  # disabled
deconstruct_2 = Deconstruct(Point=curve_middle)  # -> XComponent, YComponent, ZComponent; disabled
number_slider_2 = Slider(-1, range=-1..1)  # disabled
number_slider_3 = Slider(0.01, range=0..1)  # disabled
panel = Panel("if((Z>A)and(Z<B),1,0)")  # disabled
# Support Definitions
evaluate_2 = Evaluate(Expression=panel, Z=deconstruct_2.ZComponent, A=number_slider_2, B=number_slider_3)  # disabled
includes = Includes(Value=deconstruct_2.ZComponent, Domain=evaluate_2)  # -> Includes, Deviation; disabled
dispatch_3 = Dispatch(List=curve_2, DispatchPattern=includes.Includes)  # -> ListA, ListB; disabled

# ---- group: Ceiling Mesh Anchor POINTS on Wall
deconstruct_mesh_2 = DeconstructMesh(Mesh=flatten(mesh_2))  # -> Vertices, Faces, Colours, Normals; disabled
deconstruct_3 = Deconstruct(Point=deconstruct_mesh_2.Vertices)  # -> XComponent, YComponent, ZComponent; disabled
number_slider_4 = Slider(-1, range=-1..1)  # disabled
number_slider_5 = Slider(0.01, range=0..1)  # disabled
panel_2 = Panel("if((Z>A)and(Z<B),1,0)")  # disabled
evaluate_3 = Evaluate(Expression=panel_2, Z=deconstruct_3.ZComponent, A=number_slider_4, B=number_slider_5)  # disabled
dispatch_4 = Dispatch(List=deconstruct_mesh_2.Vertices, DispatchPattern=evaluate_3)  # -> ListA, ListB; disabled

# ---- group: Corner Points
meshcorners = MeshCorners(Mesh=mesh_2, Angle=2.35619449)  # disabled

# ---- group: BRICK SIZE / m TO cm
multiplication = Multiplication(A=height, B=100)
multiplication_2 = Multiplication(A=width, B=100)
multiplication_3 = Multiplication(A=length, B=100)

# ----
end_points = EndPoints(Curve=curve_2)  # -> Start, End
removeduplicatepts = RemoveDuplicatePts(Points=[end_points.Start, end_points.End], Tolerance=0.01)

# ---- group: ELEMENT ID
panel_3 = Panel("s001")

# ---- group: LOADS
gravity_m_s_2_2 = Panel("9.81")
facade_area_m_2 = Panel("1")
sand_area_m_2 = Panel("1")
wind_speed_m_s = Panel("10")
sand_thickness_m = Panel("0.1")
air_density_kg_m_3 = Panel("1.2")
sand_density_kg_m_3 = Panel("1000")
expression_4 = Expression(
    Density=sand_density_kg_m_3,
    Thickness=sand_thickness_m,
    Area=sand_area_m_2,
    Gravity=gravity_m_s_2_2,
    Expression="(((Density*(Thickness*1*1))*Gravity)/Area)*10^-3")
expression_5 = Expression(
    Density=air_density_kg_m_3,
    Speed=wind_speed_m_s,
    Area=facade_area_m_2,
    Expression="(((Density*(Speed^2))*Area)*(1/2))*10^-3")
unit_z = UnitZ(Factor=expression_4)
point = Point(dispatch_2.ListA)
unit_x = UnitX(Factor=expression_5)
unit_z_2 = UnitZ(Factor="-1")
negative = Negative(Value=unit_z)
# Wind Load
wind = LoadsKaramba3D(ForceVector=unit_x, Local=False, PosInd=point, LCase="2", mode="Point")
# Sand Load
sand = LoadsKaramba3D(
    Vector=negative,
    Mesh=mesh_2,
    ElementIdentifiers=panel_3,
    LCase="1",
    mode="MeshLoad -Const.",
    menu=[buttons(on, off, off), buttons(on, on)])
# Self-Weight Load
self_weight = LoadsKaramba3D(Vector=unit_z_2, LCase="0", mode="Gravity")

# ---- group: MATERIAL DEFINITION
panel_4 = Panel("""Adobe Bricks 
(Adobe CC)""")
# STRUCTURAL ANALYSIS SCRIPT - SHELLS
material_properties_karamba3d = MaterialPropertiesKaramba3D(
    FamilyOfMaterial="Bricks",
    Name=panel_4,
    ElementIdentifier=panel_3,
    YoungsModulus_kN_cm2=expression_2,
    InPlaneShearModulus_kN_cm2=division,
    TransverseShearModulus_kN_cm2=8076,
    SpecificWeight_kN_m3=expression_3,
    CoefficientOfThermalExpansion_1_C=1e-05,
    YieldStrength_kN_cm2=mpa_to_kn_cm_2,
    mode="Isotrop")

# ---- group: Wall Bottom Edges
curve_3 = Curve(dispatch_3.ListA)  # disabled

# ---- group: Wall Anchor Points from EDGES
number_slider_6 = Slider(10, range=0..100)  # disabled
divide_curve = DivideCurve(Curve=curve_3, Count=number_slider_6, Kinks=False)  # -> Points, Tangents, Parameters; disabled

# ---- group: Mesh Anchor Points at Z=0
point_2 = Point(dispatch_4.ListA)  # disabled
removeduplicatepts_2 = RemoveDuplicatePts(Points=point_2, Tolerance=0.01)  # disabled

# ---- group: Wall Anchor Points @Floor
point_3 = Point(removeduplicatepts)

# ---- group: Mesh Corners Anchor Points
point_4 = Point(meshcorners)  # disabled

# ---- group: SHELL CROSS SECTION / SHELL THICKNESS
layers = Slider(3, range=0..10)
expression_6 = Expression(Height=multiplication, Layers=layers, Expression="Height*Layers")

# ----
division_2 = Division(A=expression_6, B=2)

# ---- group: SHELL CROSS SECTION
panel_5 = Panel("VAULT")
panel_6 = Panel("MODULE 1 CORNER")
cross_section_karamba3d = CrossSectionKaramba3D(
    FamilyNameOfCrossSection=panel_5,
    NameOfCrossSection=panel_6,
    ElementIdentifier=panel_3,
    Material=material_properties_karamba3d,
    Height_cm=division_2,
    mode="Shell - Const")

# ---- group: STRUCTURAL MODEL
support_karamba3d = SupportKaramba3D(PosInd=point_3, menu=[buttons(on, on, on, on, on, on)])
mesh_to_shell_karamba3d = MeshToShellKaramba3D(Mesh=mesh_2, Identifier=panel_3, LimitDistance_m=0.005)  # -> Element, Points, Info
assemble_model_karamba3d = AssembleModelKaramba3D(
    Elem=mesh_to_shell_karamba3d.Element,
    Support=support_karamba3d,
    Load=flatten([self_weight, sand, wind]),
    CrossSection=cross_section_karamba3d,
    LimitDistance_m=0.005)  # -> Model, Info, Mass_kg, CenterOfGravity
analyze_karamba3d = AnalyzeKaramba3D(Model=assemble_model_karamba3d.Model)  # -> CalculatedModel, MaximumDisplacement_cm, ResultingForceOfGravity_kN, ElasticEnergy_kNm

# ---- group: STRUCTURAL ANALYSIS RESULTS & VIEW
colour_swatch = ColourSwatch(SwatchColor=RGB(222, 103, 0))  # disabled
colour_swatch_2 = ColourSwatch(SwatchColor=RGB(123, 228, 255))  # disabled
merge = Merge(
    Data1=colour_swatch,
    Data2=colour_swatch,
    Data3=colour_swatch,
    Data4=colour_swatch_2,
    Data5=colour_swatch_2,
    Data6=colour_swatch_2)  # disabled
model_view_karamba3d = ModelViewKaramba3D(Model=analyze_karamba3d.CalculatedModel, ResultFactors=1, ResultCase=-1, Colors=merge)  # -> Model, DeformedMesh, DeformedAxes, DeformedModel; disabled
number_slider_7 = Slider(0, range=0..1)  # disabled
panel_7 = Panel("10 to 100")  # disabled
panel_8 = Panel("90")  # disabled
beso_for_shells_karamba3d = BESOForShellsKaramba3D(
    Model=model_view_karamba3d.Model,
    LCases=0,
    TargetMassRatio=number_slider_7,
    MaxIter=10,
    ER=-1,
    ARmax=0.05,
    Nhist=3,
    Conv=0.01,
    Rmin=-1,
    Rexp=1,
    KillThick=1e-05)  # -> BSEOModel, ModelHistory, CHistory, VHistory, Info; disabled
range = Range(Domain=panel_7, Steps=panel_8)  # disabled
shell_view_karamba3d = ShellViewKaramba3D(Model=beso_for_shells_karamba3d.BSEOModel, IndexOfLayer=0)  # -> Model, MeshesOfRenderedShells, LegendColors, LegendTags; disabled
shell_view_karamba3d_2 = ShellViewKaramba3D(Model=model_view_karamba3d.Model, IndexOfLayer=0)  # -> Model, MeshesOfRenderedShells, LegendColors, LegendTags; disabled
cross_section_karamba3d_2 = CrossSectionKaramba3D(
    FamilyNameOfCrossSection=panel_5,
    NameOfCrossSection=panel_6,
    Material=material_properties_karamba3d,
    Height_cm=range,
    mode="Shell - Const")  # disabled
number_slider_8 = Slider(2, range=0..2)  # disabled
legend = Legend(Colour=shell_view_karamba3d.LegendColors, Tags=shell_view_karamba3d.LegendTags, LegendType=1)  # disabled
legend_2 = Legend(Colour=shell_view_karamba3d_2.LegendColors, Tags=shell_view_karamba3d_2.LegendTags, LegendType=1)  # disabled
shell_forces_karamba3d = ShellForcesKaramba3D(AnalyzedModel=shell_view_karamba3d_2.Model, LCase=0, mode="Principal")  # -> AnalyzedModel, FirstPrincipalNormalForce_kN_m, SecondPrincipalNormalForce_kN_m, FirstPrincipalMoment_kNm_m, SecondPrincipalMoment_kNm_m, ShearForceInLocalXDirection_kN_m, ShearForceInLocalYDirection_kN_m; disabled
optimize_cross_section_karamba3d = OptimizeCrossSectionKaramba3D(
    Model=model_view_karamba3d.Model,
    CrossSections=cross_section_karamba3d_2,
    MaximumUtilization=1,
    MaximumDisplacement_cm=number_slider_8,
    UltimateLimitStateIterations=5,
    DisplacementIterations=5,
    NumberOfSamplePoints=3,
    ElasticDesign=True,
    GammaM0=1,
    GammaM1=1)  # -> ModelWithOptimizedCrossSections, Info, Mass_kg, MaximumDisplacement_cm, ElasticEnergy_kNm; disabled
smaller_than = SmallerThan(FirstNumber=shell_forces_karamba3d.FirstPrincipalNormalForce_kN_m, SecondNumber=0)  # -> SmallerThan, OrEqualTo; disabled
larger_than = LargerThan(FirstNumber=shell_forces_karamba3d.FirstPrincipalNormalForce_kN_m, SecondNumber=0)  # -> LargerThan, OrEqualTo; disabled
cull_pattern = CullPattern(List=shell_forces_karamba3d.FirstPrincipalNormalForce_kN_m, CullPattern=smaller_than.SmallerThan)  # disabled
cull_pattern_2 = CullPattern(List=shell_forces_karamba3d.FirstPrincipalNormalForce_kN_m, CullPattern=larger_than.LargerThan)  # disabled
nodes_under_compression_stress = Panel(cull_pattern)  # disabled
nodes_under_tension_stress = Panel(cull_pattern_2)  # disabled

# ----
shell_view_karamba3d_3 = ShellViewKaramba3D(Model=optimize_cross_section_karamba3d.ModelWithOptimizedCrossSections, IndexOfLayer=0)  # -> Model, MeshesOfRenderedShells, LegendColors, LegendTags; disabled
legend_3 = Legend(Colour=shell_view_karamba3d_3.LegendColors, Tags=shell_view_karamba3d_3.LegendTags, LegendType=1)  # disabled
