# Grasshopper definition 2x3_Relaxed Box.gh (Grasshopper 1.0.7)
# plug-ins: Weaverbird, Kangaroo2 Components

# ---- group: Box Mesh
mesh = Mesh(<mesh referenced from the Rhino model>)

# ---- group: Mesh Division
mjoin = MeshJoin(Meshes=flatten(mesh))
wbsplitquads = WeaverbirdsConstantQuadsSplitSubdivision(MeshCurves=mjoin, Level=Slider(3, range=0..10), SmoothNakedEdges=0)

# ----
data = Data(wbsplitquads)

# ---- group: Anchor Points
nakedvertices = NakedVertices(Mesh=wbsplitquads)  # -> ClothedIndex, NakedIndex, ClothedPts, NakedPts
data_2 = Data(nakedvertices.ClothedPts)
curve = Curve(<curve referenced from the Rhino model>)
incurve = PointInCurve(Point=data_2, Curve=curve)  # -> Relationship, Point
expression = Expression(x=incurve.Relationship, y=Slider(2, range=0..10), Expression="If ((x=y), 1,x)")
dispatch = Dispatch(List=data_2, DispatchPattern=expression)  # -> ListA, flatten(ListB)
anchor = Anchor(Point=[dispatch.ListA, nakedvertices.NakedPts], Strength=10000)
anchorxyz = AnchorXYZ(Point=dispatch.ListB, X=True, Y=True, Z=False, Strength=1000)

# ----
edgelengths = EdgeLengths(Mesh=data, LengthFactor=1, Strength=Slider(10, range=1..20))
vertexloads = VertexLoads(Mesh=data, Strength=Slider(0.23, range=0..1))
show = Show(G=data)
bouncysolver = BouncySolver(
    GoalObjects=[show, vertexloads, edgelengths, anchor, anchorxyz],
    Reset=Button(),
    Threshold=1e-15,
    Tolerance=0.0001,
    Damping=Slider(0.8, range=0..1),
    Iterations=10,
    On=Toggle(True))  # -> I, V, O

# ---- group: Final Relaxed Mesh
mesh_2 = Mesh(bouncysolver.O)
