# Grasshopper definition 2x4_Ribs Ceiling Structural.gh (Grasshopper 1.0.7)
# plug-ins: MeshEdit Components, Weaverbird, Kangaroo2 Components, karambaGH

cat_b = Curve(<curve referenced from the Rhino model>)
cat_a = Curve(<curve referenced from the Rhino model>)

curve = Curve(<curve referenced from the Rhino model>)

# ---- group: NUMBER OF SEGMENTS IN EACH ARCH
number_slider = Slider(50, range=0..50)

# ---- group: WALLS
unit_z = UnitZ(Factor=Slider(2.4, range=0..3))  # -> expr("-x", UnitVector)
extrude = Extrude(Base=curve, Direction=unit_z)
mesh_brep = MeshBrep(
    Brep=extrude,
    Settings={GridMaxCount=0, GridMinCount=16, JaggedSeams=False, MaxEdgeLength=0, MinEdgeLength=0.0001, MinTolerance=0, Refine=True, RefineAngle=0, RelativeTolerance=0.65, SimplePlanes=True, Tolerance=0})
mesh_explode = MeshExplode(Mesh=mesh_brep, Interpolate=False)
weaverbird_s_catmull_clark_subdivision = WeaverbirdsCatmullClarkSubdivision(MeshCurves=mesh_explode, Level=Slider(3, range=0..10), SmoothNakedEdges=2)  # -> flatten(OutputMeshCurves)
nakedvertices = NakedVertices(Mesh=weaverbird_s_catmull_clark_subdivision)  # -> ClothedIndex, NakedIndex, ClothedPts, flatten(NakedPts)
meshcorners = MeshCorners(Mesh=weaverbird_s_catmull_clark_subdivision, Angle=2.35619449)  # -> flatten(Corners)
mesh_join = MeshJoin(Meshes=weaverbird_s_catmull_clark_subdivision)
deconstruct = Deconstruct(Point=nakedvertices.NakedPts)  # -> XComponent, YComponent, ZComponent
deconstruct_2 = Deconstruct(Point=meshcorners)  # -> XComponent, YComponent, ZComponent
sort_list = SortList(Keys=deconstruct_2.ZComponent, ValuesValuesA=meshcorners)  # -> Keys, ValuesValuesA
sort_list_2 = SortList(Keys=deconstruct.ZComponent, ValuesValuesA=nakedvertices.NakedPts)  # -> Keys, ValuesValuesA
dispatch = Dispatch(List=sort_list_2.ValuesValuesA, DispatchPattern=sort_list_2.Keys)  # -> ListA, ListB
dispatch_2 = Dispatch(List=sort_list.ValuesValuesA, DispatchPattern=sort_list.Keys)  # -> ListA, ListB
removeduplicatepts = RemoveDuplicatePts(Points=dispatch.ListB, Tolerance=0.01)
removeduplicatepts_2 = RemoveDuplicatePts(Points=dispatch_2.ListA, Tolerance=0.01)

# ---- group: ARCHES DIVISION IN SEGMENTS
divide_curve = DivideCurve(Curve=cat_a, Count=number_slider, Kinks=False)  # -> Points, Tangents, Parameters
divide_curve_2 = DivideCurve(Curve=cat_b, Count=number_slider, Kinks=False)  # -> Points, Tangents, Parameters
polyline = PolyLine(Vertices=divide_curve_2.Points, Closed=False)
polyline_2 = PolyLine(Vertices=divide_curve.Points, Closed=False)
explode = Explode(Curve=polyline_2, Recursive=True)  # -> Segments, Vertices
explode_2 = Explode(Curve=polyline, Recursive=True)  # -> Segments, Vertices

# ---- group: CAT A
point = Point(divide_curve.Points)

# ---- group: CAT B
point_2 = Point(divide_curve_2.Points)

# ---- group: CEILING AREA PER ARCH SEGMENT
list_length = ListLength(List=point)
list_length_2 = ListLength(List=point_2)
subtraction = Subtraction(A=list_length, B=2)
subtraction_2 = Subtraction(A=list_length_2, B=2)
construct_domain = ConstructDomain(DomainStart="0", DomainEnd=subtraction)
construct_domain_2 = ConstructDomain(DomainStart="0", DomainEnd=subtraction_2)
range = Range(Domain=construct_domain, Steps=subtraction)
range_2 = Range(Domain=construct_domain_2, Steps=subtraction_2)
reverse_list = ReverseList(List=point_2)
list_item = ListItem(List=point, Index=range, Wrap=True)  # -> Item, Item1
list_item_2 = ListItem(List=point_2, Index=range_2, Wrap=True)  # -> Item, Item1
list_item_3 = ListItem(List=reverse_list, Index=range_2, Wrap=True)  # -> Item, Item1
_4point_surface = _4PointSurface(CornerA=list_item.Item, CornerB=list_item_2.Item, CornerC=list_item_2.Item1, CornerD=list_item.Item1)
_4point_surface_2 = _4PointSurface(CornerA=list_item.Item, CornerB=list_item_3.Item, CornerC=list_item_3.Item1, CornerD=list_item.Item1)
area = Area(Geometry=_4point_surface)  # -> Area, Centroid
area_2 = Area(Geometry=_4point_surface_2)  # -> Area, Centroid
division = Division(A=area.Area, B=2)
division_2 = Division(A=area_2.Area, B=2)

# ----
division_3 = Division(A=number_slider, B=2)
division_4 = Division(A=number_slider, B=2)
cull_index = CullIndex(List=point, Indices=division_3, Wrap=True)
cull_index_2 = CullIndex(List=point_2, Indices=division_4, Wrap=True)
end_points = EndPoints(Curve=cat_a)  # -> Start, End
end_points_2 = EndPoints(Curve=cat_b)  # -> Start, End

# ---- group: AREA EQUIVALENT TO EACH CAT POINT
addition = Addition(A=division, B=division_2)

# ---- group: CAT A - POINTS TO APPLY LOAD
point_3 = Point(cull_index)

# ---- group: CAT B - POINTS TO APPLY LOAD
point_4 = Point(cull_index_2)

# ---- group: WALLS MESH
mesh = Mesh(mesh_join)

# ---- group: WALL FOUNDATIONS - SUPPORTS
point_5 = Point(removeduplicatepts)

# ---- group: RIB CONNECTION POINTS
point_6 = Point(removeduplicatepts_2)

# ---- group: CAT A & START POINTS
point_7 = Point([end_points.Start, end_points.End, end_points_2.Start, end_points_2.End])

# ---- group: COLUMNS
line_sdl = LineSDL(Start=point_7, Direction="0,0,-1", Length=Slider(2.4, range=0..3))
end_points_3 = EndPoints(Curve=line_sdl)  # -> Start, End

# ---- group: COLUMNS FOUNDATIONS - SUPPORTS
point_8 = Point(end_points_3.End)

# ---- group: COLUMNS
curve_2 = Curve(line_sdl)

# ---- group: CAT A - SEGMENTS
curve_3 = Curve(explode.Segments)

# ---- group: CAT B - SEGMENTS
curve_4 = Curve(explode_2.Segments)

# ----
panel = Panel(addition)

# ---- group: ADOBE BRICK PROPERTIES
young_s_modulus_n_mm_2 = Panel("80")
density_kg_m_3 = Panel("1200")
gravity_m_s_2 = Panel("9.81")
compressive_strength_n_mm_2 = Panel("1")
expression = Expression(E=young_s_modulus_n_mm_2, Expression="E*0.1")
expression_2 = Expression(d=density_kg_m_3, g=gravity_m_s_2, Expression="(d*g)*0.001")
mpa_to_kn_cm_2 = Multiplication(A=compressive_strength_n_mm_2, B=0.1)
division_5 = Division(A=expression, B=2.5)

# ---- group: BRICK SIZE
width = Slider(0.2, range=0..1)
length = Slider(0.3, range=0..1)
height = Slider(0.1, range=0..1)
multiplication = Multiplication(A=height, B=100)
multiplication_2 = Multiplication(A=width, B=100)
multiplication_3 = Multiplication(A=length, B=100)
domain_box = DomainBox(Base=PlaneXY(0, 0, 0), Width=width, Length=length, Height=height)

# ----
point_9 = Point([point_3, point_4])

# ---- group: MATERIAL DEFINITION
material_properties_karamba3d = MaterialPropertiesKaramba3D(
    FamilyOfMaterial="Bricks",
    Name="Adobe Bricks ",
    YoungsModulus_kN_cm2=expression,
    InPlaneShearModulus_kN_cm2=division_5,
    TransverseShearModulus_kN_cm2=8076,
    SpecificWeight_kN_m3=expression_2,
    CoefficientOfThermalExpansion_1_C=1e-05,
    YieldStrength_kN_cm2=mpa_to_kn_cm_2,
    mode="Isotrop")

# ---- group: LOADS
# Self-Weight Load
# Sand Load
# Infill Load
# Wind Load
facade_area_m_2 = Panel("1")
sand_thickness_m = Panel("0.1")
infill_thickness_m = Panel("0.1")
sand_density_kg_m_3 = Panel("1400")
infill_density_kg_m_3 = Panel("1200")
wind_speed_m_s = Panel("10")
gravity_m_s_2_2 = Panel("9.81")
gravity_m_s_2_3 = Panel("9.81")
air_density_kg_m_3 = Panel("1.2")
deconstruct_3 = Deconstruct(Point=point_9)  # -> XComponent, YComponent, ZComponent
expression_3 = Expression(
    Density=infill_density_kg_m_3,
    Thickness=infill_thickness_m,
    Area=addition,
    Gravity=gravity_m_s_2_3,
    Expression="(((Density*(Thickness*Area))*Gravity))*10^-3")
expression_4 = Expression(
    Density=sand_density_kg_m_3,
    Thickness=sand_thickness_m,
    Area=addition,
    Gravity=gravity_m_s_2_2,
    Expression="(((Density*(Thickness*Area))*Gravity))*10^-3")
expression_5 = Expression(
    Density=air_density_kg_m_3,
    Speed=wind_speed_m_s,
    Area=facade_area_m_2,
    Expression="(((Density*(Speed^2))*Area)*(1/2))*10^-3")
average = Average(Input=deconstruct_3.XComponent)
evaluate = Evaluate(Expression="if((X=A)or(X<A),1,0)", X=deconstruct_3.XComponent, A=average)
dispatch_3 = Dispatch(List=point_9, DispatchPattern=evaluate)  # -> ListA, ListB
Z = UnitZ(Factor=expression_3)
Z_2 = UnitZ(Factor=expression_4)
neg = Negative(Value=Z)
neg_2 = Negative(Value=Z_2)
unit_x = UnitX(Factor=expression_5)
point_10 = Point(dispatch_3.ListA)
sand_cat_b = LoadsKaramba3D(ForceVector=neg, Local=False, PosInd=point_4, LCase="4", mode="Point")
self_weight = LoadsKaramba3D(Vector="0,0,-1", LCase="0", mode="Gravity")
infill_cat_b = LoadsKaramba3D(ForceVector=neg_2, Local=False, PosInd=point_4, LCase="2", mode="Point")
sand_cat_a = LoadsKaramba3D(ForceVector=neg, Local=False, PosInd=point_3, LCase="3", mode="Point")
infill_cat_a = LoadsKaramba3D(ForceVector=neg_2, Local=False, PosInd=point_3, LCase="1", mode="Point")
wind = LoadsKaramba3D(ForceVector=unit_x, Local=False, PosInd=point_10, LCase="5", mode="Point")

# ---- group: CROSS SECTION - WALLS
panel_2 = Panel("Walls")
panel_3 = Panel("Wall 1x1")
panel_4 = Panel("w001")
brick_module = Panel("0.15")
multiplication_4 = Multiplication(A=Slider(3, range=1..10), B=brick_module)
multiplication_5 = Multiplication(A=multiplication_4, B=100)
cross_section_karamba3d = CrossSectionKaramba3D(
    FamilyNameOfCrossSection=panel_2,
    NameOfCrossSection=panel_3,
    ElementIdentifier=panel_4,
    Material=material_properties_karamba3d,
    Height_cm=multiplication_5,
    mode="Shell - Const")

# ---- group: CROSS SECTION - RIBS
height_2 = Slider(0.6, range=0..2)
width_2 = Slider(0.45, range=0..2)
panel_5 = Panel("Ribs 1x1")
panel_6 = Panel("Catenary Ribs")
panel_7 = Panel("r001")
multiplication_6 = Multiplication(A=height_2, B=100)
multiplication_7 = Multiplication(A=width_2, B=100)
cross_section_karamba3d_2 = CrossSectionKaramba3D(
    FamilyNameOfCrossSection=panel_6,
    NameOfCrossSection=panel_5,
    ElementIdentifier=panel_7,
    Material=material_properties_karamba3d,
    Height_cm=multiplication_6,
    UpperFlangeWidth_cm=multiplication_7,
    LowerFlangeWidth_cm=multiplication_7,
    mode="Trapezoid")

# ---- group: CROSS SECTION - COLUMNS
height_3 = Slider(0.6, range=0..2)
width_3 = Slider(0.45, range=0..2)
panel_8 = Panel("c001")
multiplication_8 = Multiplication(A=height_3, B=100)
multiplication_9 = Multiplication(A=width_3, B=100)
cross_section_karamba3d_3 = CrossSectionKaramba3D(
    FamilyNameOfCrossSection="Columns",
    NameOfCrossSection="Columns 1x1",
    ElementIdentifier=panel_8,
    Material=material_properties_karamba3d,
    Height_cm=multiplication_8,
    UpperFlangeWidth_cm=multiplication_9,
    LowerFlangeWidth_cm=multiplication_9,
    mode="Trapezoid")

# ---- group: STRUCTURAL ANALYSIS SET UP
line_to_beam_karamba3d = LineToBeamKaramba3D(
    Line=flatten([curve_4, curve_3]),
    Identifier=panel_7,
    CrossSection=cross_section_karamba3d_2,
    New=True,
    Remove=True,
    LimitDistance_m=0.005)  # -> Element, Points, Info
line_to_beam_karamba3d_2 = LineToBeamKaramba3D(
    Line=flatten(curve_2),
    Identifier=panel_8,
    CrossSection=cross_section_karamba3d_3,
    New=True,
    Remove=True,
    LimitDistance_m=0.005)  # -> Element, Points, Info
mesh_to_shell_karamba3d = MeshToShellKaramba3D(Mesh=flatten(mesh), Identifier=panel_4, CrossSection=cross_section_karamba3d, LimitDistance_m=0.005)  # -> Element, Points, Info
beam_joints_karamba3d = BeamJointsKaramba3D(
    ElementIdentifiers=panel_7,
    CtKNMAtStartingNode=Vector(0, 0, 0),
    CrKNmRadAtStartingNode=Vector(0, 0, 0),
    CtKNMAtEndNode=Vector(0, 0, 0),
    CrKNmRadAtEndNode=Vector(0, 0, 0),
    menu=[buttons(off, off, off, on, on, on), buttons(off, off, off, on, on, on)])  # disabled
support_karamba3d = SupportKaramba3D(PosInd=flatten(point_5), menu=[buttons(on, on, on, on, on, on)])
beam_joint_agent_karamba3d = BeamJointAgentKaramba3D(
    AtElementIdentifiers=panel_7,
    Ct_kN_m=Vector(0, 0, 0),
    Cr_kNm_rad=Vector(0, 0, 0),
    menu=[buttons(on, on, on, on, on, on)])  # disabled
assemble_model_karamba3d = AssembleModelKaramba3D(
    Elem=flatten([line_to_beam_karamba3d.Element, mesh_to_shell_karamba3d.Element]),
    Support=flatten(support_karamba3d),
    Load=flatten([self_weight, infill_cat_a, infill_cat_b, sand_cat_a, sand_cat_b, wind]),
    Joint=flatten([beam_joints_karamba3d, beam_joint_agent_karamba3d]),
    LimitDistance_m=0.005)  # -> Model, Info, Mass_kg, CenterOfGravity
analyze_karamba3d = AnalyzeKaramba3D(Model=assemble_model_karamba3d.Model)  # -> CalculatedModel, MaximumDisplacement_cm, ResultingForceOfGravity_kN, ElasticEnergy_kNm

# ---- group: STRUCTURAL MODEL VIEW SET UP
colour_swatch = ColourSwatch(SwatchColor=RGB(222, 103, 0))
colour_swatch_2 = ColourSwatch(SwatchColor=RGB(123, 228, 255))
merge = Merge(
    Data1=colour_swatch,
    Data2=colour_swatch,
    Data3=colour_swatch,
    Data4=colour_swatch_2,
    Data5=colour_swatch_2,
    Data6=colour_swatch_2)
model_view_karamba3d = ModelViewKaramba3D(Model=analyze_karamba3d.CalculatedModel, ResultFactors=1, ResultCase=-1, Colors=merge)  # -> Model, DeformedMesh, DeformedAxes, DeformedModel

# ---- group: RIBS STRUCTURAL RESULTS
beamview = BeamViewKaramba3D(Model=model_view_karamba3d.Model)  # -> Model, MeshesOfRenderedBeams, DeformedBeamAxes, LegendColors, LegendTags
legend = Legend(Colour=beamview.LegendColors, Tags=beamview.LegendTags, LegendType=1)
utilization = UtilizationOfElementsKaramba3D(
    AnalyzedModel=beamview.Model,
    ResultCase=-1,
    NumberOfSamplePoints=3,
    ElasticDesign=True,
    GammaM0=1,
    GammaM1=1,
    WithDetails=False,
    mode="Beams")  # -> AnalyzedModel, Utilization, SigMax_kN_cm2, SigMin_kN_cm2, TauMax_kN_cm2, UtilN, UtilVy, UtilVz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
sort = SortList(Keys=utilization.Utilization)  # -> reverse(Keys), ValuesA
sort_2 = SortList(Keys=utilization.SigMax_kN_cm2)  # -> reverse(Keys), ValuesA
sort_3 = SortList(Keys=utilization.SigMin_kN_cm2)  # -> reverse(Keys), ValuesA
panel_9 = Panel(sort_3.Keys)
panel_10 = Panel(sort.Keys)
panel_11 = Panel(sort_2.Keys)

# ---- group: WALLS STRUCTURAL RESULTS
shell_view_karamba3d = ShellViewKaramba3D(Model=model_view_karamba3d.Model, IndexOfLayer=0)  # -> Model, MeshesOfRenderedShells, LegendColors, LegendTags
legend_2 = Legend(Colour=shell_view_karamba3d.LegendColors, Tags=shell_view_karamba3d.LegendTags, LegendType=1)
result_vectors_on_shells_karamba3d = ResultVectorsOnShellsKaramba3D(AnalyzedModel=shell_view_karamba3d.Model, LayerPosition=0, mode="PrincStress")  # -> AnalyzedModel, Points, FirstPrincipalStressVector_kN_cm2, SecondPrincipalStressVector_kN_cm2, FirstPrincipalStressValue_kN_cm2, SecondPrincipalStressValue_kN_cm2
sort_list_3 = SortList(Keys=result_vectors_on_shells_karamba3d.FirstPrincipalStressValue_kN_cm2)  # -> reverse(Keys), ValuesValuesA
panel_12 = Panel(sort_list_3.Keys)

# ---- group: STRUCTURAL OPTIMIZATION - RIBS
panel_13 = Panel("1 to 100")  # disabled
panel_14 = Panel("1 to 100")  # disabled
panel_15 = Panel("99")  # disabled
panel_16 = Panel("99")  # disabled
range_3 = Range(Domain=panel_13, Steps=panel_16)  # disabled
range_4 = Range(Domain=panel_14, Steps=panel_15)  # disabled
cross_section_karamba3d_4 = CrossSectionKaramba3D(
    FamilyNameOfCrossSection=panel_6,
    NameOfCrossSection=panel_5,
    ElementIdentifier=panel_7,
    Material=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,
    Height_cm=range_3,
    UpperFlangeWidth_cm=range_4,
    LowerFlangeWidth_cm=range_4,
    mode="Trapezoid")  # disabled
number_slider_2 = Slider(0.02, range=0..1)  # disabled
optimize_cross_section_karamba3d = OptimizeCrossSectionKaramba3D(
    Model=beamview.Model,
    CrossSections=cross_section_karamba3d_4,
    MaximumUtilization=number_slider_2,
    MaximumDisplacement_cm=-1,
    UltimateLimitStateIterations=5,
    DisplacementIterations=5,
    NumberOfSamplePoints=3,
    ElasticDesign=True,
    GammaM0=1,
    GammaM1=1)  # -> ModelWithOptimizedCrossSections, Info, Mass_kg, MaximumDisplacement_cm, ElasticEnergy_kNm; disabled
colour_swatch_3 = ColourSwatch(SwatchColor=RGB(222, 103, 0))  # disabled
colour_swatch_4 = ColourSwatch(SwatchColor=RGB(123, 228, 255))  # disabled
merge_2 = Merge(
    Data1=colour_swatch_3,
    Data2=colour_swatch_3,
    Data3=colour_swatch_3,
    Data4=colour_swatch_4,
    Data5=colour_swatch_4,
    Data6=colour_swatch_4)  # disabled
model_view_karamba3d_2 = ModelViewKaramba3D(Model=optimize_cross_section_karamba3d.ModelWithOptimizedCrossSections, ResultFactors=1, ResultCase=-1, Colors=merge_2)  # -> Model, DeformedMesh, DeformedAxes, DeformedModel; disabled
beamview_2 = BeamViewKaramba3D(Model=model_view_karamba3d_2.Model)  # -> Model, MeshesOfRenderedBeams, DeformedBeamAxes, LegendColors, LegendTags; disabled
legend_3 = Legend(Colour=beamview_2.LegendColors, Tags=beamview_2.LegendTags, LegendType=1)  # disabled
utilization_2 = UtilizationOfElementsKaramba3D(
    AnalyzedModel=beamview_2.Model,
    ResultCase=-1,
    NumberOfSamplePoints=3,
    ElasticDesign=True,
    GammaM0=1,
    GammaM1=1,
    WithDetails=False,
    mode="Beams")  # -> AnalyzedModel, Utilization, SigMax_kN_cm2, SigMin_kN_cm2, TauMax_kN_cm2, UtilN, UtilVy, UtilVz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; disabled
sort_4 = SortList(Keys=utilization_2.Utilization)  # -> reverse(Keys), ValuesA; disabled
sort_5 = SortList(Keys=utilization_2.SigMax_kN_cm2)  # -> reverse(Keys), ValuesA; disabled
sort_6 = SortList(Keys=utilization_2.SigMin_kN_cm2)  # -> reverse(Keys), ValuesA; disabled
panel_17 = Panel(sort_4.Keys)  # disabled
panel_18 = Panel(sort_5.Keys)  # disabled
panel_19 = Panel(sort_6.Keys)  # disabled

# ---- group: STRUCTURAL OPTIMIZATION - WALLS
panel_20 = Panel("1 to 100")  # disabled
panel_21 = Panel("99")  # disabled
range_5 = Range(Domain=panel_20, Steps=panel_21)  # disabled
cross_section_karamba3d_5 = CrossSectionKaramba3D(
    FamilyNameOfCrossSection=panel_2,
    NameOfCrossSection=panel_3,
    ElementIdentifier=panel_4,
    Material=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,
    Height_cm=range_5,
    mode="Shell - Const")  # disabled
number_slider_3 = Slider(0.02, range=0..1)  # disabled
optimize_cross_section_karamba3d_2 = OptimizeCrossSectionKaramba3D(
    Model=beamview.Model,
    CrossSections=cross_section_karamba3d_5,
    MaximumUtilization=number_slider_3,
    MaximumDisplacement_cm=-1,
    UltimateLimitStateIterations=5,
    DisplacementIterations=5,
    NumberOfSamplePoints=3,
    ElasticDesign=True,
    GammaM0=1,
    GammaM1=1)  # -> ModelWithOptimizedCrossSections, Info, Mass_kg, MaximumDisplacement_cm, ElasticEnergy_kNm; disabled
colour_swatch_5 = ColourSwatch(SwatchColor=RGB(222, 103, 0))  # disabled
colour_swatch_6 = ColourSwatch(SwatchColor=RGB(123, 228, 255))  # disabled
merge_3 = Merge(
    Data1=colour_swatch_5,
    Data2=colour_swatch_5,
    Data3=colour_swatch_5,
    Data4=colour_swatch_6,
    Data5=colour_swatch_6,
    Data6=colour_swatch_6)  # disabled
model_view_karamba3d_3 = ModelViewKaramba3D(Model=optimize_cross_section_karamba3d_2.ModelWithOptimizedCrossSections, ResultFactors=1, ResultCase=-1, Colors=merge_3)  # -> Model, DeformedMesh, DeformedAxes, DeformedModel; disabled
beamview_3 = BeamViewKaramba3D(Model=model_view_karamba3d_3.Model)  # -> Model, MeshesOfRenderedBeams, DeformedBeamAxes, LegendColors, LegendTags; disabled
legend_4 = Legend(Colour=beamview_3.LegendColors, Tags=beamview_3.LegendTags, LegendType=1)  # disabled
utilization_3 = UtilizationOfElementsKaramba3D(
    AnalyzedModel=beamview_3.Model,
    ResultCase=-1,
    NumberOfSamplePoints=3,
    ElasticDesign=True,
    GammaM0=1,
    GammaM1=1,
    WithDetails=False,
    mode="Beams")  # -> AnalyzedModel, Utilization, SigMax_kN_cm2, SigMin_kN_cm2, TauMax_kN_cm2, UtilN, UtilVy, UtilVz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; disabled
sort_7 = SortList(Keys=utilization_3.Utilization)  # -> reverse(Keys), ValuesA; disabled
sort_8 = SortList(Keys=utilization_3.SigMax_kN_cm2)  # -> reverse(Keys), ValuesA; disabled
sort_9 = SortList(Keys=utilization_3.SigMin_kN_cm2)  # -> reverse(Keys), ValuesA; disabled
panel_22 = Panel(sort_7.Keys)  # disabled
panel_23 = Panel(sort_8.Keys)  # disabled
panel_24 = Panel(sort_9.Keys)  # disabled

# ---- group: WALLS - TENSION STRESSES THRESHOLD
division_6 = Division(A=mpa_to_kn_cm_2, B=10)
larger_than = LargerThan(FirstNumber=result_vectors_on_shells_karamba3d.FirstPrincipalStressValue_kN_cm2, SecondNumber=division_6)  # -> LargerThan, OrEqualTo
dispatch_4 = Dispatch(List=result_vectors_on_shells_karamba3d.FirstPrincipalStressValue_kN_cm2, DispatchPattern=larger_than.LargerThan)  # -> ListA, ListB
panel_25 = Panel(dispatch_4.ListA)

# ---- group: RIBS - TENSION STRESSES THRESHOLD
division_7 = Division(A=mpa_to_kn_cm_2, B=10)
larger_than_2 = LargerThan(FirstNumber=utilization.SigMax_kN_cm2, SecondNumber=division_7)  # -> LargerThan, OrEqualTo
dispatch_5 = Dispatch(List=utilization.SigMax_kN_cm2, DispatchPattern=larger_than_2.LargerThan)  # -> ListA, ListB
panel_26 = Panel(dispatch_5.ListA)
