# Grasshopper definition 6x4_Ribs Ceiling Structural - BUTTRESS - WIN.gh (Grasshopper 1.0.7)
# plug-ins: MeshEdit Components, Weaverbird, Kangaroo2 Components, karambaGH

# ---- group: CATENARIES
curve = Curve([<curve referenced from the Rhino model> x8])

# ---- group: ROOM BOUNDARY / WALLS
curve_2 = Curve([<curve referenced from the Rhino model> x4])

# ---- group: BUTTRESSES
curve_3 = Curve([<curve referenced from the Rhino model> x8])

# ---- group: NUMBER OF ARCH DIVISIONS
number_slider = Slider(50, range=0..50)

# ----
unit_z = UnitZ(Factor="-1")
end_points = EndPoints(Curve=curve_2)  # -> Start, End
end_points_2 = EndPoints(Curve=curve)  # -> Start, End
line_sdl = LineSDL(Start=end_points.Start, Direction=unit_z, Length=Slider(2.4, range=0..10))

# ---- group: CURVES & DIVISIONS
divide_curve = DivideCurve(Curve=curve, Count=number_slider, Kinks=False)  # -> Points, Tangents, Parameters
expression = Expression(x=number_slider, Expression="(x/2)")
expression_2 = Expression(x=number_slider, Expression="(x/2)")
construct_domain = ConstructDomain(DomainStart="0", DomainEnd=expression)
construct_domain_2 = ConstructDomain(DomainStart=number_slider, DomainEnd=expression_2)
range = Range(Domain=construct_domain, Steps=expression)
range_2 = Range(Domain=construct_domain_2, Steps=expression_2)
list_item = ListItem(List=divide_curve.Points, Index=range, Wrap=True)
list_item_2 = ListItem(List=divide_curve.Points, Index=range_2, Wrap=True)
flip_matrix = FlipMatrix(Data=list_item)
flip_matrix_2 = FlipMatrix(Data=list_item_2)
deconstruct = Deconstruct(Point=flip_matrix)  # -> XComponent, YComponent, ZComponent
deconstruct_2 = Deconstruct(Point=flip_matrix_2)  # -> XComponent, YComponent, ZComponent
sort_list = SortList(Keys=deconstruct_2.XComponent, ValuesValuesA=flip_matrix_2)  # -> Keys, reverse(ValuesValuesA)
sort_list_2 = SortList(Keys=deconstruct.XComponent, ValuesValuesA=flip_matrix)  # -> Keys, ValuesValuesA
flip_matrix_3 = FlipMatrix(Data=sort_list_2.ValuesValuesA)
flip_matrix_4 = FlipMatrix(Data=sort_list.ValuesValuesA)
polyline = PolyLine(Vertices=flip_matrix_4, Closed=False)
polyline_2 = PolyLine(Vertices=flip_matrix_3, Closed=False)
explode = Explode(Curve=polyline_2, Recursive=True)  # -> Segments, Vertices
explode_2 = Explode(Curve=polyline, Recursive=True)  # -> Segments, Vertices

# ---- group: INDEX
expression_3 = Expression(x=number_slider, Expression="(x/2)-1")
construct_domain_3 = ConstructDomain(DomainStart="0", DomainEnd=expression_3)
range_3 = Range(Domain=construct_domain_3, Steps=expression_3)
list_item_3 = ListItem(List=divide_curve.Points, Index=range_3, Wrap=True)

# ----
list_item_4 = ListItem(List=end_points_2.Start, Index=0, Wrap=True)
unit_z_2 = UnitZ(Factor="-1")
end_points_3 = EndPoints(Curve=line_sdl)  # -> Start, End
unit_x = UnitX(Factor="1")
line_sdl_2 = LineSDL(Start=end_points_3.End, Direction=unit_x, Length=Slider(1.425, range=0..10))
line_sdl_3 = LineSDL(Start=list_item_4, Direction=unit_z_2, Length=Slider(2.4, range=0..10))
end_points_4 = EndPoints(Curve=line_sdl_3)  # -> Start, End
unit_y = UnitY(Factor="-1")
unit_z_3 = UnitZ(Factor=Slider(0.9, range=0..1))
move = Move(Geometry=line_sdl_2, Motion=unit_z_3)  # -> Geometry, Transform
curve_middle = CurveMiddle(Curve=move.Geometry)
line_sdl_4 = LineSDL(Start=end_points_4.End, Direction=unit_y, Length=Slider(1.425, range=0..10))
unit_z_4 = UnitZ(Factor=1)
line_sdl_5 = LineSDL(Start=curve_middle, Direction=unit_z_4, Length=Slider(0.75, range=0..1))

# ---- group: WALLS
unit_z_5 = UnitZ(Factor=Slider(2.4, range=0..3))  # -> expr("-x", UnitVector)
extrude = Extrude(Base=curve_3, Direction=unit_z_5)
mesh_brep = MeshBrep(
    Brep=extrude,
    Settings={GridMaxCount=0, GridMinCount=16, JaggedSeams=False, MaxEdgeLength=0, MinEdgeLength=0.0001, MinTolerance=0, Refine=True, RefineAngle=0, RelativeTolerance=0.65, SimplePlanes=True, Tolerance=0})
mesh_explode = MeshExplode(Mesh=mesh_brep, Interpolate=False)
weaverbird_s_catmull_clark_subdivision = WeaverbirdsCatmullClarkSubdivision(MeshCurves=mesh_explode, Level=Slider(3, range=0..10), SmoothNakedEdges=2)  # -> flatten(OutputMeshCurves)
nakedvertices = NakedVertices(Mesh=weaverbird_s_catmull_clark_subdivision)  # -> ClothedIndex, NakedIndex, ClothedPts, flatten(NakedPts)
mesh_join = MeshJoin(Meshes=weaverbird_s_catmull_clark_subdivision)
deconstruct_3 = Deconstruct(Point=nakedvertices.NakedPts)  # -> XComponent, YComponent, ZComponent
sort_list_3 = SortList(Keys=deconstruct_3.ZComponent, ValuesValuesA=nakedvertices.NakedPts)  # -> Keys, ValuesValuesA
dispatch = Dispatch(List=sort_list_3.ValuesValuesA, DispatchPattern=sort_list_3.Keys)  # -> ListA, ListB
removeduplicatepts = RemoveDuplicatePts(Points=dispatch.ListB, Tolerance=0.01)

# ----
unit_x_2 = UnitX(Factor=Slider(0.3, range=0..1))
unit_y_2 = UnitY(Factor="-4.275")
unit_z_6 = UnitZ(Factor=Slider(0.9, range=0..1))
move_2 = Move(Geometry=line_sdl_4, Motion=unit_z_6)  # -> Geometry, Transform
unit_x_3 = UnitX(Factor=Slider(-0.6, range=-1..1))
unit_z_7 = UnitZ(Factor=1)
move_3 = Move(Geometry=line_sdl_5, Motion=unit_x_2)  # -> Geometry, Transform
move_4 = Move(Geometry=move_3.Geometry, Motion=unit_x_3)  # -> Geometry, Transform
move_5 = Move(Geometry=line_sdl_4, Motion=unit_y_2)  # -> Geometry, Transform
curve_middle_2 = CurveMiddle(Curve=move_5.Geometry)
curve_middle_3 = CurveMiddle(Curve=move_2.Geometry)
line_sdl_6 = LineSDL(Start=curve_middle_2, Direction=unit_z_7, Length=Slider(1.55, range=0..10))
unit_z_8 = UnitZ(Factor=1)
unit_y_3 = UnitY(Factor=Slider(-0.9, range=-1..1))
unit_y_4 = UnitY(Factor=Slider(0.45, range=0..1))
end_points_5 = EndPoints(Curve=move_3.Geometry)  # -> Start, End
end_points_6 = EndPoints(Curve=move_4.Geometry)  # -> Start, End
line_sdl_7 = LineSDL(Start=curve_middle_3, Direction=unit_z_8, Length=Slider(0.75, range=0..1))
unit_y_5 = UnitY(Factor=Slider(0.3, range=0..1))
move_6 = Move(Geometry=line_sdl_6, Motion=unit_y_4)  # -> Geometry, Transform
move_7 = Move(Geometry=move_6.Geometry, Motion=unit_y_3)  # -> Geometry, Transform
line = Line(StartPoint=end_points_5.Start, EndPoint=end_points_6.Start)
unit_y_6 = UnitY(Factor=Slider(-0.6, range=-1..1))
unit_z_9 = UnitZ(Factor=1)
move_8 = Move(Geometry=line_sdl_7, Motion=unit_y_5)  # -> Geometry, Transform
move_9 = Move(Geometry=move_8.Geometry, Motion=unit_y_6)  # -> Geometry, Transform
end_points_7 = EndPoints(Curve=move_6.Geometry)  # -> Start, End
end_points_8 = EndPoints(Curve=move_7.Geometry)  # -> Start, End
arc_sed = ArcSED(Start=end_points_5.End, End=end_points_6.End, Direction=unit_z_9)  # -> Arc, Plane, Radius
list_item_5 = ListItem(List=move_3.Geometry, Index=0, Wrap=True)  # -> Item, Item1, Item2
list_item_6 = ListItem(List=line, Index=0, Wrap=True)  # -> Item, Item1, Item2
list_item_7 = ListItem(List=move_4.Geometry, Index=0, Wrap=True)  # -> Item, Item1, Item2
list_item_8 = ListItem(List=arc_sed.Arc, Index=0, Wrap=True)  # -> Item, Item1, Item2
line_2 = Line(StartPoint=end_points_7.Start, EndPoint=end_points_8.Start)
end_points_9 = EndPoints(Curve=move_8.Geometry)  # -> Start, End
end_points_10 = EndPoints(Curve=move_9.Geometry)  # -> Start, End

# ---- group: AREAS
list_length = ListLength(List=curve)
subtraction = Subtraction(A=list_length, B=1)
construct_path = ConstructPath(Indices=["0", subtraction, "0"])
split_tree = SplitTree(Data=explode.Vertices, Masks=construct_path)  # -> Positive, Negative
split_tree_2 = SplitTree(Data=explode.Vertices, Masks="{0;0;0}")  # -> Positive, Negative
split_tree_3 = SplitTree(Data=explode_2.Vertices, Masks=construct_path)  # -> Positive, Negative
split_tree_4 = SplitTree(Data=explode_2.Vertices, Masks="{0;0;0}")  # -> Positive, Negative
list_item_9 = ListItem(List=split_tree.Negative, Index=range_3, Wrap=True)  # -> Item, Item1
list_item_10 = ListItem(List=split_tree_2.Negative, Index=range_3, Wrap=True)  # -> Item, Item1
list_item_11 = ListItem(List=split_tree_3.Negative, Index=range_3, Wrap=True)  # -> Item, Item1
list_item_12 = ListItem(List=split_tree_4.Negative, Index=range_3, Wrap=True)  # -> Item, Item1
list_item_13 = ListItem(List=split_tree.Positive, Index=range_3, Wrap=True)  # -> Item, Item1
list_item_14 = ListItem(List=split_tree_4.Positive, Index=range_3, Wrap=True)  # -> Item, Item1
list_item_15 = ListItem(List=split_tree_3.Positive, Index=range_3, Wrap=True)  # -> Item, Item1
list_item_16 = ListItem(List=split_tree_2.Positive, Index=range_3, Wrap=True)  # -> Item, Item1
_4point_surface = _4PointSurface(CornerA=list_item_9.Item, CornerB=list_item_10.Item, CornerC=list_item_10.Item1, CornerD=list_item_9.Item1)
_4point_surface_2 = _4PointSurface(CornerA=list_item_11.Item, CornerB=list_item_12.Item, CornerC=list_item_12.Item1, CornerD=list_item_11.Item1)
_4point_surface_3 = _4PointSurface(CornerA=list_item_13.Item, CornerB=list_item_14.Item, CornerC=list_item_14.Item1, CornerD=list_item_13.Item1)
_4point_surface_4 = _4PointSurface(CornerA=list_item_15.Item, CornerB=list_item_16.Item, CornerC=list_item_16.Item1, CornerD=list_item_15.Item1)
area = Area(Geometry=_4point_surface)  # -> flatten(Area), Centroid
area_2 = Area(Geometry=_4point_surface_2)  # -> flatten(Area), Centroid
area_3 = Area(Geometry=_4point_surface_3)  # -> flatten(Area), Centroid
area_4 = Area(Geometry=_4point_surface_4)  # -> flatten(Area), Centroid

# ----
unit_z_10 = UnitZ(Factor=1)
boundary_surfaces = BoundarySurfaces(Edges=[list_item_5.Item1, list_item_6.Item1, list_item_7.Item1, list_item_8.Item1])
boundary_surfaces_2 = BoundarySurfaces(Edges=[list_item_5.Item, list_item_6.Item, list_item_7.Item, list_item_8.Item])
line_3 = Line(StartPoint=end_points_9.Start, EndPoint=end_points_10.Start)
unit_z_11 = UnitZ(Factor=1)
arc_sed_2 = ArcSED(Start=end_points_7.End, End=end_points_8.End, Direction=unit_z_10)  # -> Arc, Plane, Radius
boundary_surfaces_3 = BoundarySurfaces(Edges=[move_6.Geometry, line_2, move_7.Geometry, arc_sed_2.Arc])
arc_sed_3 = ArcSED(Start=end_points_9.End, End=end_points_10.End, Direction=unit_z_11)  # -> Arc, Plane, Radius
unit_x_4 = UnitX(Factor="1.425")
unit_x_5 = UnitX(Factor="-1.425")
unit_x_6 = UnitX(Factor="-2.85")
unit_x_7 = UnitX(Factor="1.425")
unit_y_7 = UnitY(Factor="-1.425")
unit_y_8 = UnitY(Factor="-1.425")
boundary_surfaces_4 = BoundarySurfaces(Edges=[move_8.Geometry, line_3, move_9.Geometry, arc_sed_3.Arc])
move_10 = Move(Geometry=boundary_surfaces_2, Motion=unit_x_4)  # -> Geometry, Transform
move_11 = Move(Geometry=boundary_surfaces_2, Motion=unit_x_5)  # -> Geometry, Transform
move_12 = Move(Geometry=boundary_surfaces_2, Motion=unit_x_6)  # -> Geometry, Transform
move_13 = Move(Geometry=boundary_surfaces, Motion=unit_x_7)  # -> Geometry, Transform
unit_x_8 = UnitX(Factor="8.55")
unit_y_9 = UnitY(Factor="-1.425")
unit_y_10 = UnitY(Factor="-1.425")
unit_y_11 = UnitY(Factor="-1.425")

# ---- group: COLUMNS
end_points_11 = EndPoints(Curve=curve)  # -> Start, End
removeduplicatepts_2 = RemoveDuplicatePts(Points=[end_points_11.Start, end_points_11.End], Tolerance=0.01)
line_sdl_8 = LineSDL(Start=removeduplicatepts_2, Direction="0,0,-1", Length=Slider(2.4, range=0..3))
end_points_12 = EndPoints(Curve=line_sdl_8)  # -> Start, End

# ----
unit_x_9 = UnitX(Factor="-1.425")
unit_x_10 = UnitX(Factor="-1.425")
unit_x_11 = UnitX(Factor="-1.425")
unit_x_12 = UnitX(Factor="-1.425")
unit_x_13 = UnitX(Factor="-1.425")
unit_y_12 = UnitY(Factor="-6.15")
move_14 = Move(Geometry=boundary_surfaces_4, Motion=unit_y_7)  # -> Geometry, Transform
move_15 = Move(Geometry=move_14.Geometry, Motion=unit_y_8)  # -> Geometry, Transform
move_16 = Move(Geometry=boundary_surfaces_4, Motion=unit_x_8)  # -> Geometry, Transform
move_17 = Move(Geometry=move_16.Geometry, Motion=unit_y_9)  # -> Geometry, Transform
move_18 = Move(Geometry=move_17.Geometry, Motion=unit_y_10)  # -> Geometry, Transform
move_19 = Move(Geometry=move_18.Geometry, Motion=unit_y_11)  # -> Geometry, Transform
move_20 = Move(Geometry=move_13.Geometry, Motion=unit_y_12)  # -> Geometry, Transform
move_21 = Move(Geometry=move_20.Geometry, Motion=unit_x_12)  # -> Geometry, Transform
move_22 = Move(Geometry=move_21.Geometry, Motion=unit_x_10)  # -> Geometry, Transform
move_23 = Move(Geometry=move_22.Geometry, Motion=unit_x_11)  # -> Geometry, Transform
move_24 = Move(Geometry=move_23.Geometry, Motion=unit_x_13)  # -> Geometry, Transform
move_25 = Move(Geometry=move_24.Geometry, Motion=unit_x_9)  # -> Geometry, Transform
curve_4 = Curve(<curve referenced from the Rhino model>)
curve_5 = Curve([<curve referenced from the Rhino model> x6])
curve_6 = Curve([<curve referenced from the Rhino model> x6])
curve_7 = Curve(<curve referenced from the Rhino model>)
unit_z_12 = UnitZ(Factor="-2.40")
unit_z_13 = UnitZ(Factor="-2.40")
unit_z_14 = UnitZ(Factor="-2.40")
unit_z_15 = UnitZ(Factor="-2.40")
extrude_2 = Extrude(Base=curve_6, Direction=unit_z_12)
extrude_3 = Extrude(Base=curve_7, Direction=unit_z_13)
extrude_4 = Extrude(Base=curve_5, Direction=unit_z_14)
extrude_5 = Extrude(Base=curve_4, Direction=unit_z_15)

# ---- group: AREAS 0 TO 9
data = Data([area_4.Area, area.Area, area_3.Area, area_2.Area])

# ---- group: AREAS 1 TO 0
data_2 = Data([area.Area, area_3.Area, area_2.Area, area_4.Area])

# ----
curve_8 = Curve(flatten(polyline))
curve_9 = Curve(flatten(polyline_2))
surface_split = SurfaceSplit(Surface=extrude_5, Curves=[move_17.Geometry, move_18.Geometry, move_16.Geometry, move_19.Geometry])
surface_split_2 = SurfaceSplit(
    Surface=extrude_2,
    Curves=[move_20.Geometry, move_21.Geometry, move_22.Geometry, move_23.Geometry, move_24.Geometry, move_25.Geometry])
surface_split_3 = SurfaceSplit(
    Surface=extrude_4,
    Curves=[move_10.Geometry, move_11.Geometry, move_12.Geometry, move_13.Geometry, boundary_surfaces_2, boundary_surfaces])
surface_split_4 = SurfaceSplit(Surface=extrude_3, Curves=[boundary_surfaces_3, move_14.Geometry, move_15.Geometry, boundary_surfaces_4])
cull_index = CullIndex(List=explode.Vertices, Indices=expression, Wrap=True)  # -> flatten(List)
cull_index_2 = CullIndex(List=explode_2.Vertices, Indices=expression, Wrap=True)  # -> flatten(List)
division = Division(A=data_2, B=2)
division_2 = Division(A=data, B=2)
cull_pattern = CullPattern(List=curve_8, CullPattern=[False, False, True])
cull_pattern_2 = CullPattern(List=curve_8, CullPattern=[True, True, False])
cull_pattern_3 = CullPattern(List=curve_9, CullPattern=[False, False, True])
cull_pattern_4 = CullPattern(List=curve_9, CullPattern=[True, True, False])
list_item_17 = ListItem(List=surface_split, Index=0, Wrap=True)
list_item_18 = ListItem(List=surface_split_2, Index=0, Wrap=True)
list_item_19 = ListItem(List=surface_split_3, Index=0, Wrap=True)
list_item_20 = ListItem(List=surface_split_4, Index=4, Wrap=True)
addition = Addition(A=division_2, B=division)
explode_3 = Explode(Curve=cull_pattern_3, Recursive=True)  # -> Segments, Vertices
explode_4 = Explode(Curve=cull_pattern_4, Recursive=True)  # -> Segments, Vertices
explode_5 = Explode(Curve=cull_pattern, Recursive=True)  # -> Segments, Vertices
explode_6 = Explode(Curve=cull_pattern_2, Recursive=True)  # -> Segments, Vertices
surface = Surface(list_item_17)
surface_2 = Surface(list_item_19)
surface_3 = Surface(list_item_18)
surface_4 = Surface(list_item_20)

# ---- group: CATENARY - DIAGONALS
curve_10 = Curve(flatten([explode_4.Segments, explode_6.Segments]))

# ---- group: CATENARY - TRANSVERSAL
curve_11 = Curve(flatten([explode_3.Segments, explode_5.Segments]))

# ---- group: CATENARY SEGMENTS
curve_12 = Curve(flatten([explode.Segments, explode_2.Segments]))

# ---- group: CATENARY POINTS TO APPLY LOAD
point = Point([cull_index, cull_index_2])

# ---- group: BUTTRESS MESH
mesh = Mesh(weaverbird_s_catmull_clark_subdivision)

# ----
mesh_2 = Mesh([surface_4, surface_2, surface, surface_3])

# ---- group: WALLS MESH
mesh_3 = Mesh(mesh_2)

# ---- group: EQUIVALENT AREA TO EACH CATENARY POINT
data_3 = Data(addition)

# ---- group: RIB CONNECTION POINTS
point_2 = Point(removeduplicatepts_2)

# ---- group: COLUMNS FOUNDATIONS - SUPPORTS
point_3 = Point(end_points_12.End)

# ---- group: COLUMNS
curve_13 = Curve(line_sdl_8)

# ---- group: BUTTRESS FOUNDATIONS - SUPPORTS
point_4 = Point(removeduplicatepts)

# ---- group: ADOBE BRICK PROPERTIES
young_s_modulus_n_mm_2 = Panel("80")
density_kg_m_3 = Panel("1200")
gravity_m_s_2 = Panel("9.81")
compressive_strength_n_mm_2 = Panel("1")
expression_4 = Expression(E=young_s_modulus_n_mm_2, Expression="E*0.1")
expression_5 = Expression(d=density_kg_m_3, g=gravity_m_s_2, Expression="(d*g)*0.001")
mpa_to_kn_cm_2 = Multiplication(A=compressive_strength_n_mm_2, B=0.1)
division_3 = Division(A=expression_4, B=2.5)

# ---- group: BRICK SIZE
width = Slider(0.2, range=0..1)
length = Slider(0.3, range=0..1)
height = Slider(0.1, range=0..1)
multiplication = Multiplication(A=height, B=100)
multiplication_2 = Multiplication(A=width, B=100)
multiplication_3 = Multiplication(A=length, B=100)
domain_box = DomainBox(Base=PlaneXY(0, 0, 0), Width=width, Length=length, Height=height)

# ----
point_5 = Point(point)

# ---- group: MATERIAL DEFINITION
material_properties_karamba3d = MaterialPropertiesKaramba3D(
    FamilyOfMaterial="Bricks",
    Name="Adobe Bricks ",
    YoungsModulus_kN_cm2=expression_4,
    InPlaneShearModulus_kN_cm2=division_3,
    TransverseShearModulus_kN_cm2=8076,
    SpecificWeight_kN_m3=expression_5,
    CoefficientOfThermalExpansion_1_C=1e-05,
    YieldStrength_kN_cm2=mpa_to_kn_cm_2,
    mode="Isotrop")

# ---- group: CROSS SECTION - WALLS
panel = Panel("Wall 1x1")
panel_2 = Panel("Walls")
panel_3 = Panel("w001")
brick_module = Panel("0.15")
multiplication_4 = Multiplication(A=Slider(3, range=1..10), B=brick_module)
multiplication_5 = Multiplication(A=multiplication_4, B=100)
cross_section_karamba3d = CrossSectionKaramba3D(
    FamilyNameOfCrossSection=panel_2,
    NameOfCrossSection=panel,
    ElementIdentifier=panel_3,
    Material=material_properties_karamba3d,
    Height_cm=multiplication_5,
    mode="Shell - Const")

# ---- group: CROSS SECTION - BUTTRESSES
panel_4 = Panel("w002")
brick_module_2 = Panel("0.15")
multiplication_6 = Multiplication(A=Slider(4, range=1..10), B=brick_module_2)
multiplication_7 = Multiplication(A=multiplication_6, B=100)
cross_section_karamba3d_2 = CrossSectionKaramba3D(
    FamilyNameOfCrossSection="Walls",
    NameOfCrossSection="Buttress",
    ElementIdentifier=panel_4,
    Material=material_properties_karamba3d,
    Height_cm=multiplication_7,
    mode="Shell - Const")

# ---- group: CROSS SECTION - RIBS
height_2 = Slider(0.6, range=0..2)
width_2 = Slider(0.45, range=0..2)
panel_5 = Panel("Ribs 2x3")
panel_6 = Panel("r001")
panel_7 = Panel("Catenary Ribs")
multiplication_8 = Multiplication(A=height_2, B=100)
multiplication_9 = Multiplication(A=width_2, B=100)
cross_section_karamba3d_3 = CrossSectionKaramba3D(
    FamilyNameOfCrossSection=panel_7,
    NameOfCrossSection=panel_5,
    ElementIdentifier=panel_6,
    Material=material_properties_karamba3d,
    Height_cm=multiplication_8,
    UpperFlangeWidth_cm=multiplication_9,
    LowerFlangeWidth_cm=multiplication_9,
    mode="Trapezoid")

# ---- group: CROSS SECTION - TRANSVERSAL RIBS
height_3 = Slider(0.45, range=0..2)
width_3 = Slider(0.3, range=0..2)
panel_8 = Panel("r002")
multiplication_10 = Multiplication(A=height_3, B=100)
multiplication_11 = Multiplication(A=width_3, B=100)
cross_section_karamba3d_4 = CrossSectionKaramba3D(
    FamilyNameOfCrossSection="Transversal Ribs",
    NameOfCrossSection="Ribs 3x4 T",
    ElementIdentifier=panel_8,
    Material=material_properties_karamba3d,
    Height_cm=multiplication_10,
    UpperFlangeWidth_cm=multiplication_11,
    LowerFlangeWidth_cm=multiplication_11,
    mode="Trapezoid")

# ---- group: CROSS SECTION - COLUMNS
height_4 = Slider(1.11, range=0..2)
width_4 = Slider(1.2, range=0..2)
panel_9 = Panel("c001")
multiplication_12 = Multiplication(A=height_4, B=100)
multiplication_13 = Multiplication(A=width_4, B=100)
cross_section_karamba3d_5 = CrossSectionKaramba3D(
    FamilyNameOfCrossSection="Columns",
    NameOfCrossSection="Columns 1x1",
    ElementIdentifier=panel_9,
    Material=material_properties_karamba3d,
    Height_cm=multiplication_12,
    UpperFlangeWidth_cm=multiplication_13,
    LowerFlangeWidth_cm=multiplication_13,
    mode="Trapezoid")

# ----
mesh_to_shell_karamba3d = MeshToShellKaramba3D(Mesh=flatten(mesh), Identifier=panel_4, CrossSection=cross_section_karamba3d_2, LimitDistance_m=0.005)  # -> Element, Points, Info

# ---- group: WALLS
unit_z_16 = UnitZ(Factor=Slider(3, range=0..3))  # -> expr("-x", UnitVector)
extrude_6 = Extrude(Base=curve_2, Direction=unit_z_16)
mesh_brep_2 = MeshBrep(
    Brep=extrude_6,
    Settings={GridMaxCount=0, GridMinCount=16, JaggedSeams=False, MaxEdgeLength=0, MinEdgeLength=0.0001, MinTolerance=0, Refine=True, RefineAngle=0, RelativeTolerance=0.65, SimplePlanes=True, Tolerance=0})
mesh_explode_2 = MeshExplode(Mesh=mesh_brep_2, Interpolate=False)
weaverbird_s_catmull_clark_subdivision_2 = WeaverbirdsCatmullClarkSubdivision(MeshCurves=mesh_explode_2, Level=Slider(3, range=0..10), SmoothNakedEdges=2)  # -> flatten(OutputMeshCurves)
nakedvertices_2 = NakedVertices(Mesh=mesh_2)  # -> ClothedIndex, NakedIndex, ClothedPts, flatten(NakedPts)
mesh_join_2 = MeshJoin(Meshes=weaverbird_s_catmull_clark_subdivision_2)
deconstruct_4 = Deconstruct(Point=nakedvertices_2.NakedPts)  # -> XComponent, YComponent, ZComponent
sort_list_4 = SortList(Keys=deconstruct_4.ZComponent, ValuesValuesA=nakedvertices_2.NakedPts)  # -> Keys, ValuesValuesA

# ----
smaller_than = SmallerThan(FirstNumber=sort_list_4.Keys, SecondNumber=0.01)  # -> SmallerThan, OrEqualTo

# ---- group: WALLS (continued)
dispatch_2 = Dispatch(List=sort_list_4.ValuesValuesA, DispatchPattern=smaller_than.SmallerThan)  # -> ListA, ListB
removeduplicatepts_3 = RemoveDuplicatePts(Points=dispatch_2.ListA, Tolerance=0.01)

# ---- group: WALL FOUNDATIONS - SUPPORTS
point_6 = Point(removeduplicatepts_3)

# ----
removeduplicatepts_4 = RemoveDuplicatePts(Points=[point_4, point_6], Tolerance=0.01)

# ---- group: ALL SUPPORTS - REMOVED DUPLICATE POINTS
point_7 = Point(removeduplicatepts_4)

# ---- group: LOADS
# Self-Weight Load
# Sand Load
# Infill Load
# Wind Load
facade_area_m_2 = Panel("1")
sand_thickness_m = Panel("0.1")
infill_thickness_m = Panel("0.1")
wind_speed_m_s = Panel("10")
sand_density_kg_m_3 = Panel("1400")
gravity_m_s_2_2 = Panel("9.81")
infill_density_kg_m_3 = Panel("1200")
gravity_m_s_2_3 = Panel("9.81")
air_density_kg_m_3 = Panel("1.2")
deconstruct_5 = Deconstruct(Point=point_5)  # -> XComponent, YComponent, ZComponent
expression_6 = Expression(
    Density=infill_density_kg_m_3,
    Thickness=infill_thickness_m,
    Area=data_3,
    Gravity=gravity_m_s_2_3,
    Expression="(((Density*(Thickness*Area))*Gravity))*10^-3")
expression_7 = Expression(
    Density=sand_density_kg_m_3,
    Thickness=sand_thickness_m,
    Area=data_3,
    Gravity=gravity_m_s_2_2,
    Expression="(((Density*(Thickness*Area))*Gravity))*10^-3")
expression_8 = Expression(
    Density=air_density_kg_m_3,
    Speed=wind_speed_m_s,
    Area=facade_area_m_2,
    Expression="(((Density*(Speed^2))*Area)*(1/2))*10^-3")
average = Average(Input=deconstruct_5.YComponent)
evaluate = Evaluate(Expression="if((X=A)or(X<A),1,0)", X=deconstruct_5.YComponent, A=average)
dispatch_3 = Dispatch(List=point_5, DispatchPattern=evaluate)  # -> ListA, ListB
Z = UnitZ(Factor=expression_6)
Z_2 = UnitZ(Factor=expression_7)
neg = Negative(Value=Z)
neg_2 = Negative(Value=Z_2)
point_8 = Point(dispatch_3.ListA)
self_weight = LoadsKaramba3D(Vector="0,0,-1", LCase="0", mode="Gravity")
sand_cat_a = LoadsKaramba3D(ForceVector=neg, Local=False, PosInd=point, LCase="2", mode="Point")
infill_cat_a = LoadsKaramba3D(ForceVector=neg_2, Local=False, PosInd=point, LCase="1", mode="Point")

# ----
unit_y_13 = UnitY(Factor=expression_8)

# ---- group: LOADS (continued)
wind = LoadsKaramba3D(ForceVector=unit_y_13, Local=False, PosInd=point_8, LCase="3", mode="Point")

# ---- group: STRUCTURAL ANALYSIS SET UP
line_to_beam_karamba3d = LineToBeamKaramba3D(
    Line=flatten(curve_10),
    Identifier=panel_6,
    CrossSection=cross_section_karamba3d_3,
    New=True,
    Remove=True,
    LimitDistance_m=0.005)  # -> Element, Points, Info
line_to_beam_karamba3d_2 = LineToBeamKaramba3D(
    Line=flatten(curve_11),
    Identifier=panel_8,
    CrossSection=cross_section_karamba3d_4,
    New=True,
    Remove=True,
    LimitDistance_m=0.005)  # -> Element, Points, Info
line_to_beam_karamba3d_3 = LineToBeamKaramba3D(
    Line=flatten(curve_13),
    Identifier=panel_9,
    CrossSection=cross_section_karamba3d_5,
    New=True,
    Remove=True,
    LimitDistance_m=0.005)  # -> Element, Points, Info; disabled
mesh_to_shell_karamba3d_2 = MeshToShellKaramba3D(Mesh=flatten(mesh_3), Identifier=panel_3, CrossSection=cross_section_karamba3d, LimitDistance_m=0.005)  # -> Element, Points, Info
beam_joints_karamba3d = BeamJointsKaramba3D(
    ElementIdentifiers=[panel_6, panel_8],
    CtKNMAtStartingNode=Vector(0, 0, 0),
    CrKNmRadAtStartingNode=Vector(0, 0, 0),
    CtKNMAtEndNode=Vector(0, 0, 0),
    CrKNmRadAtEndNode=Vector(0, 0, 0),
    menu=[buttons(on, on, on, on, on, on), buttons(on, on, on, on, on, on)])  # disabled
support_karamba3d = SupportKaramba3D(PosInd=flatten(point_7), menu=[buttons(on, on, on, on, on, on)])
beam_joint_agent_karamba3d = BeamJointAgentKaramba3D(
    AtElementIdentifiers=panel_6,
    ToGeometry=curve_13,
    Ct_kN_m=Vector(0, 0, 0),
    Cr_kNm_rad=Vector(0, 0, 0),
    menu=[buttons(on, on, on, on, on, on)])
assemble_model_karamba3d = AssembleModelKaramba3D(
    Elem=flatten([line_to_beam_karamba3d.Element, line_to_beam_karamba3d_2.Element, mesh_to_shell_karamba3d_2.Element, line_to_beam_karamba3d_3.Element, mesh_to_shell_karamba3d.Element]),
    Support=support_karamba3d,
    Load=flatten([self_weight, infill_cat_a, sand_cat_a, wind]),
    Joint=flatten(beam_joints_karamba3d),
    LimitDistance_m=0.005)  # -> Model, Info, Mass_kg, CenterOfGravity
analyze_karamba3d = AnalyzeKaramba3D(Model=assemble_model_karamba3d.Model)  # -> CalculatedModel, MaximumDisplacement_cm, ResultingForceOfGravity_kN, ElasticEnergy_kNm

# ---- group: STRUCTURAL MODEL VIEW SET UP
colour_swatch = ColourSwatch(SwatchColor=RGB(222, 103, 0))
colour_swatch_2 = ColourSwatch(SwatchColor=RGB(123, 228, 255))
merge = Merge(
    Data1=colour_swatch,
    Data2=colour_swatch,
    Data3=colour_swatch,
    Data4=colour_swatch_2,
    Data5=colour_swatch_2,
    Data6=colour_swatch_2)
model_view_karamba3d = ModelViewKaramba3D(Model=analyze_karamba3d.CalculatedModel, ResultFactors=1, ResultCase=-1, Colors=merge)  # -> Model, DeformedMesh, DeformedAxes, DeformedModel

# ---- group: RIBS STRUCTURAL RESULTS
beamview = BeamViewKaramba3D(Model=model_view_karamba3d.Model)  # -> Model, MeshesOfRenderedBeams, DeformedBeamAxes, LegendColors, LegendTags
legend = Legend(Colour=beamview.LegendColors, Tags=beamview.LegendTags, LegendType=1)
utilization = UtilizationOfElementsKaramba3D(
    AnalyzedModel=beamview.Model,
    ResultCase=-1,
    NumberOfSamplePoints=3,
    ElasticDesign=True,
    GammaM0=1,
    GammaM1=1,
    WithDetails=False,
    mode="Beams")  # -> AnalyzedModel, Utilization, SigMax_kN_cm2, SigMin_kN_cm2, TauMax_kN_cm2, UtilN, UtilVy, UtilVz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
sort = SortList(Keys=utilization.Utilization)  # -> reverse(Keys), ValuesA
sort_2 = SortList(Keys=utilization.SigMax_kN_cm2)  # -> reverse(Keys), ValuesA
sort_3 = SortList(Keys=utilization.SigMin_kN_cm2)  # -> reverse(Keys), ValuesA
panel_10 = Panel(sort_3.Keys)
panel_11 = Panel(sort.Keys)
panel_12 = Panel(sort_2.Keys)

# ---- group: WALLS STRUCTURAL RESULTS
shell_view_karamba3d = ShellViewKaramba3D(Model=model_view_karamba3d.Model, IndexOfLayer=0)  # -> Model, MeshesOfRenderedShells, LegendColors, LegendTags
legend_2 = Legend(Colour=shell_view_karamba3d.LegendColors, Tags=shell_view_karamba3d.LegendTags, LegendType=1)
result_vectors_on_shells_karamba3d = ResultVectorsOnShellsKaramba3D(AnalyzedModel=shell_view_karamba3d.Model, LayerPosition=0, mode="PrincStress")  # -> AnalyzedModel, Points, FirstPrincipalStressVector_kN_cm2, SecondPrincipalStressVector_kN_cm2, FirstPrincipalStressValue_kN_cm2, SecondPrincipalStressValue_kN_cm2
sort_list_5 = SortList(Keys=result_vectors_on_shells_karamba3d.FirstPrincipalStressValue_kN_cm2)  # -> reverse(Keys), ValuesValuesA
panel_13 = Panel(sort_list_5.Keys)

# ---- group: STRUCTURAL OPTIMIZATION - RIBS
panel_14 = Panel("1 to 100")  # disabled
panel_15 = Panel("1 to 100")  # disabled
panel_16 = Panel("99")  # disabled
panel_17 = Panel("99")  # disabled
range_4 = Range(Domain=panel_14, Steps=panel_16)  # disabled
range_5 = Range(Domain=panel_15, Steps=panel_17)  # disabled
cross_section_karamba3d_6 = CrossSectionKaramba3D(
    FamilyNameOfCrossSection=panel_7,
    NameOfCrossSection=panel_5,
    ElementIdentifier=panel_6,
    Material=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,
    Height_cm=range_4,
    UpperFlangeWidth_cm=range_5,
    LowerFlangeWidth_cm=range_5,
    mode="Trapezoid")  # disabled
number_slider_2 = Slider(0.02, range=0..1)  # disabled
optimize_cross_section_karamba3d = OptimizeCrossSectionKaramba3D(
    Model=beamview.Model,
    CrossSections=cross_section_karamba3d_6,
    MaximumUtilization=number_slider_2,
    MaximumDisplacement_cm=-1,
    UltimateLimitStateIterations=5,
    DisplacementIterations=5,
    NumberOfSamplePoints=3,
    ElasticDesign=True,
    GammaM0=1,
    GammaM1=1)  # -> ModelWithOptimizedCrossSections, Info, Mass_kg, MaximumDisplacement_cm, ElasticEnergy_kNm; disabled
colour_swatch_3 = ColourSwatch(SwatchColor=RGB(222, 103, 0))  # disabled
colour_swatch_4 = ColourSwatch(SwatchColor=RGB(123, 228, 255))  # disabled
merge_2 = Merge(
    Data1=colour_swatch_3,
    Data2=colour_swatch_3,
    Data3=colour_swatch_3,
    Data4=colour_swatch_4,
    Data5=colour_swatch_4,
    Data6=colour_swatch_4)  # disabled
model_view_karamba3d_2 = ModelViewKaramba3D(Model=optimize_cross_section_karamba3d.ModelWithOptimizedCrossSections, ResultFactors=1, ResultCase=-1, Colors=merge_2)  # -> Model, DeformedMesh, DeformedAxes, DeformedModel; disabled
beamview_2 = BeamViewKaramba3D(Model=model_view_karamba3d_2.Model)  # -> Model, MeshesOfRenderedBeams, DeformedBeamAxes, LegendColors, LegendTags; disabled
legend_3 = Legend(Colour=beamview_2.LegendColors, Tags=beamview_2.LegendTags, LegendType=1)  # disabled
utilization_2 = UtilizationOfElementsKaramba3D(
    AnalyzedModel=beamview_2.Model,
    ResultCase=-1,
    NumberOfSamplePoints=3,
    ElasticDesign=True,
    GammaM0=1,
    GammaM1=1,
    WithDetails=False,
    mode="Beams")  # -> AnalyzedModel, Utilization, SigMax_kN_cm2, SigMin_kN_cm2, TauMax_kN_cm2, UtilN, UtilVy, UtilVz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; disabled
sort_4 = SortList(Keys=utilization_2.Utilization)  # -> reverse(Keys), ValuesA; disabled
sort_5 = SortList(Keys=utilization_2.SigMax_kN_cm2)  # -> reverse(Keys), ValuesA; disabled
sort_6 = SortList(Keys=utilization_2.SigMin_kN_cm2)  # -> reverse(Keys), ValuesA; disabled
panel_18 = Panel(sort_4.Keys)  # disabled
panel_19 = Panel(sort_5.Keys)  # disabled
panel_20 = Panel(sort_6.Keys)  # disabled

# ---- group: STRUCTURAL OPTIMIZATION - WALLS
panel_21 = Panel("1 to 100")  # disabled
panel_22 = Panel("99")  # disabled
range_6 = Range(Domain=panel_21, Steps=panel_22)  # disabled
cross_section_karamba3d_7 = CrossSectionKaramba3D(
    FamilyNameOfCrossSection=panel_2,
    NameOfCrossSection=panel,
    ElementIdentifier=panel_3,
    Material=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,
    Height_cm=range_6,
    mode="Shell - Const")  # disabled
number_slider_3 = Slider(0.02, range=0..1)  # disabled
optimize_cross_section_karamba3d_2 = OptimizeCrossSectionKaramba3D(
    Model=beamview.Model,
    CrossSections=cross_section_karamba3d_7,
    MaximumUtilization=number_slider_3,
    MaximumDisplacement_cm=-1,
    UltimateLimitStateIterations=5,
    DisplacementIterations=5,
    NumberOfSamplePoints=3,
    ElasticDesign=True,
    GammaM0=1,
    GammaM1=1)  # -> ModelWithOptimizedCrossSections, Info, Mass_kg, MaximumDisplacement_cm, ElasticEnergy_kNm; disabled
colour_swatch_5 = ColourSwatch(SwatchColor=RGB(222, 103, 0))  # disabled
colour_swatch_6 = ColourSwatch(SwatchColor=RGB(123, 228, 255))  # disabled
merge_3 = Merge(
    Data1=colour_swatch_5,
    Data2=colour_swatch_5,
    Data3=colour_swatch_5,
    Data4=colour_swatch_6,
    Data5=colour_swatch_6,
    Data6=colour_swatch_6)  # disabled
model_view_karamba3d_3 = ModelViewKaramba3D(Model=optimize_cross_section_karamba3d_2.ModelWithOptimizedCrossSections, ResultFactors=1, ResultCase=-1, Colors=merge_3)  # -> Model, DeformedMesh, DeformedAxes, DeformedModel; disabled
beamview_3 = BeamViewKaramba3D(Model=model_view_karamba3d_3.Model)  # -> Model, MeshesOfRenderedBeams, DeformedBeamAxes, LegendColors, LegendTags; disabled
legend_4 = Legend(Colour=beamview_3.LegendColors, Tags=beamview_3.LegendTags, LegendType=1)  # disabled
utilization_3 = UtilizationOfElementsKaramba3D(
    AnalyzedModel=beamview_3.Model,
    ResultCase=-1,
    NumberOfSamplePoints=3,
    ElasticDesign=True,
    GammaM0=1,
    GammaM1=1,
    WithDetails=False,
    mode="Beams")  # -> AnalyzedModel, Utilization, SigMax_kN_cm2, SigMin_kN_cm2, TauMax_kN_cm2, UtilN, UtilVy, UtilVz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; disabled
sort_7 = SortList(Keys=utilization_3.Utilization)  # -> reverse(Keys), ValuesA; disabled
sort_8 = SortList(Keys=utilization_3.SigMax_kN_cm2)  # -> reverse(Keys), ValuesA; disabled
sort_9 = SortList(Keys=utilization_3.SigMin_kN_cm2)  # -> reverse(Keys), ValuesA; disabled
panel_23 = Panel(sort_7.Keys)  # disabled
panel_24 = Panel(sort_8.Keys)  # disabled
panel_25 = Panel(sort_9.Keys)  # disabled

# ---- group: WALLS - TENSION STRESSES THRESHOLD
division_4 = Division(A=mpa_to_kn_cm_2, B=10)
larger_than = LargerThan(FirstNumber=result_vectors_on_shells_karamba3d.FirstPrincipalStressValue_kN_cm2, SecondNumber=division_4)  # -> LargerThan, OrEqualTo
dispatch_4 = Dispatch(List=result_vectors_on_shells_karamba3d.FirstPrincipalStressValue_kN_cm2, DispatchPattern=larger_than.LargerThan)  # -> ListA, ListB
panel_26 = Panel(dispatch_4.ListA)

# ---- group: RIBS - TENSION STRESSES THRESHOLD
division_5 = Division(A=mpa_to_kn_cm_2, B=10)
larger_than_2 = LargerThan(FirstNumber=utilization.SigMax_kN_cm2, SecondNumber=division_5)  # -> LargerThan, OrEqualTo
dispatch_5 = Dispatch(List=utilization.SigMax_kN_cm2, DispatchPattern=larger_than_2.LargerThan)  # -> ListA, ListB
panel_27 = Panel(dispatch_5.ListA)
